# Grasshopper definition FD-path planning.gh (Grasshopper 1.0.7)
# plug-ins: Kangaroo Components

python = GhPythonScript(deltaX=Slider(506.58, range=-1000..10000), deltaY=Slider(525, range=0..10000), deltaZ=Slider(50, range=0..500))  # -> out, myMove
# ---------- python: Python ----------
import Rhino.Geometry as rg

myMove = rg.Vector3d(deltaX,deltaY,deltaZ)
# ---------- end python ----------

python_2 = GhPythonScript(deltaX=Slider(500, range=-1000..10000), deltaY=Slider(514, range=0..10000), deltaZ=Slider(150, range=0..500))  # -> out, myMove; same code as python

python_3 = GhPythonScript(deltaX=Slider(500, range=-1000..10000), deltaY=Slider(500, range=0..10000), deltaZ=Slider(0, range=0..500))  # -> out, myMove; same code as python

python_4 = GhPythonScript(deltaX=Slider(505, range=-1000..10000), deltaY=Slider(520, range=0..10000), deltaZ=Slider(200, range=0..500))  # -> out, myMove; same code as python

python_5 = GhPythonScript(deltaX=Slider(402, range=-1000..10000), deltaY=Slider(540, range=0..10000), deltaZ=Slider(100, range=0..500))  # -> out, myMove; same code as python

python_6 = GhPythonScript(deltaX=Slider(497.26, range=-1000..10000), deltaY=Slider(494.41, range=0..10000), deltaZ=Slider(250, range=0..500))  # -> out, myMove; same code as python

python_7 = GhPythonScript(deltaX=Slider(-1000, range=-1000..10000), deltaY=Slider(0, range=0..10000), deltaZ=Slider(0, range=0..500))  # -> out, myMove; same code as python

python_8 = GhPythonScript(deltaX=Slider(420, range=-1000..10000), deltaY=Slider(710, range=0..10000), deltaZ=Slider(250, range=0..500))  # -> out, myMove; same code as python
number_slider = Slider(2, range=0..100)
number_slider_2 = Slider(2, range=0..100)
number_slider_3 = Slider(1.5, range=0..10)
number_slider_4 = Slider(2, range=0..100)
number_slider_5 = Slider(1.5, range=0..10)
number_slider_6 = Slider(1.5, range=0..10)
number_slider_7 = Slider(2, range=0..100)
number_slider_8 = Slider(1.5, range=0..10)
number_slider_9 = Slider(1, range=0..10)
number_slider_10 = Slider(2, range=0..100)
number_slider_11 = Slider(1.5, range=0..10)
number_slider_12 = Slider(1.5, range=0..10)
list = ValueList({"None": "", "Dot": "0.1 1.0", "Dash": "1.0", "DashDot": "1.0 1.0 0.1 1.0"}, selected="None")
dom = ConstructDomain(DomainStart=expr("-x/2", number_slider_3), DomainEnd=expr("x/2", number_slider_3))
dom_2 = ConstructDomain(DomainStart=expr("-x/2", number_slider_3), DomainEnd=expr("x/2", number_slider_3))
number_slider_13 = Slider(1, range=0..10)
dom_3 = ConstructDomain(DomainStart=expr("-x/2", number_slider_5), DomainEnd=expr("x/2", number_slider_5))
dom_4 = ConstructDomain(DomainStart=expr("-x/2", number_slider_5), DomainEnd=expr("x/2", number_slider_5))
dom_5 = ConstructDomain(DomainStart=expr("-x/2", number_slider_6), DomainEnd=expr("x/2", number_slider_6))
dom_6 = ConstructDomain(DomainStart=expr("-x/2", number_slider_6), DomainEnd=expr("x/2", number_slider_6))
number_slider_14 = Slider(1, range=0..10)
number_slider_15 = Slider(1, range=0..10)
dom_7 = ConstructDomain(DomainStart=expr("-x/2", number_slider_8), DomainEnd=expr("x/2", number_slider_8))
dom_8 = ConstructDomain(DomainStart=expr("-x/2", number_slider_8), DomainEnd=expr("x/2", number_slider_8))
list_2 = ValueList({"None": "", "Dot": "0.1 1.0", "Dash": "1.0", "DashDot": "1.0 1.0 0.1 1.0"}, selected="None")
list_3 = ValueList({"None": "", "Dot": "0.1 1.0", "Dash": "1.0", "DashDot": "1.0 1.0 0.1 1.0"}, selected="None")
list_4 = ValueList({"None": "", "Dot": "0.1 1.0", "Dash": "1.0", "DashDot": "1.0 1.0 0.1 1.0"}, selected="None")
list_5 = ValueList({"None": "", "Dot": "0.1 1.0", "Dash": "1.0", "DashDot": "1.0 1.0 0.1 1.0"}, selected="None")
dom_9 = ConstructDomain(DomainStart=expr("-x/2", number_slider_11), DomainEnd=expr("x/2", number_slider_11))
dom_10 = ConstructDomain(DomainStart=expr("-x/2", number_slider_11), DomainEnd=expr("x/2", number_slider_11))
dom_11 = ConstructDomain(DomainStart=expr("-x/2", number_slider_12), DomainEnd=expr("x/2", number_slider_12))
dom_12 = ConstructDomain(DomainStart=expr("-x/2", number_slider_12), DomainEnd=expr("x/2", number_slider_12))
list_6 = ValueList({"None": "", "Dot": "0.1 1.0", "Dash": "1.0", "DashDot": "1.0 1.0 0.1 1.0"}, selected="None")
list_7 = ValueList({"None": "", "Dot": "0.1 1.0", "Dash": "1.0", "DashDot": "1.0 1.0 0.1 1.0"}, selected="None")
list_8 = ValueList({"None": "", "Dot": "0.1 1.0", "Dash": "1.0", "DashDot": "1.0 1.0 0.1 1.0"}, selected="None")
list_9 = ValueList({"None": "", "Dot": "0.1 1.0", "Dash": "1.0", "DashDot": "1.0 1.0 0.1 1.0"}, selected="None")
list_10 = ValueList({"None": "", "Dot": "0.1 1.0", "Dash": "1.0", "DashDot": "1.0 1.0 0.1 1.0"}, selected="None")
list_11 = ValueList({"None": "", "Dot": "0.1 1.0", "Dash": "1.0", "DashDot": "1.0 1.0 0.1 1.0"}, selected="None")
list_12 = ValueList({"None": "", "Dot": "0.1 1.0", "Dash": "1.0", "DashDot": "1.0 1.0 0.1 1.0"}, selected="None")
list_13 = ValueList({"None": "", "Dot": "0.1 1.0", "Dash": "1.0", "DashDot": "1.0 1.0 0.1 1.0"}, selected="None")
list_14 = ValueList({"None": "", "Dot": "0.1 1.0", "Dash": "1.0", "DashDot": "1.0 1.0 0.1 1.0"}, selected="None")
list_15 = ValueList({"None": "", "Dot": "0.1 1.0", "Dash": "1.0", "DashDot": "1.0 1.0 0.1 1.0"}, selected="None")
list_16 = ValueList({"None": "", "Dot": "0.1 1.0", "Dash": "1.0", "DashDot": "1.0 1.0 0.1 1.0"}, selected="None")
list_17 = ValueList({"None": "", "Dot": "0.1 1.0", "Dash": "1.0", "DashDot": "1.0 1.0 0.1 1.0"}, selected="None")
list_18 = ValueList({"None": "", "Dot": "0.1 1.0", "Dash": "1.0", "DashDot": "1.0 1.0 0.1 1.0"}, selected="None")
list_19 = ValueList({"None": "", "Dot": "0.1 1.0", "Dash": "1.0", "DashDot": "1.0 1.0 0.1 1.0"}, selected="None")
list_20 = ValueList({"None": "", "Dot": "0.1 1.0", "Dash": "1.0", "DashDot": "1.0 1.0 0.1 1.0"}, selected="None")
# Lobster Tail Seafood Restaurant
panel = Panel("EscalatorE_L4")
panel_2 = Panel("Gro Urban Oasis")
# Lobster Tail Seafood Restaurant
panel_3 = Panel("EscalatorA_L2")
list_21 = ValueList({"EscalatorB_L2", "EscalatorC_L2", "LiftA_L2", "LiftB_L2", "StairsA_L2", "EscalatorD_L2"}, selected="EscalatorD_L2")  # disabled
list_22 = ValueList({"None": "", "Dot": "0.1 1.0", "Dash": "1.0", "DashDot": "1.0 1.0 0.1 1.0"}, selected="None")
list_23 = ValueList({"None": "", "Dot": "0.1 1.0", "Dash": "1.0", "DashDot": "1.0 1.0 0.1 1.0"}, selected="None")
list_24 = ValueList({"EscalatorB_L2", "EscalatorC_L2", "LiftA_L2", "LiftB_L2", "StairsA_L2", "EscalatorD_L2"}, selected="EscalatorD_L2")
# Lobster Tail Seafood Restaurant
panel_5 = Panel("Gro Urban Oasis")
list_25 = ValueList({"None": "", "Dot": "0.1 1.0", "Dash": "1.0", "DashDot": "1.0 1.0 0.1 1.0"}, selected="None")
list_26 = ValueList({"LiftB_L3", "EscalatorF_L3", "LiftC_L3", "EscalatorE_L3"}, selected="EscalatorE_L3")  # disabled
number_slider_16 = Slider(2, range=0..100)
number_slider_17 = Slider(150, range=0..1000)
panel_6 = Panel("Corridor_L6_8")
list_27 = ValueList({"None": "", "Dot": "0.1 1.0", "Dash": "1.0", "DashDot": "1.0 1.0 0.1 1.0"}, selected="None")
list_28 = ValueList({"LiftA_L5", "EscalatorA_L5", "EscalatorB_L5", "LiftB_L5", "EscalatorC_L5", "EscalatorE_L5", "EscalatorD_L5"}, selected="LiftB_L5")
num = Number(Slider(25.12, range=0..1000))
list_29 = ValueList({"EscalatorA_L1", "EscalatorB_L1", "EscalatorC_L1", "LiftA_L1", "LiftB_L1", "StairsA_L1"}, selected="StairsA_L1")
list_30 = ValueList({"None": "", "Dot": "0.1 1.0", "Dash": "1.0", "DashDot": "1.0 1.0 0.1 1.0"}, selected="Dash")
list_31 = ValueList({"9", "4.5"}, selected="9")
list_32 = ValueList({"None": "", "Dot": "0.1 1.0", "Dash": "1.0", "DashDot": "1.0 1.0 0.1 1.0"}, selected="None")
material = CreateMaterial(
    Diffuse=RGB(255, 105, 180),
    Specular=RGB(255, 255, 255),
    Emission=RGB(0, 0, 0),
    Transparency=Slider(0.9, range=0..1),
    Shine=0)
material_2 = CreateMaterial(
    Diffuse=RGB(255, 105, 180),
    Specular=RGB(255, 255, 255),
    Emission=RGB(0, 0, 0),
    Transparency=Slider(0.9, range=0..1),
    Shine=0)
list_33 = ValueList({"9", "4.5"}, selected="9")
X = UnitX(Factor=Slider(1000, range=0..1000))
list_34 = ValueList({"None": "", "Dot": "0.1 1.0", "Dash": "1.0", "DashDot": "1.0 1.0 0.1 1.0"}, selected="None")
panel_8 = Panel("""Myer L5
Coles""")
crv = Curve([<curve referenced from the Rhino model> x6])  # disabled
pt = Point(<point referenced from the Rhino model>)  # disabled
panel_9 = Panel("""Bondi Hair
McDonald's
Target
Myer L5""")
python_9 = GhPythonScript(myP=pt, myCur=crv)  # -> out, a, allLinked; inputs myP: Point3d, myCur: list of Curve; disabled
# ---------- python_9: Python ----------
a = myCur[0]
allLinked = []
#print a.ClosestPoint(myP, 0.001)

for i in range(0,len(myCur)):
    onLine, t = myCur[i].ClosestPoint(myP, 0.001)
    print onLine
    if onLine:
        allLinked.append(myCur[i])
# ---------- end python_9 ----------
crv_2 = Curve(python_9.allLinked)
list_35 = ValueList({"None": "", "Dot": "0.1 1.0", "Dash": "1.0", "DashDot": "1.0 1.0 0.1 1.0"}, selected="None")
panel_10 = Panel("""NAB
StairsA_L1
QBD Books
Sushi Connection- Level 1
Pearsons Florist
NEWS KING
Banana Blossom
LiftA_L1
EscalatorC_L1
Bailey Nelson
Howards Storage World
EB Game
Specsavers
Telstra
Flight Centre
David Jones L1
ATM B L1
Shop_L1_38
Bondi Hair
Vodafone - Level 1
ATM A L1
Results Laser Clinic
digiDIRECT
Optus
LiftB_L1
ToiletA_L1
EscalatorA_L1
Godfreys
Just Cuts
EscalatorB_L1
Room 4 Pets
Oriental Massage
Shop_L1_52
Shop_L1_39
PharmaSave Pharmacy
Hairhouse Warehouse
Flight Centre Tailor Made
Fresh Nails
Shop_L1_4
Michel's Dry Cleaners
1001 Optical
Riot Art & Craft
Shop_L1_9
Stylz Hair
LensPro
Bags to Go
Kibbutz
STA Travel
Bakers Delight
Vince Scalone Barber
ANZ
Bupa Optical
Oxford
Westpac
Ella Baché
ProfessioNAIL
Bupa Dental
Medibank
Evolution Laser Clinic
EscalatorD_L2
Perfect Potion
Toby's Estate
Bench A L2
Cotton On Body
Windsor Smith
Bench B L2
Typo
Nike
2XU
Shop_L2_16
Lorna Jane
Bench B L2
EscalatorA_L2
Oxford
Tremlett Jewellery
Shop_L2_22
Witchery
EscalatorC_L2
Blue Illusion
Toby's Estate
Bonds
Bench A L2
adidas Sports Performance 2
Florshiem
adidas Sports Performance 1
ToiletA_L2
ZJOOSH
LiftA_L2
Tree Of Life
Evolution Laser Clinic
Foot Locker
Wittner
Shop_L2_34
Shop_L2_20
Perfect Potion
Peter Jackson
Ella Baché
Ignazia
Cotton On
THE UPSIDE
ToiletA_L3
Princess Highway
Aesop
EscalatorD_L3
L'urv
OMEGA
Dior Perfume & Beauty Boutique
M.A.C
L'Occitane en Provence
ToiletA_L4
Rodd & Gunn
EscalatorB_L4
Simone Perele
EscalatorE_L4
Salvatore Ferragamo
BenchB L4
BenchA L4
EscalatorA_L5
ToiletA_L5
ATM_L5
Le Creuset
Holistic Massage & Acupuncture
BenchD_L5
BenchC_L5
The Cancer Council
BenchB_L5
BenchA_L5
EscalatorE_L5
Ripe Maternity
Laser Clinics Australia
Medi Physio
Fresh Therapeutics Pharmacy and Compounding Chemist
LiftB_L6
Myhealth Medical Centre
ABC Dental
Body Sculpting Clinics
BenchB L6""")
X_2 = UnitX(Factor=Slider(0, range=0..1000))
list_36 = ValueList({"None": "", "Dot": "0.1 1.0", "Dash": "1.0", "DashDot": "1.0 1.0 0.1 1.0"}, selected="None")
panel_11 = Panel("red")
number_slider_18 = Slider(0, range=0..1000)
number_slider_19 = Slider(0, range=0..10)
Y = UnitY(Factor=number_slider_18)
Y_2 = UnitY(Factor=number_slider_18)
Y_3 = UnitY(Factor=number_slider_18)
Y_4 = UnitY(Factor=number_slider_18)
Y_5 = UnitY(Factor=number_slider_18)
number_slider_20 = Slider(3, range=0..10)
Y_6 = UnitY(Factor=number_slider_18)
Y_7 = UnitY(Factor=number_slider_18)
list_37 = ValueList({"None": "", "Dot": "0.1 1.0", "Dash": "1.0", "DashDot": "1.0 1.0 0.1 1.0"}, selected="None")
number_slider_21 = Slider(3, range=0..10)
number_slider_22 = Slider(3, range=0..10)
list_38 = ValueList({"None": "", "Dot": "0.1 1.0", "Dash": "1.0", "DashDot": "1.0 1.0 0.1 1.0"}, selected="None")
list_39 = ValueList({"None": "", "Dot": "0.1 1.0", "Dash": "1.0", "DashDot": "1.0 1.0 0.1 1.0"}, selected="None")
number_slider_23 = Slider(1, range=0..10)
list_40 = ValueList({"None": "", "Dot": "0.1 1.0", "Dash": "1.0", "DashDot": "1.0 1.0 0.1 1.0"}, selected="None")
list_41 = ValueList({"None": "", "Dot": "0.1 1.0", "Dash": "1.0", "DashDot": "1.0 1.0 0.1 1.0"}, selected="None")
number_slider_24 = Slider(3, range=0..10)
list_42 = ValueList({"None": "", "Dot": "0.1 1.0", "Dash": "1.0", "DashDot": "1.0 1.0 0.1 1.0"}, selected="None")
list_43 = ValueList({"None": "", "Dot": "0.1 1.0", "Dash": "1.0", "DashDot": "1.0 1.0 0.1 1.0"}, selected="None")
material_3 = CreateMaterial(Diffuse="255,0,255", Specular="255,0,255", Emission="255,0,255", Transparency=Slider(0.9, range=0..1), Shine=0)

# ----
# Level 4
toggle = BooleanToggle(False)
path = FilePath("E:\00 - Workdata of Research\01 - Paper writting\03 - Personalized Pedestrian Navigation Path Options\03 - Bondi Junction\Version 2\02 - ShapeFiles\L4\L4_QRTags_Add.shp")
path_2 = FilePath("E:\00 - Workdata of Research\01 - Paper writting\03 - Personalized Pedestrian Navigation Path Options\03 - Bondi Junction\Version 2\02 - ShapeFiles\L4\L4_QRTags.shp")
path_3 = FilePath("E:\00 - Workdata of Research\01 - Paper writting\03 - Personalized Pedestrian Navigation Path Options\03 - Bondi Junction\Version 2\02 - ShapeFiles\L4\L4_shops.shp")
path_4 = FilePath("E:\00 - Workdata of Research\01 - Paper writting\03 - Personalized Pedestrian Navigation Path Options\03 - Bondi Junction\Version 2\02 - ShapeFiles\L4\L4_corridor_holes.shp")
path_5 = FilePath("E:\00 - Workdata of Research\01 - Paper writting\03 - Personalized Pedestrian Navigation Path Options\03 - Bondi Junction\Version 2\02 - ShapeFiles\L4\L4_corridor.shp")
shp_import = ShapefileImport(path=path_3, read_geometry=toggle, read_records=toggle)  # -> out, shape_type, flatten(geometry), fields, field_names, flatten(records); inputs path: tree, read_geometry: tree of Boolean, read_records: tree of Boolean, field_ids: tree, enc: tree
# ---------- shp_import: Python ----------
# -*- coding: utf-8 -*-

# Source code available at https://github.com/hiteca

"""
Component to import geometry and data from ESRI Shapefile.

    Args:
        path: Path to .shp file
        read_geometry: [bool, optional] Toggle to read geometry.
                        Default - True.
        read_records: [bool, optional] Toggle to read data.
                        Default - True.
        field_ids: List of data column to read. 
                    Default - read all columns.
        enc: File encoding. 
                Default - utf-8
    Returns:
        shape_type: pyShp shape type (1 - point, 3 - polyline, 5 - polygon...). See full list at https://github.com/GeospatialPython/pyshp
        geometry: Imported geometry from shp. Each shape is in own branch
        fields: List of fields (format - "name|type|length")
        field_names: List of field names
        records: Data rows. Each row in own branch
"""
ghenv.Component.Name = "Shapefile Import"
ghenv.Component.NickName = 'Shp Import'
ghenv.Component.IconDisplayMode = ghenv.Component.IconDisplayMode.icon
ghenv.Component.Category = "Extra"
ghenv.Component.SubCategory = "Hiteca"
try: ghenv.Component.AdditionalHelpFromDocStrings = "2"
except: pass


import System
import clr
clr.AddReference("Grasshopper")
from Grasshopper.Kernel.Data import GH_Path
from Grasshopper import DataTree

import Grasshopper.Kernel as gh

we = gh.GH_RuntimeMessageLevel.Error
ww = gh.GH_RuntimeMessageLevel.Warning

try:
    import shapefile
except:
    message = "Python module 'pyshp' not found. Please download it and install to Rhino IronPython folder using manual at https://github.com/hiteca/ghshp"
    ghenv.Component.AddRuntimeMessage(we, message)
    message = "https://github.com/hiteca/ghshp#install-pyshp"
    ghenv.Component.AddRuntimeMessage(we, message)

import Rhino as rc

def list2branch(source_tree,data,item_index,data_path):
    _p = GH_Path(data_path).AppendElement(item_index)
    for i in range(len(data)):
        _data = data[i]
        if type(_data) == list:
            soruce_tree = v2branch(source_tree,_data,i,_p)
        else:
            source_tree.AddRange([_data],GH_Path(_p))
    return source_tree
    

def py_tree(source_tree, reverse=False, default=None):
    if not reverse:
        result = {}
        for i in range(len(source_tree.Branches)):
            d = source_tree.Branches[i]
            p = GH_Path(source_tree.Paths[i])
            
            result[p] = list(d)
        if len(result.keys())==0:
            result[GH_Path(0)] = [default]
    else:
        result = DataTree[System.Object]()
        for p in source_tree.keys():
            d = source_tree[p]
            _d = []
            for j in range(len(d)):
                data = d[j]
                if type(data) == list:
                    result = list2branch(result,data,j,p)
                else:
                    _d.append(data)
            if len(_d) > 0:
                result.AddRange(_d,p)
                
    return result

def repeat_latest(data,length):
    if len(data) > length:
        return data[:length]
    else:
        return data + ([data[-1]] * (length - len(data)))

def graft_tree(t):
    r = {}
    for k,v in t.items():
        for i in range(len(v)):
            r[GH_Path(k).AppendElement(i)] = [v[i]]
    return r
    
def longest_list(t_a,t_b):
    r_b = {}
    r_a = {}
    prev_a = t_a.items()[0][1]
    prev_b = t_b.items()[0][1]
    
    if len(t_a) >= len(t_b):
        keys = t_a.keys()
    else:
        keys = t_b.keys()

    keys = sorted(keys, key=lambda x: str(GH_Path(x)))

    for k in keys:
        try:
            branch_a = t_a[k]
            prev_a = t_a[k]
        except:
            branch_a = prev_a
        try:
            branch_b = t_b[k]
            prev_b = t_b[k]
        except:
            branch_b = prev_b
        max_len = max(len(branch_b),len(branch_a))
        if len(branch_b) >= len(branch_a):
            branch_a = repeat_latest(branch_a, len(branch_b))
        else:
            branch_b = repeat_latest(branch_b, len(branch_a))
        r_a[k] = branch_a
        r_b[k] = branch_b
        
    return(r_a,r_b)


shape_types = {
    "point" : [
        1, #POINT
        8, #MULTIPOINT
        11, #POINTZ
        18, #MULTIPOINTZ
        21, #POINTM
        28, #MULTIPOINTM
    ],
    "polyline": [
        3, #POLYLINE
        5, #POLYGON
        13, #POLYLINEZ
        15, #POLYGONZ
        23, #POLYLINEM
        25, #POLYGONM
        31, #MULTIPATCH
    ]
}

def find_type(t):
    for k in shape_types.keys():        
        if t in shape_types[k]:
            return k
            

def list2point(pt):
    pt = list(pt)
    if len(pt)==2:
        pt.append(0)
    return rc.Geometry.Point3d(pt[0],pt[1],pt[2])
    
def read_shapefile(file_path, read_data=True, read_geom=True, enc="utf-8"):
    result_geom = []
    result_fields = []
    result_field_names = []
    result_records = []
    if read_data or read_geom:
        sf = shapefile.Reader(file_path)
        sf_type = find_type(sf.shapeType)
        # вывод полей
        if read_data:
            shpfields = sf.fields
            shprecords = sf.records()
            f = 0
            if str(sf.fields[0][0]).startswith("DeletionFlag"):
                shpfields.pop(0) # remove DeletionFlag field

            for i in range(len(shpfields)):
                _shpfields = shpfields[i]
                _field = _shpfields[0]
                _field_type = _shpfields[1]
                _field_len = _shpfields[2]
                _field_len2 = _shpfields[3]
                _field = _field.decode(enc, errors="replace")
                
                result_field_names.append(_field)
                field = "%s;%s;%d;%d" % (_field,_field_type,_field_len,_field_len2)
                result_fields.append(field)
                
        #вывод полилиний и данных
        shapes = sf.shapes()
        

        for i in range(len(shapes)):
            path = GH_Path(i)

            #считывание геометрии
            if read_geom:
                shape = shapes[i]
                #разделение на части
    
                if sf_type == "point":
                    parts = shape.points
                    pt_list = []
                    for p in range(len(parts)):
                        pt = list(parts[p])
                        pt_list.append(list2point(pt))
                    result_geom.append(pt_list)
                else:
                    parts = shape.parts
                    parts2 = parts[:] # copy
                    parts2.append(len(shape.points))
                    part = []
                    for p in range(len(parts)):
                        points = []
                        _p = p + 1
                        for n in range(len(shape.points)):
                            if(n<parts2[_p] and n>=parts2[p]):
                                pt = shape.points[n]
                                points.append(list2point(pt))
                        
                        polylinecurve = rc.Geometry.PolylineCurve(points)
                        part.append(polylinecurve)
                    result_geom.append(part)
            
            if read_records:
                rec = shprecords[i]
                _result_records = []
                for r in range(len(sf.fields)):
                    if str(sf.fields[0][0]).startswith("DeletionFlag") and r==0:
                        continue
                    record = rec[r]
                    if(isinstance(record, str)):
                        record = record.decode(enc, errors="replace")
                    _result_records.append(record)
                result_records.append(_result_records)
                    
    return [sf.shapeType], result_geom, result_fields, result_field_names, result_records


path =py_tree(path)
if len(path.keys())==0:
    message = "Specify .shp file path"
    ghenv.Component.AddRuntimeMessage(ww, message)
else:
    read_geometry =py_tree(read_geometry, default=True)
    read_records =py_tree(read_records, default=True)
    enc =py_tree(enc, default="utf-8")
    
    _path, read_geometry = longest_list(path,read_geometry)
    _path, read_records = longest_list(path,read_records)
    _path, enc = longest_list(path,enc)
    
    path = graft_tree(path)
    read_geometry = graft_tree(read_geometry)
    read_records = graft_tree(read_records)
    enc = graft_tree(enc)
    
    out_shapeType = {}
    out_geometry = {}
    out_fields = {}
    out_field_names = {}
    out_records = {}
    
    for p,file_path in path.items():
    #    print(GH_Path(p), file_path[0],read_geometry[p][0],read_records[p][0],enc[p][0])
        _sf_type, _geom, _fields, _field_names, _records = read_shapefile(file_path[0],
                                                             read_geometry[p][0],
                                                             read_records[p][0],
                                                             enc[p][0])
        out_shapeType[p] = _sf_type
        out_geometry[p] = _geom
        out_fields[p] = _fields
        out_field_names[p] = _field_names
        out_records[p] = _records
    
    shape_type = py_tree(out_shapeType, reverse = True)
    geometry = py_tree(out_geometry, True)
    fields = py_tree(out_fields, True)
    field_names = py_tree(out_field_names, True)
    records = py_tree(out_records, True)
# ---------- end shp_import ----------
shp_import_2 = ShapefileImport(path=path_2, read_geometry=toggle, read_records=toggle)  # -> out, shape_type, flatten(geometry), fields, field_names, flatten(records); inputs path: tree, read_geometry: tree of Boolean, read_records: tree of Boolean, field_ids: tree, enc: tree; same code as shp_import
shp_import_3 = ShapefileImport(path=path_4, read_geometry=toggle, read_records=toggle)  # -> out, shape_type, flatten(geometry), fields, field_names, flatten(records); inputs path: tree, read_geometry: tree of Boolean, read_records: tree of Boolean, field_ids: tree, enc: tree; same code as shp_import
shp_import_4 = ShapefileImport(path=path_5, read_geometry=toggle, read_records=toggle)  # -> out, shape_type, flatten(geometry), fields, field_names, flatten(records); inputs path: tree, read_geometry: tree of Boolean, read_records: tree of Boolean, field_ids: tree, enc: tree; same code as shp_import
shp_import_5 = ShapefileImport(path=path, read_geometry=toggle, read_records=toggle)  # -> out, shape_type, flatten(geometry), fields, field_names, flatten(records); inputs path: tree, read_geometry: tree of Boolean, read_records: tree of Boolean, field_ids: tree, enc: tree; same code as shp_import
python_10 = GhPythonScript(deltaZ=Slider(0, range=0..10), x=shp_import_4.geometry)  # -> allV, deltaX, deltaY, myMove; inputs x: list of Brep
# ---------- python_10: Python ----------
import Rhino.Geometry as rg

"""
allV = []
for i in range(0,len(x)):
    for j in range(0,x[i].Vertices.Count):
        allV.append(x[i].Vertices[j].Location)
        #print x[i].Vertices[j].Location
"""
print x[0].Vertices[0].Location

deltaX = -x[0].Vertices[0].Location.X+350
deltaY = -x[0].Vertices[0].Location.Y

myMove = rg.Vector3d(deltaX,deltaY,deltaZ)
# ---------- end python_10 ----------
movevector = Vector(python_10.myMove)
move = Move(Geometry=shp_import_4.geometry, Motion=movevector)  # -> Geometry, Transform
move_2 = Move(Geometry=shp_import_3.geometry, Motion=movevector)  # -> Geometry, Transform
move_3 = Move(Geometry=shp_import.geometry, Motion=movevector)  # -> Geometry, Transform
move_4 = Move(Geometry=shp_import_2.geometry, Motion=movevector)  # -> Geometry, Transform
move_5 = Move(Geometry=shp_import_5.geometry, Motion=movevector)  # -> Geometry, Transform
qrtagaddattri = Text(shp_import_5.records)
qrtagoriattri = Text(shp_import_2.records)
qrtagadd = Point(move_5.Geometry)
qrtagori = Point(move_4.Geometry)
crv_3 = Curve(move.Geometry)
holes = Curve([move_2.Geometry, move_3.Geometry])
shops = Curve(move_3.Geometry)
python_11 = GhPythonScript(deltaX=Slider(500.16, range=-1000..10000), deltaY=Slider(514, range=0..10000), deltaZ=Slider(150, range=0..500))  # -> out, myMove; same code as python
movevector_2 = Vector(python_11.myMove)
move_6 = Move(Geometry=crv_3, Motion=movevector_2)  # -> Geometry, Transform
move_7 = Move(Geometry=shops, Motion=movevector_2)  # -> Geometry, Transform
move_8 = Move(Geometry=qrtagori, Motion=movevector_2)  # -> Geometry, Transform
move_9 = Move(Geometry=qrtagadd, Motion=movevector_2)  # -> Geometry, Transform
move_10 = Move(Geometry=holes, Motion=movevector_2)  # -> Geometry, Transform
qr_tags_add = Point(move_9.Geometry)
holes_shops = Curve(move_10.Geometry)
corridor = Curve(move_6.Geometry)
qr_tags = Point(move_8.Geometry)
duppt = RemoveDuplicatePts(Points=[qr_tags, qr_tags_add], Tolerance=0.01)
voronoi = Voronoi(Points=duppt, BruteForceOverride=False)
rint = RegionIntersection(CurvesA=voronoi, CurvesB=corridor)
rdiff = RegionDifference(CurvesA=rint, CurvesB=holes_shops)
python_12 = GhPythonScript(
    run=Toggle(True),
    shops=move_7.Geometry,
    shopAttri=shp_import.records,
    otherSpaces=rdiff,
    QRtagsOri=qr_tags,
    QRTagOriAttri=qrtagoriattri,
    QRtagsAdd=qr_tags_add,
    QRTagAddAttri=qrtagaddattri,
    level=Slider(4, range=1..6))  # -> Network, NodeDic, Nodes, Links, Attri; inputs run: Boolean, shops: list of Curve, shopAttri: list, otherSpaces: list of Curve, QRtagsOri: list of Point3d, QRTagOriAttri: list, QRtagsAdd: list of Point3d, QRTagAddAttri: list, level: Int32
# ---------- python_12: Python ----------
from collections import deque, namedtuple
import Rhino.Geometry as rg
import ghpythonlib.components as gc
import re

# we'll use infinity as a default distance to nodes.
inf = float('inf')
Edge = namedtuple('Edge', 'start, end, cost')


def make_edge(start, end, cost=1):
  return Edge(start, end, cost)


class Graph:
    def __init__(self, edges):
        # let's check that the data is right
        wrong_edges = [i for i in edges if len(i) not in [2, 3]]
        if wrong_edges:
            raise ValueError('Wrong edges data: {}'.format(wrong_edges))

        self.edges = [make_edge(*edge) for edge in edges]
        
    @property
    def vertices(self):
        return set(
            sum(
                ([edge.start, edge.end] for edge in self.edges), []
            )
        )

    def get_node_pairs(self, n1, n2, both_ends=True):
        if both_ends:
            node_pairs = [[n1, n2], [n2, n1]]
        else:
            node_pairs = [[n1, n2]]
        return node_pairs

    def remove_edge(self, n1, n2, both_ends=True):
        node_pairs = self.get_node_pairs(n1, n2, both_ends)
        edges = self.edges[:]
        for edge in edges:
            if [edge.start, edge.end] in node_pairs:
                self.edges.remove(edge)

    def add_edge(self, n1, n2, cost=1, both_ends=True):
        node_pairs = self.get_node_pairs(n1, n2, both_ends)
        for edge in self.edges:
            if [edge.start, edge.end] in node_pairs:
                return ValueError('Edge {} {} already exists'.format(n1, n2))

        self.edges.append(Edge(start=n1, end=n2, cost=cost))
        if both_ends:
            self.edges.append(Edge(start=n2, end=n1, cost=cost))

    @property
    def neighbours(self):
        neighbours = {vertex: set() for vertex in self.vertices}
        for edge in self.edges:
            neighbours[edge.start].add((edge.end, edge.cost))

        return neighbours

    def dijkstra(self, source, dest):
        assert source in self.vertices, 'Such source node doesn\'t exist'
        distances = {vertex: inf for vertex in self.vertices}
        previous_vertices = {
            vertex: None for vertex in self.vertices
        }
        distances[source] = 0
        vertices = self.vertices.copy()

        while vertices:
            current_vertex = min(
                vertices, key=lambda vertex: distances[vertex])
            vertices.remove(current_vertex)
            if distances[current_vertex] == inf:
                break
            for neighbour, cost in self.neighbours[current_vertex]:
                alternative_route = distances[current_vertex] + cost
                if alternative_route < distances[neighbour]:
                    distances[neighbour] = alternative_route
                    previous_vertices[neighbour] = current_vertex

        path, current_vertex = deque(), dest
        while previous_vertices[current_vertex] is not None:
            path.appendleft(current_vertex)
            current_vertex = previous_vertices[current_vertex]
        if path:
            path.appendleft(current_vertex)
        return path

def createBooleanIntersection(curveA, curveB):
    #curveA is a brep or enclosed polyline
    #curveB is a curve, brep, or enclosed polyline
    points, params_a, params_b = gc.CurveXCurve(gc.JoinCurves(curveA,False),gc.JoinCurves(curveB,False))
    if isinstance(points, list):
        intersections = []
        mydirection = rg.Vector3d(0,0,1)
        brepA = gc.BoundarySurfaces(curveA)
        curves_B = curveB.DuplicateSegments()
        
        for cb in curves_B:
            overlaps = rg.Curve.ProjectToBrep(gc.JoinCurves(cb,False),brepA,mydirection,0.01)
            if len(overlaps)!=0:
                for ol in overlaps:
                    intersections.append(ol)

        return intersections
    else:
        return None

def networkDerivation(QRtagsOri,QRTagOriAttri,QRTagAddAttri,QRtagsAdd,shops,otherSpaces,shopAttri):

    Links = []
    Nodes = []
    allNodes = []
    
    Network = []
    NodeDic = []
    
    QRtags = QRtagsOri + QRtagsAdd
    Spaces = shops + otherSpaces
    QRTagAttri = QRTagOriAttri + QRTagAddAttri
    
    Attri = []
    for i in range(0,int(len(shopAttri)/6)):
        if shopAttri[6*i+1] == '':
            Attri.append('Shop_L'+str(level)+'_'+str(i))
        else:
            Attri.append(shopAttri[6*i+1])
    print len(Attri)
    print len(shops)
    print Attri
    print len(QRtags)
    print len(QRTagAttri)
    
    for i in range(0,len(otherSpaces)):
        Attri.append('Corridor_L'+str(level)+'_'+str(i))
        """
        for j in range(0,len(QRtags)):
            if str(otherSpaces[i].Contains(QRtags[j])) == 'Inside':
                if QRTagAttri[5*j+1]:
                    print QRTagAttri[5*j+1], '---', i, '----------', j
                    Attri.append(QRTagAttri[5*j+1])
                    
                else:
                    Attri.append('Corridor_L'+str(level)+'_'+str(i))
                    print 'i=', i
                    """
    #for i in range(len(QRtagsOri), len(otherSpaces)):

    print len(otherSpaces)
    print len(Attri)-57
    
    print Attri
    
    
    flag2QRtags = [0]*len(QRtags)
    for i in range(0,len(Spaces)):
        flag = 0
        for j in range(0,len(QRtags)):
            if str(Spaces[i].Contains(QRtags[j])) == 'Inside':
                Nodes.append(QRtags[j])

                if j < int(len(QRTagAttri)/5):
                    if QRTagAttri[5*j+1]:
                        NodeDic.append(QRTagAttri[5*j+1])
                    else:
                        NodeDic.append(Attri[i])
                    NodeDic.append(QRtags[j])
                
                else:
                    NodeDic.append(Attri[i])
                    NodeDic.append(QRtags[j])
                
                flag2QRtags[j] = 1
                flag = 1
                break
        if flag == 0:
            area, centroid = gc.Area(Spaces[i])
            Nodes.append(centroid)
            
            NodeDic.append(Attri[i])
            NodeDic.append(centroid)

    for i in range(0,len(Spaces)):
        for j in range(i+1,len(Spaces)):
            inter = createBooleanIntersection(Spaces[i], Spaces[j])
            if inter != None and len(inter)!=0:
                Links.append(gc.Line(Nodes[i],Nodes[j]))
                distance_ij = gc.Distance(Nodes[i],Nodes[j])
                edge_ij = make_edge(Attri[i], Attri[j], distance_ij)
                edge_ji = make_edge(Attri[j], Attri[i], distance_ij)
                Network.append(edge_ij)
                Network.append(edge_ji)
                    
    
    return Links, Nodes, Network, NodeDic

def createAttri_NodeDic(shops, otherSpaces, QRtagsOri, QRTagOriAttri, QRtagsAdd, QRTagAddAttri):
    
    QRtags = QRtagsOri + QRtagsAdd
    Spaces = shops + otherSpaces
    QRTagAttri = QRTagOriAttri + QRTagAddAttri
    
    NodeDic = []
    Nodes = []
    Attri = []

    for i in range(0,len(shops)):
        if shopAttri[6*i+1]:
            Attri.append(shopAttri[6*i+1])
            
            area, centroid = gc.Area(shops[i])
            NodeDic.append(shopAttri[6*i+1])
            NodeDic.append(centroid)
            Nodes.append(centroid)
            
        else:
            Attri.append('Shop_L'+str(level)+'_'+str(i))
            
            area, centroid = gc.Area(shops[i])
            NodeDic.append('Shop_L'+str(level)+'_'+str(i))
            NodeDic.append(centroid)
            Nodes.append(centroid)
    
    for i in range(0,len(otherSpaces)):
        flag_Inside =0
        for j in range(0,len(QRtags)):
            if str(otherSpaces[i].Contains(QRtags[j])) == 'Inside':
                flag_Inside =1
                Nodes.append(QRtags[j])
                
                if QRTagAttri[5*j+1]:
                    Attri.append(QRTagAttri[5*j+1])
                    
                    NodeDic.append(QRTagAttri[5*j+1])
                    NodeDic.append(QRtags[j])
                    
                    break
                else:
                    Attri.append('Corridor_L'+str(level)+'_'+str(i))
                    
                    NodeDic.append('Corridor_L'+str(level)+'_'+str(i))
                    NodeDic.append(QRtags[j])
                    
                    break
        if flag_Inside == 0:
            
            Attri.append('Corridor_L'+str(level)+'_'+str(i))
            
            area, centroid = gc.Area(otherSpaces[i])
            NodeDic.append('Corridor_L'+str(level)+'_'+str(i))
            NodeDic.append(centroid)
            Nodes.append(centroid)
    
    # Network derivation
    Links = []
    Network = []

    myNodeDict = {}
    for i in range (0,int(len(NodeDic)/2)):
        myNodeDict[NodeDic[2*i]] = NodeDic[2*i+1]

    for i in range(0,len(Spaces)):
        for j in range(i+1,len(Spaces)):
            inter = createBooleanIntersection(Spaces[i], Spaces[j])
            if inter != None and len(inter)!=0:
                Links.append(gc.Line(Nodes[i],Nodes[j]))
                distance_ij = gc.Distance(Nodes[i],Nodes[j])
                edge_ij = make_edge(Attri[i], Attri[j], distance_ij)
                edge_ji = make_edge(Attri[j], Attri[i], distance_ij)
                Network.append(edge_ij)
                Network.append(edge_ji)
    
    
    return Attri, NodeDic, Nodes, Links, Network


if run:
    #Links, Nodes, Network, NodeDic = networkDerivation(QRtagsOri,QRTagOriAttri,QRTagAddAttri,QRtagsAdd,shops,otherSpaces,shopAttri)
    Attri, NodeDic, Nodes, Links, Network = createAttri_NodeDic(shops, otherSpaces, QRtagsOri, QRTagOriAttri, QRtagsAdd, QRTagAddAttri)
# ---------- end python_12 ----------
dots = DotDisplay(Colour="0,255,0", Size=Slider(0.8, range=0..10))

# ----
# Level 2
toggle_2 = BooleanToggle(False)
path_6 = FilePath("E:\00 - Workdata of Research\01 - Paper writting\03 - Personalized Pedestrian Navigation Path Options\03 - Bondi Junction\Version 2\02 - ShapeFiles\L2\L2_QRTags_Add.shp")
path_7 = FilePath("E:\00 - Workdata of Research\01 - Paper writting\03 - Personalized Pedestrian Navigation Path Options\03 - Bondi Junction\Version 2\02 - ShapeFiles\L2\L2_QRTags.shp")
path_8 = FilePath("E:\00 - Workdata of Research\01 - Paper writting\03 - Personalized Pedestrian Navigation Path Options\03 - Bondi Junction\Version 2\02 - ShapeFiles\L2\L2_shop.shp")
path_9 = FilePath("E:\00 - Workdata of Research\01 - Paper writting\03 - Personalized Pedestrian Navigation Path Options\03 - Bondi Junction\Version 2\02 - ShapeFiles\L2\L2_corridor_holes.shp")
path_10 = FilePath("E:\00 - Workdata of Research\01 - Paper writting\03 - Personalized Pedestrian Navigation Path Options\03 - Bondi Junction\Version 2\02 - ShapeFiles\L2\L2_corridor.shp")
shp_import_6 = ShapefileImport(path=path_8, read_geometry=toggle_2, read_records=toggle_2)  # -> out, shape_type, flatten(geometry), fields, field_names, flatten(records); inputs path: tree, read_geometry: tree of Boolean, read_records: tree of Boolean, field_ids: tree, enc: tree; same code as shp_import
shp_import_7 = ShapefileImport(path=path_7, read_geometry=toggle_2, read_records=toggle_2)  # -> out, shape_type, flatten(geometry), fields, field_names, flatten(records); inputs path: tree, read_geometry: tree of Boolean, read_records: tree of Boolean, field_ids: tree, enc: tree; same code as shp_import
shp_import_8 = ShapefileImport(path=path_9, read_geometry=toggle_2, read_records=toggle_2)  # -> out, shape_type, flatten(geometry), fields, field_names, flatten(records); inputs path: tree, read_geometry: tree of Boolean, read_records: tree of Boolean, field_ids: tree, enc: tree; same code as shp_import
shp_import_9 = ShapefileImport(path=path_10, read_geometry=toggle_2, read_records=toggle_2)  # -> out, shape_type, flatten(geometry), fields, field_names, flatten(records); inputs path: tree, read_geometry: tree of Boolean, read_records: tree of Boolean, field_ids: tree, enc: tree; same code as shp_import
shp_import_10 = ShapefileImport(path=path_6, read_geometry=toggle_2, read_records=toggle_2)  # -> out, shape_type, flatten(geometry), fields, field_names, flatten(records); inputs path: tree, read_geometry: tree of Boolean, read_records: tree of Boolean, field_ids: tree, enc: tree; same code as shp_import
python_13 = GhPythonScript(deltaZ=Slider(0, range=0..10), x=shp_import_9.geometry)  # -> allV, deltaX, deltaY, myMove; inputs x: list of Brep; same code as python_10
movevector_3 = Vector(python_13.myMove)
move_11 = Move(Geometry=shp_import_9.geometry, Motion=movevector_3)  # -> Geometry, Transform
move_12 = Move(Geometry=shp_import_8.geometry, Motion=movevector_3)  # -> Geometry, Transform
move_13 = Move(Geometry=shp_import_6.geometry, Motion=movevector_3)  # -> Geometry, Transform
move_14 = Move(Geometry=shp_import_7.geometry, Motion=movevector_3)  # -> Geometry, Transform
move_15 = Move(Geometry=shp_import_10.geometry, Motion=movevector_3)  # -> Geometry, Transform
qrtagaddattri_2 = Text(shp_import_10.records)
qrtagoriattri_2 = Text(shp_import_7.records)
qrtagadd_2 = Point(move_15.Geometry)
qrtagori_2 = Point(move_14.Geometry)
holes_2 = Curve([move_12.Geometry, move_13.Geometry])
shops_2 = Curve(move_13.Geometry)
crv_4 = Curve(move_11.Geometry)
python_14 = GhPythonScript(deltaX=Slider(506.58, range=-1000..10000), deltaY=Slider(525, range=0..10000), deltaZ=Slider(50, range=0..500))  # -> out, myMove; same code as python
movevector_4 = Vector(python_14.myMove)
move_16 = Move(Geometry=crv_4, Motion=movevector_4)  # -> Geometry, Transform
move_17 = Move(Geometry=shops_2, Motion=movevector_4)  # -> Geometry, Transform
move_18 = Move(Geometry=qrtagori_2, Motion=movevector_4)  # -> Geometry, Transform
move_19 = Move(Geometry=qrtagadd_2, Motion=movevector_4)  # -> Geometry, Transform
move_20 = Move(Geometry=holes_2, Motion=movevector_4)  # -> Geometry, Transform
qr_tags_add_2 = Point(move_19.Geometry)
holes_shops_2 = Curve(move_20.Geometry)
qr_tags_2 = Point(move_18.Geometry)
corridor_2 = Curve(move_16.Geometry)
duppt_2 = RemoveDuplicatePts(Points=[qr_tags_2, qr_tags_add_2], Tolerance=0.01)
voronoi_2 = Voronoi(Points=duppt_2, BruteForceOverride=False)
rint_2 = RegionIntersection(CurvesA=voronoi_2, CurvesB=corridor_2)
rdiff_2 = RegionDifference(CurvesA=rint_2, CurvesB=holes_shops_2)
python_15 = GhPythonScript(
    run=Toggle(True),
    shops=move_17.Geometry,
    shopAttri=shp_import_6.records,
    otherSpaces=rdiff_2,
    QRtagsOri=qr_tags_2,
    QRTagOriAttri=qrtagoriattri_2,
    QRtagsAdd=qr_tags_add_2,
    QRTagAddAttri=qrtagaddattri_2,
    level=Slider(2, range=1..6))  # -> Network, NodeDic, Nodes, Links, Attri; inputs run: Boolean, shops: list of Curve, shopAttri: list, otherSpaces: list of Curve, QRtagsOri: list of Point3d, QRTagOriAttri: list, QRtagsAdd: list of Point3d, QRTagAddAttri: list, level: Int32; same code as python_12
dots_2 = DotDisplay(Colour="0,255,0", Size=Slider(0.8, range=0..10))

# ----
# Level 3
toggle_3 = BooleanToggle(False)
path_11 = FilePath("E:\00 - Workdata of Research\01 - Paper writting\03 - Personalized Pedestrian Navigation Path Options\03 - Bondi Junction\Version 2\02 - ShapeFiles\L3\L3_QRTags_Add.shp")
path_12 = FilePath("E:\00 - Workdata of Research\01 - Paper writting\03 - Personalized Pedestrian Navigation Path Options\03 - Bondi Junction\Version 2\02 - ShapeFiles\L3\L3_QRTags.shp")
path_13 = FilePath("E:\00 - Workdata of Research\01 - Paper writting\03 - Personalized Pedestrian Navigation Path Options\03 - Bondi Junction\Version 2\02 - ShapeFiles\L3\L3_shops.shp")
path_14 = FilePath("E:\00 - Workdata of Research\01 - Paper writting\03 - Personalized Pedestrian Navigation Path Options\03 - Bondi Junction\Version 2\02 - ShapeFiles\L3\L3_corridor_holes.shp")
path_15 = FilePath("E:\00 - Workdata of Research\01 - Paper writting\03 - Personalized Pedestrian Navigation Path Options\03 - Bondi Junction\Version 2\02 - ShapeFiles\L3\L3_corridor.shp")
shp_import_11 = ShapefileImport(path=path_13, read_geometry=toggle_3, read_records=toggle_3)  # -> out, shape_type, flatten(geometry), fields, field_names, flatten(records); inputs path: tree, read_geometry: tree of Boolean, read_records: tree of Boolean, field_ids: tree, enc: tree; same code as shp_import
shp_import_12 = ShapefileImport(path=path_12, read_geometry=toggle_3, read_records=toggle_3)  # -> out, shape_type, flatten(geometry), fields, field_names, flatten(records); inputs path: tree, read_geometry: tree of Boolean, read_records: tree of Boolean, field_ids: tree, enc: tree; same code as shp_import
shp_import_13 = ShapefileImport(path=path_14, read_geometry=toggle_3, read_records=toggle_3)  # -> out, shape_type, flatten(geometry), fields, field_names, flatten(records); inputs path: tree, read_geometry: tree of Boolean, read_records: tree of Boolean, field_ids: tree, enc: tree; same code as shp_import
shp_import_14 = ShapefileImport(path=path_15, read_geometry=toggle_3, read_records=toggle_3)  # -> out, shape_type, flatten(geometry), fields, field_names, flatten(records); inputs path: tree, read_geometry: tree of Boolean, read_records: tree of Boolean, field_ids: tree, enc: tree; same code as shp_import
shp_import_15 = ShapefileImport(path=path_11, read_geometry=toggle_3, read_records=toggle_3)  # -> out, shape_type, flatten(geometry), fields, field_names, flatten(records); inputs path: tree, read_geometry: tree of Boolean, read_records: tree of Boolean, field_ids: tree, enc: tree; same code as shp_import
python_16 = GhPythonScript(deltaZ=Slider(0, range=0..10), x=shp_import_14.geometry)  # -> allV, deltaX, deltaY, myMove; inputs x: list of Brep; same code as python_10
movevector_5 = Vector(python_16.myMove)
move_21 = Move(Geometry=shp_import_14.geometry, Motion=movevector_5)  # -> Geometry, Transform
move_22 = Move(Geometry=shp_import_13.geometry, Motion=movevector_5)  # -> Geometry, Transform
move_23 = Move(Geometry=shp_import_11.geometry, Motion=movevector_5)  # -> Geometry, Transform
move_24 = Move(Geometry=shp_import_12.geometry, Motion=movevector_5)  # -> Geometry, Transform
move_25 = Move(Geometry=shp_import_15.geometry, Motion=movevector_5)  # -> Geometry, Transform
qrtagaddattri_3 = Text(shp_import_15.records)
qrtagoriattri_3 = Text(shp_import_12.records)
qrtagadd_3 = Point(move_25.Geometry)
qrtagori_3 = Point(move_24.Geometry)
holes_3 = Curve([move_22.Geometry, move_23.Geometry])
shops_3 = Curve(move_23.Geometry)
crv_5 = Curve(move_21.Geometry)
python_17 = GhPythonScript(deltaX=Slider(402, range=-1000..10000), deltaY=Slider(540, range=0..10000), deltaZ=Slider(100, range=0..500))  # -> out, myMove; same code as python
movevector_6 = Vector(python_17.myMove)
move_26 = Move(Geometry=crv_5, Motion=movevector_6)  # -> Geometry, Transform
move_27 = Move(Geometry=shops_3, Motion=movevector_6)  # -> Geometry, Transform
move_28 = Move(Geometry=qrtagori_3, Motion=movevector_6)  # -> Geometry, Transform
move_29 = Move(Geometry=qrtagadd_3, Motion=movevector_6)  # -> Geometry, Transform
move_30 = Move(Geometry=holes_3, Motion=movevector_6)  # -> Geometry, Transform
qr_tags_add_3 = Point(move_29.Geometry)
holes_shops_3 = Curve(move_30.Geometry)
qr_tags_3 = Point(move_28.Geometry)
corridor_3 = Curve(move_26.Geometry)
duppt_3 = RemoveDuplicatePts(Points=[qr_tags_3, qr_tags_add_3], Tolerance=0.01)
voronoi_3 = Voronoi(Points=duppt_3, BruteForceOverride=False)
rint_3 = RegionIntersection(CurvesA=voronoi_3, CurvesB=corridor_3)
rdiff_3 = RegionDifference(CurvesA=rint_3, CurvesB=holes_shops_3)
python_18 = GhPythonScript(
    run=Toggle(True),
    shops=move_27.Geometry,
    shopAttri=shp_import_11.records,
    otherSpaces=rdiff_3,
    QRtagsOri=qr_tags_3,
    QRTagOriAttri=qrtagoriattri_3,
    QRtagsAdd=qr_tags_add_3,
    QRTagAddAttri=qrtagaddattri_3,
    level=Slider(3, range=1..6))  # -> Network, NodeDic, Nodes, Links, Attri; inputs run: Boolean, shops: list of Curve, shopAttri: list, otherSpaces: list of Curve, QRtagsOri: list of Point3d, QRTagOriAttri: list, QRtagsAdd: list of Point3d, QRTagAddAttri: list, level: Int32; same code as python_12
dots_3 = DotDisplay(Colour="0,255,0", Size=Slider(0.8, range=0..10))

# ----
# Level 1
toggle_4 = BooleanToggle(False)
path_16 = FilePath("E:\00 - Workdata of Research\01 - Paper writting\03 - Personalized Pedestrian Navigation Path Options\03 - Bondi Junction\Version 2\02 - ShapeFiles\L1\L1_QRTags_Add.shp")
path_17 = FilePath("E:\00 - Workdata of Research\01 - Paper writting\03 - Personalized Pedestrian Navigation Path Options\03 - Bondi Junction\Version 2\02 - ShapeFiles\L1\L1_QRTags.shp")
path_18 = FilePath("E:\00 - Workdata of Research\01 - Paper writting\03 - Personalized Pedestrian Navigation Path Options\03 - Bondi Junction\Version 2\02 - ShapeFiles\L1\L1_shop.shp")
path_19 = FilePath("E:\00 - Workdata of Research\01 - Paper writting\03 - Personalized Pedestrian Navigation Path Options\03 - Bondi Junction\Version 2\02 - ShapeFiles\L1\L1_corridor_holes.shp")
path_20 = FilePath("E:\00 - Workdata of Research\01 - Paper writting\03 - Personalized Pedestrian Navigation Path Options\03 - Bondi Junction\Version 2\02 - ShapeFiles\L1\L1_corridor.shp")
shp_import_16 = ShapefileImport(path=path_18, read_geometry=toggle_4, read_records=toggle_4)  # -> out, shape_type, flatten(geometry), fields, field_names, flatten(records); inputs path: tree, read_geometry: tree of Boolean, read_records: tree of Boolean, field_ids: tree, enc: tree; same code as shp_import
shp_import_17 = ShapefileImport(path=path_17, read_geometry=toggle_4, read_records=toggle_4)  # -> out, shape_type, flatten(geometry), fields, field_names, flatten(records); inputs path: tree, read_geometry: tree of Boolean, read_records: tree of Boolean, field_ids: tree, enc: tree; same code as shp_import
shp_import_18 = ShapefileImport(path=path_19, read_geometry=toggle_4, read_records=toggle_4)  # -> out, shape_type, flatten(geometry), fields, field_names, flatten(records); inputs path: tree, read_geometry: tree of Boolean, read_records: tree of Boolean, field_ids: tree, enc: tree; same code as shp_import
shp_import_19 = ShapefileImport(path=path_20, read_geometry=toggle_4, read_records=toggle_4)  # -> out, shape_type, flatten(geometry), fields, field_names, flatten(records); inputs path: tree, read_geometry: tree of Boolean, read_records: tree of Boolean, field_ids: tree, enc: tree; same code as shp_import
shp_import_20 = ShapefileImport(path=path_16, read_geometry=toggle_4, read_records=toggle_4)  # -> out, shape_type, flatten(geometry), fields, field_names, flatten(records); inputs path: tree, read_geometry: tree of Boolean, read_records: tree of Boolean, field_ids: tree, enc: tree; same code as shp_import
python_19 = GhPythonScript(deltaZ=Slider(0, range=0..10), x=shp_import_19.geometry)  # -> allV, deltaX, deltaY, myMove; inputs x: list of Brep; same code as python_10
movevector_7 = Vector(python_19.myMove)
move_31 = Move(Geometry=shp_import_19.geometry, Motion=movevector_7)  # -> Geometry, Transform
move_32 = Move(Geometry=shp_import_18.geometry, Motion=movevector_7)  # -> Geometry, Transform
move_33 = Move(Geometry=shp_import_16.geometry, Motion=movevector_7)  # -> Geometry, Transform
move_34 = Move(Geometry=shp_import_17.geometry, Motion=movevector_7)  # -> Geometry, Transform
move_35 = Move(Geometry=shp_import_20.geometry, Motion=movevector_7)  # -> Geometry, Transform
qrtagaddattri_4 = Text(shp_import_20.records)
qrtagoriattri_4 = Text(shp_import_17.records)
qrtagadd_4 = Point(move_35.Geometry)
qrtagori_4 = Point(move_34.Geometry)
holes_4 = Curve([move_32.Geometry, move_33.Geometry])
shops_4 = Curve(move_33.Geometry)
crv_6 = Curve(move_31.Geometry)
python_20 = GhPythonScript(deltaX=Slider(500, range=-1000..10000), deltaY=Slider(500, range=0..10000), deltaZ=Slider(0, range=0..500))  # -> out, myMove; same code as python
movevector_8 = Vector(python_20.myMove)
move_36 = Move(Geometry=crv_6, Motion=movevector_8)  # -> Geometry, Transform
move_37 = Move(Geometry=shops_4, Motion=movevector_8)  # -> Geometry, Transform
move_38 = Move(Geometry=qrtagori_4, Motion=movevector_8)  # -> Geometry, Transform
move_39 = Move(Geometry=qrtagadd_4, Motion=movevector_8)  # -> Geometry, Transform
move_40 = Move(Geometry=holes_4, Motion=movevector_8)  # -> Geometry, Transform
qr_tags_add_4 = Point(move_39.Geometry)
holes_shops_4 = Curve(move_40.Geometry)
corridor_4 = Curve(move_36.Geometry)
qr_tags_4 = Point(move_38.Geometry)
duppt_4 = RemoveDuplicatePts(Points=[qr_tags_4, qr_tags_add_4], Tolerance=0.01)
voronoi_4 = Voronoi(Points=duppt_4, BruteForceOverride=False)
rint_4 = RegionIntersection(CurvesA=voronoi_4, CurvesB=corridor_4)
rdiff_4 = RegionDifference(CurvesA=rint_4, CurvesB=holes_shops_4)
python_21 = GhPythonScript(
    run=Toggle(True),
    shops=move_37.Geometry,
    shopAttri=shp_import_16.records,
    otherSpaces=rdiff_4,
    QRtagsOri=qr_tags_4,
    QRTagOriAttri=qrtagoriattri_4,
    QRtagsAdd=qr_tags_add_4,
    QRTagAddAttri=qrtagaddattri_4,
    level=Slider(1, range=1..6))  # -> Network, NodeDic, Nodes, Links, Attri; inputs run: Boolean, shops: list of Curve, shopAttri: list, otherSpaces: list of Curve, QRtagsOri: list of Point3d, QRTagOriAttri: list, QRtagsAdd: list of Point3d, QRTagAddAttri: list, level: Int32
# ---------- python_21: Python ----------
from collections import deque, namedtuple
import Rhino.Geometry as rg
import ghpythonlib.components as gc
import re

# we'll use infinity as a default distance to nodes.
inf = float('inf')
Edge = namedtuple('Edge', 'start, end, cost')


def make_edge(start, end, cost=1):
  return Edge(start, end, cost)


class Graph:
    def __init__(self, edges):
        # let's check that the data is right
        wrong_edges = [i for i in edges if len(i) not in [2, 3]]
        if wrong_edges:
            raise ValueError('Wrong edges data: {}'.format(wrong_edges))

        self.edges = [make_edge(*edge) for edge in edges]
        
    @property
    def vertices(self):
        return set(
            sum(
                ([edge.start, edge.end] for edge in self.edges), []
            )
        )

    def get_node_pairs(self, n1, n2, both_ends=True):
        if both_ends:
            node_pairs = [[n1, n2], [n2, n1]]
        else:
            node_pairs = [[n1, n2]]
        return node_pairs

    def remove_edge(self, n1, n2, both_ends=True):
        node_pairs = self.get_node_pairs(n1, n2, both_ends)
        edges = self.edges[:]
        for edge in edges:
            if [edge.start, edge.end] in node_pairs:
                self.edges.remove(edge)

    def add_edge(self, n1, n2, cost=1, both_ends=True):
        node_pairs = self.get_node_pairs(n1, n2, both_ends)
        for edge in self.edges:
            if [edge.start, edge.end] in node_pairs:
                return ValueError('Edge {} {} already exists'.format(n1, n2))

        self.edges.append(Edge(start=n1, end=n2, cost=cost))
        if both_ends:
            self.edges.append(Edge(start=n2, end=n1, cost=cost))

    @property
    def neighbours(self):
        neighbours = {vertex: set() for vertex in self.vertices}
        for edge in self.edges:
            neighbours[edge.start].add((edge.end, edge.cost))

        return neighbours

    def dijkstra(self, source, dest):
        assert source in self.vertices, 'Such source node doesn\'t exist'
        distances = {vertex: inf for vertex in self.vertices}
        previous_vertices = {
            vertex: None for vertex in self.vertices
        }
        distances[source] = 0
        vertices = self.vertices.copy()

        while vertices:
            current_vertex = min(
                vertices, key=lambda vertex: distances[vertex])
            vertices.remove(current_vertex)
            if distances[current_vertex] == inf:
                break
            for neighbour, cost in self.neighbours[current_vertex]:
                alternative_route = distances[current_vertex] + cost
                if alternative_route < distances[neighbour]:
                    distances[neighbour] = alternative_route
                    previous_vertices[neighbour] = current_vertex

        path, current_vertex = deque(), dest
        while previous_vertices[current_vertex] is not None:
            path.appendleft(current_vertex)
            current_vertex = previous_vertices[current_vertex]
        if path:
            path.appendleft(current_vertex)
        return path

def createBooleanIntersection(curveA, curveB):
    #curveA is a brep or enclosed polyline
    #curveB is a curve, brep, or enclosed polyline
    points, params_a, params_b = gc.CurveXCurve(gc.JoinCurves(curveA,False),gc.JoinCurves(curveB,False))
    if isinstance(points, list):
        intersections = []
        mydirection = rg.Vector3d(0,0,1)
        brepA = gc.BoundarySurfaces(curveA)
        curves_B = curveB.DuplicateSegments()
        
        for cb in curves_B:
            overlaps = rg.Curve.ProjectToBrep(gc.JoinCurves(cb,False),brepA,mydirection,0.01)
            if len(overlaps)!=0:
                for ol in overlaps:
                    intersections.append(ol)

        return intersections
    else:
        return None

def networkDerivation(QRtagsOri,QRTagOriAttri,QRTagAddAttri,QRtagsAdd,shops,otherSpaces,shopAttri):

    Links = []
    Nodes = []
    allNodes = []
    
    Network = []
    NodeDic = []
    
    QRtags = QRtagsOri + QRtagsAdd
    Spaces = shops + otherSpaces
    QRTagAttri = QRTagOriAttri + QRTagAddAttri
    
    Attri = []
    for i in range(0,int(len(shopAttri)/6)):
        if shopAttri[6*i+1] == '':
            Attri.append('Shop_L'+str(level)+'_'+str(i))
        else:
            Attri.append(shopAttri[6*i+1])

    for i in range(0,len(otherSpaces)):
        Attri.append('Corridor_L'+str(level)+'_'+str(i))
        """
        for j in range(0,len(QRtags)):
            if str(otherSpaces[i].Contains(QRtags[j])) == 'Inside':
                if QRTagAttri[5*j+1]:
                    print QRTagAttri[5*j+1], '---', i, '----------', j
                    Attri.append(QRTagAttri[5*j+1])
                    
                else:
                    Attri.append('Corridor_L'+str(level)+'_'+str(i))
                    print 'i=', i
                    """
    #for i in range(len(QRtagsOri), len(otherSpaces)):

    
    flag2QRtags = [0]*len(QRtags)
    for i in range(0,len(Spaces)):
        flag = 0
        for j in range(0,len(QRtags)):
            if str(Spaces[i].Contains(QRtags[j])) == 'Inside':
                Nodes.append(QRtags[j])

                if j < int(len(QRTagAttri)/5):
                    if QRTagAttri[5*j+1]:
                        NodeDic.append(QRTagAttri[5*j+1])
                    else:
                        NodeDic.append(Attri[i])
                    NodeDic.append(QRtags[j])
                
                else:
                    NodeDic.append(Attri[i])
                    NodeDic.append(QRtags[j])
                
                flag2QRtags[j] = 1
                flag = 1
                break
        if flag == 0:
            area, centroid = gc.Area(Spaces[i])
            Nodes.append(centroid)
            
            NodeDic.append(Attri[i])
            NodeDic.append(centroid)

    for i in range(0,len(Spaces)):
        for j in range(i+1,len(Spaces)):
            inter = createBooleanIntersection(Spaces[i], Spaces[j])
            if inter != None and len(inter)!=0:
                Links.append(gc.Line(Nodes[i],Nodes[j]))
                distance_ij = gc.Distance(Nodes[i],Nodes[j])
                edge_ij = make_edge(Attri[i], Attri[j], distance_ij)
                edge_ji = make_edge(Attri[j], Attri[i], distance_ij)
                Network.append(edge_ij)
                Network.append(edge_ji)
                    
    
    return Links, Nodes, Network, NodeDic

def createAttri_NodeDic(shops, otherSpaces, QRtagsOri, QRTagOriAttri, QRtagsAdd, QRTagAddAttri):
    
    QRtags = QRtagsOri + QRtagsAdd
    Spaces = shops + otherSpaces
    QRTagAttri = QRTagOriAttri + QRTagAddAttri
    
    NodeDic = []
    Nodes = []
    Attri = []

    for i in range(0,len(shops)):
        if shopAttri[6*i+1]:
            Attri.append(shopAttri[6*i+1])
            
            area, centroid = gc.Area(shops[i])
            NodeDic.append(shopAttri[6*i+1])
            NodeDic.append(centroid)
            Nodes.append(centroid)
            
        else:
            Attri.append('Shop_L'+str(level)+'_'+str(i))
            
            area, centroid = gc.Area(shops[i])
            NodeDic.append('Shop_L'+str(level)+'_'+str(i))
            NodeDic.append(centroid)
            Nodes.append(centroid)
    
    for i in range(0,len(otherSpaces)):
        flag_Inside =0
        for j in range(0,len(QRtags)):
            if str(otherSpaces[i].Contains(QRtags[j])) == 'Inside':
                flag_Inside =1
                Nodes.append(QRtags[j])
                
                if QRTagAttri[5*j+1]:
                    Attri.append(QRTagAttri[5*j+1])
                    
                    NodeDic.append(QRTagAttri[5*j+1])
                    NodeDic.append(QRtags[j])
                    
                    break
                else:
                    Attri.append('Corridor_L'+str(level)+'_'+str(i))
                    
                    NodeDic.append('Corridor_L'+str(level)+'_'+str(i))
                    NodeDic.append(QRtags[j])
                    
                    break
        if flag_Inside == 0:
            
            Attri.append('Corridor_L'+str(level)+'_'+str(i))
            
            area, centroid = gc.Area(otherSpaces[i])
            NodeDic.append('Corridor_L'+str(level)+'_'+str(i))
            NodeDic.append(centroid)
            Nodes.append(centroid)
    
    # Network derivation
    Links = []
    Network = []

    myNodeDict = {}
    for i in range (0,int(len(NodeDic)/2)):
        myNodeDict[NodeDic[2*i]] = NodeDic[2*i+1]

    for i in range(0,len(Spaces)):
        for j in range(i+1,len(Spaces)):
            inter = createBooleanIntersection(Spaces[i], Spaces[j])
            if inter != None and len(inter)!=0:
                Links.append(gc.Line(Nodes[i],Nodes[j]))
                distance_ij = gc.Distance(Nodes[i],Nodes[j])
                edge_ij = make_edge(Attri[i], Attri[j], distance_ij)
                edge_ji = make_edge(Attri[j], Attri[i], distance_ij)
                Network.append(edge_ij)
                Network.append(edge_ji)
    
    
    return Attri, NodeDic, Nodes, Links, Network


if run:
    #Links, Nodes, Network, NodeDic = networkDerivation(QRtagsOri,QRTagOriAttri,QRTagAddAttri,QRtagsAdd,shops,otherSpaces,shopAttri)
    Attri, NodeDic, Nodes, Links, Network = createAttri_NodeDic(shops, otherSpaces, QRtagsOri, QRTagOriAttri, QRtagsAdd, QRTagAddAttri)
# ---------- end python_21 ----------
dots_4 = DotDisplay(Point=qr_tags_4, Colour="0,255,0", Size=Slider(0.8, range=0..10))

dots_5 = DotDisplay(Colour="0,255,0", Size=Slider(0.8, range=0..10))

# ---- group: Curve Visulization
crv_7 = Curve()
X_3 = UnitX(Factor=Slider(288, range=0..1000))
move_41 = Move(Geometry=crv_7, Motion=X_3)  # -> Geometry, Transform
list_44 = ValueList({"None": "", "Dot": "0.1 1.0", "Dash": "1.0", "DashDot": "1.0 1.0 0.1 1.0"}, selected="None")
c_script = CSharpScript(Curve=move_41.Geometry, Width=Slider(3, range=0..10), Colour="0,0,255", Dash=list_44)  # -> out, A, B; inputs Curve: Curve, Width: Int32, Colour: Color, Dash: String
# ---------- c_script: C# usings ----------
using System.IO;
using System.Linq;
using System.Data;
using System.Drawing;
using System.Reflection;
using System.Windows.Forms;
using System.Xml;
using System.Xml.Linq;
using System.Runtime.InteropServices;

using Rhino.DocObjects;
using Rhino.Collections;
using GH_IO;
using GH_IO.Serialization;
# ---------- c_script: C# ----------
    if (Curve == null) return;
    if (Width <= 0) return;

    double[] pattern = ParseDashPattern(Dash);
    IEnumerable<Curve> segments = ApplyDashPattern(Curve, pattern);

    _clip = BoundingBox.Union(_clip, Curve.GetBoundingBox(false));
    foreach (Curve segment in segments)
    {
      _curves.Add(segment);
      _colors.Add(Colour);
      _widths.Add(Width);
    }
# ---------- c_script: C# additional code ----------
  private double[] ParseDashPattern(string pattern)
  {
    if (string.IsNullOrWhiteSpace(pattern))
      return null;

    string[] fragments = pattern.Split(new char[] {' '});
    if (fragments == null || fragments.Length == 0)
      return null;

    double[] values = new double[fragments.Length];
    for (int i = 0; i < fragments.Length; i++)
    {
      double v;
      if (!double.TryParse(fragments[i], out v))
        throw new Exception(fragments[i] + " is a not a valid number.");

      if (v <= 0.0)
        throw new Exception("Dashes or gaps must have a strictly positive length.");

      values[i] = v;
    }

    return values;
  }
  /// <summary>
  /// Apply a dash+gap pattern to a curve.
  /// </summary>
  private IEnumerable<Curve> ApplyDashPattern(Curve curve, double[] pattern)
  {
    if (pattern == null || pattern.Length == 0)
      return new Curve[] { curve };

    double curveLength = curve.GetLength();
    List<Curve> dashes = new List<Curve>();

    double offset0 = 0.0;
    int index = 0;
    while(true)
    {
      // Get the current dash length.
      double dashLength = pattern[index++];
      if (index >= pattern.Length)
        index = 0;

      // Compute the offset of the current dash from the curve start.
      double offset1 = offset0 + dashLength;
      if (offset1 > curveLength)
        offset1 = curveLength;

      // Solve the curve parameters at the current dash start and end.
      double t0, t1;
      curve.LengthParameter(offset0, out t0);
      curve.LengthParameter(offset1, out t1);

      Curve dash = curve.Trim(t0, t1);
      if (dash != null)
        dashes.Add(dash);

      // Get the current gap length.
      double gapLength = pattern[index++];
      if (index >= pattern.Length)
        index = 0;

      // Set the start of the next dash to be the end of the current
      // dash + the length of the adjacent gap.
      offset0 = offset1 + gapLength;

      // Abort when we've reached the end of the curve.
      if (offset0 >= curveLength)
        break;
    }

    return dashes;
  }

  private BoundingBox _clip;
  private readonly List<Curve> _curves = new List<Curve>();
  private readonly List<Color> _colors = new List<Color>();
  private readonly List<int> _widths = new List<int>();

  /// <summary>
  /// This method will be called once every solution, before any calls to RunScript.
  /// </summary>
  public override void BeforeRunScript()
  {
    _clip = BoundingBox.Empty;
    _curves.Clear();
    _colors.Clear();
    _widths.Clear();
  }

  /// <summary>
  /// Return a BoundingBox that contains all the geometry you are about to draw.
  /// </summary>
  public override BoundingBox ClippingBox
  {
    get { return _clip; }
  }
  /// <summary>
  /// Draw all wires and points in this method.
  /// </summary>
  public override void DrawViewportWires(IGH_PreviewArgs args)
  {
    for (int i = 0; i < _curves.Count; i++)
      args.Display.DrawCurve(_curves[i], _colors[i], _widths[i]);
  }
# ---------- end c_script ----------

# ----
# Level 1
toggle_5 = BooleanToggle(False)

# ----
# Shops
path_21 = FilePath("E:\00 - Workdata of Research\01 - Paper writting\03 - Personalized Pedestrian Navigation Path Options\03 - Bondi Junction\Version 2\02 - ShapeFiles\L1 new Update\shops.shp")
shp_import_21 = ShapefileImport(path=path_21, read_geometry=toggle_5, read_records=toggle_5)  # -> out, shape_type, flatten(geometry), fields, field_names, flatten(records); inputs path: tree, read_geometry: tree of Boolean, read_records: tree of Boolean, field_ids: tree, enc: tree; same code as shp_import

# ----
# POIs
path_22 = FilePath("E:\00 - Workdata of Research\01 - Paper writting\03 - Personalized Pedestrian Navigation Path Options\03 - Bondi Junction\Version 2\02 - ShapeFiles\L1 new Update\POIs.shp")
shp_import_22 = ShapefileImport(path=path_22, read_geometry=toggle_5, read_records=toggle_5)  # -> out, shape_type, flatten(geometry), fields, field_names, flatten(records); inputs path: tree, read_geometry: tree of Boolean, read_records: tree of Boolean, field_ids: tree, enc: tree; same code as shp_import

# ----
# Corridor
path_23 = FilePath("E:\00 - Workdata of Research\01 - Paper writting\03 - Personalized Pedestrian Navigation Path Options\03 - Bondi Junction\Version 2\02 - ShapeFiles\L1 new Update\corridor.shp")
shp_import_23 = ShapefileImport(path=path_23, read_geometry=toggle_5, read_records=toggle_5)  # -> out, shape_type, flatten(geometry), fields, field_names, flatten(records); inputs path: tree, read_geometry: tree of Boolean, read_records: tree of Boolean, field_ids: tree, enc: tree; same code as shp_import

# ---- group: Corridor
# Corridor shape
path_24 = FilePath("E:\00 - Workdata of Research\01 - Paper writting\03 - Personalized Pedestrian Navigation Path Options\03 - Bondi Junction\Version 2\02 - ShapeFiles\L1\L1_corridor.shp")
shp_import_24 = ShapefileImport(path=path_24, read_geometry=toggle_5, read_records=toggle_5)  # -> out, shape_type, flatten(geometry), fields, field_names, flatten(records); inputs path: tree, read_geometry: tree of Boolean, read_records: tree of Boolean, field_ids: tree, enc: tree; same code as shp_import

# ----
panel_12 = Panel(shp_import_21.records)

# ----
# Level 4
toggle_6 = BooleanToggle(False)

# ----
# Shops
path_25 = FilePath("E:\00 - Workdata of Research\01 - Paper writting\03 - Personalized Pedestrian Navigation Path Options\03 - Bondi Junction\Version 2\02 - ShapeFiles\L4 new Update\shops.shp")
shp_import_25 = ShapefileImport(path=path_25, read_geometry=toggle_6, read_records=toggle_6)  # -> out, shape_type, flatten(geometry), fields, field_names, flatten(records); inputs path: tree, read_geometry: tree of Boolean, read_records: tree of Boolean, field_ids: tree, enc: tree; same code as shp_import

# ----
# POIs
path_26 = FilePath("E:\00 - Workdata of Research\01 - Paper writting\03 - Personalized Pedestrian Navigation Path Options\03 - Bondi Junction\Version 2\02 - ShapeFiles\L4 new Update\POIs.shp")
shp_import_26 = ShapefileImport(path=path_26, read_geometry=toggle_6, read_records=toggle_6)  # -> out, shape_type, flatten(geometry), fields, field_names, flatten(records); inputs path: tree, read_geometry: tree of Boolean, read_records: tree of Boolean, field_ids: tree, enc: tree; same code as shp_import

# ----
# Corridor
path_27 = FilePath("E:\00 - Workdata of Research\01 - Paper writting\03 - Personalized Pedestrian Navigation Path Options\03 - Bondi Junction\Version 2\02 - ShapeFiles\L4 new Update\corridor.shp")
shp_import_27 = ShapefileImport(path=path_27, read_geometry=toggle_6, read_records=toggle_6)  # -> out, shape_type, flatten(geometry), fields, field_names, flatten(records); inputs path: tree, read_geometry: tree of Boolean, read_records: tree of Boolean, field_ids: tree, enc: tree; same code as shp_import

# ---- group: Corridor
# Corridor shape
path_28 = FilePath("E:\00 - Workdata of Research\01 - Paper writting\03 - Personalized Pedestrian Navigation Path Options\03 - Bondi Junction\Version 2\02 - ShapeFiles\L4\L4_corridor.shp")
shp_import_28 = ShapefileImport(path=path_28, read_geometry=toggle_6, read_records=toggle_6)  # -> out, shape_type, flatten(geometry), fields, field_names, flatten(records); inputs path: tree, read_geometry: tree of Boolean, read_records: tree of Boolean, field_ids: tree, enc: tree; same code as shp_import

# ----
# Level 2
toggle_7 = BooleanToggle(False)

# ----
# Shops
path_29 = FilePath("E:\00 - Workdata of Research\01 - Paper writting\03 - Personalized Pedestrian Navigation Path Options\03 - Bondi Junction\Version 2\02 - ShapeFiles\L2 new Update\shops.shp")
shp_import_29 = ShapefileImport(path=path_29, read_geometry=toggle_7, read_records=toggle_7)  # -> out, shape_type, flatten(geometry), fields, field_names, flatten(records); inputs path: tree, read_geometry: tree of Boolean, read_records: tree of Boolean, field_ids: tree, enc: tree; same code as shp_import

# ----
# POIs
path_30 = FilePath("E:\00 - Workdata of Research\01 - Paper writting\03 - Personalized Pedestrian Navigation Path Options\03 - Bondi Junction\Version 2\02 - ShapeFiles\L2 new Update\POIs.shp")
shp_import_30 = ShapefileImport(path=path_30, read_geometry=toggle_7, read_records=toggle_7)  # -> out, shape_type, flatten(geometry), fields, field_names, flatten(records); inputs path: tree, read_geometry: tree of Boolean, read_records: tree of Boolean, field_ids: tree, enc: tree; same code as shp_import

# ----
# Corridor
path_31 = FilePath("E:\00 - Workdata of Research\01 - Paper writting\03 - Personalized Pedestrian Navigation Path Options\03 - Bondi Junction\Version 2\02 - ShapeFiles\L2 new Update\corridor.shp")
shp_import_31 = ShapefileImport(path=path_31, read_geometry=toggle_7, read_records=toggle_7)  # -> out, shape_type, flatten(geometry), fields, field_names, flatten(records); inputs path: tree, read_geometry: tree of Boolean, read_records: tree of Boolean, field_ids: tree, enc: tree; same code as shp_import

# ---- group: Corridor
# Corridor shape
path_32 = FilePath("E:\00 - Workdata of Research\01 - Paper writting\03 - Personalized Pedestrian Navigation Path Options\03 - Bondi Junction\Version 2\02 - ShapeFiles\L2\L2_corridor.shp")
shp_import_32 = ShapefileImport(path=path_32, read_geometry=toggle_7, read_records=toggle_7)  # -> out, shape_type, flatten(geometry), fields, field_names, flatten(records); inputs path: tree, read_geometry: tree of Boolean, read_records: tree of Boolean, field_ids: tree, enc: tree; same code as shp_import

# ----
panel_13 = Panel(path_29)

# ----
# Level 5
toggle_8 = BooleanToggle(False)

# ----
# Walls
path_33 = FilePath("E:\00 - Workdata of Research\01 - Paper writting\03 - Personalized Pedestrian Navigation Path Options\03 - Bondi Junction\Version 2\02 - ShapeFiles\L5 new Update\wall_L5.shp")
shp_import_33 = ShapefileImport(path=path_33, read_geometry=toggle_8, read_records=toggle_8)  # -> out, shape_type, flatten(geometry), fields, field_names, flatten(records); inputs path: tree, read_geometry: tree of Boolean, read_records: tree of Boolean, field_ids: tree, enc: tree; same code as shp_import

# ----
# Atrium/Obstacle
path_34 = FilePath("E:\00 - Workdata of Research\01 - Paper writting\03 - Personalized Pedestrian Navigation Path Options\03 - Bondi Junction\Version 2\02 - ShapeFiles\L5 new Update\wall_inner_L5.shp")
shp_import_34 = ShapefileImport(path=path_34, read_geometry=toggle_8, read_records=toggle_8)  # -> out, shape_type, flatten(geometry), fields, field_names, flatten(records); inputs path: tree, read_geometry: tree of Boolean, read_records: tree of Boolean, field_ids: tree, enc: tree; same code as shp_import

# ----
# Shops
path_35 = FilePath("E:\00 - Workdata of Research\01 - Paper writting\03 - Personalized Pedestrian Navigation Path Options\03 - Bondi Junction\Version 2\02 - ShapeFiles\L5 new Update\shops.shp")
shp_import_35 = ShapefileImport(path=path_35, read_geometry=toggle_8, read_records=toggle_8)  # -> out, shape_type, flatten(geometry), fields, field_names, flatten(records); inputs path: tree, read_geometry: tree of Boolean, read_records: tree of Boolean, field_ids: tree, enc: tree; same code as shp_import

# ----
# POIs
path_36 = FilePath("E:\00 - Workdata of Research\01 - Paper writting\03 - Personalized Pedestrian Navigation Path Options\03 - Bondi Junction\Version 2\02 - ShapeFiles\L5 new Update\POIs.shp")
shp_import_36 = ShapefileImport(path=path_36, read_geometry=toggle_8, read_records=toggle_8)  # -> out, shape_type, flatten(geometry), fields, field_names, flatten(records); inputs path: tree, read_geometry: tree of Boolean, read_records: tree of Boolean, field_ids: tree, enc: tree; same code as shp_import

# ----
# Corridor
path_37 = FilePath("E:\00 - Workdata of Research\01 - Paper writting\03 - Personalized Pedestrian Navigation Path Options\03 - Bondi Junction\Version 2\02 - ShapeFiles\L5 new Update\Corridor.shp")
shp_import_37 = ShapefileImport(path=path_37, read_geometry=toggle_8, read_records=toggle_8)  # -> out, shape_type, flatten(geometry), fields, field_names, flatten(records); inputs path: tree, read_geometry: tree of Boolean, read_records: tree of Boolean, field_ids: tree, enc: tree; same code as shp_import

# ---- group: Corridor
# Corridor shape
path_38 = FilePath("E:\00 - Workdata of Research\01 - Paper writting\03 - Personalized Pedestrian Navigation Path Options\03 - Bondi Junction\Version 2\02 - ShapeFiles\L5\L5_corridor.shp")
shp_import_38 = ShapefileImport(path=path_38, read_geometry=toggle_8, read_records=toggle_8)  # -> out, shape_type, flatten(geometry), fields, field_names, flatten(records); inputs path: tree, read_geometry: tree of Boolean, read_records: tree of Boolean, field_ids: tree, enc: tree; same code as shp_import

# ----
panel_14 = Panel(shp_import_35.records)

# ----
# Level 3
toggle_9 = BooleanToggle(False)

# ----
# Shops
path_39 = FilePath("E:\00 - Workdata of Research\01 - Paper writting\03 - Personalized Pedestrian Navigation Path Options\03 - Bondi Junction\Version 2\02 - ShapeFiles\L3 new Update\shops.shp")
shp_import_39 = ShapefileImport(path=path_39, read_geometry=toggle_9, read_records=toggle_9)  # -> out, shape_type, flatten(geometry), fields, field_names, flatten(records); inputs path: tree, read_geometry: tree of Boolean, read_records: tree of Boolean, field_ids: tree, enc: tree; same code as shp_import

# ----
# POIs
path_40 = FilePath("E:\00 - Workdata of Research\01 - Paper writting\03 - Personalized Pedestrian Navigation Path Options\03 - Bondi Junction\Version 2\02 - ShapeFiles\L3 new Update\POIs.shp")
shp_import_40 = ShapefileImport(path=path_40, read_geometry=toggle_9, read_records=toggle_9)  # -> out, shape_type, flatten(geometry), fields, field_names, flatten(records); inputs path: tree, read_geometry: tree of Boolean, read_records: tree of Boolean, field_ids: tree, enc: tree; same code as shp_import

# ----
# Corridor
path_41 = FilePath("E:\00 - Workdata of Research\01 - Paper writting\03 - Personalized Pedestrian Navigation Path Options\03 - Bondi Junction\Version 2\02 - ShapeFiles\L3 new Update\corridor.shp")
shp_import_41 = ShapefileImport(path=path_41, read_geometry=toggle_9, read_records=toggle_9)  # -> out, shape_type, flatten(geometry), fields, field_names, flatten(records); inputs path: tree, read_geometry: tree of Boolean, read_records: tree of Boolean, field_ids: tree, enc: tree; same code as shp_import

# ---- group: Corridor
# Corridor shape
path_42 = FilePath("E:\00 - Workdata of Research\01 - Paper writting\03 - Personalized Pedestrian Navigation Path Options\03 - Bondi Junction\Version 2\02 - ShapeFiles\L3\L3_corridor.shp")
shp_import_42 = ShapefileImport(path=path_42, read_geometry=toggle_9, read_records=toggle_9)  # -> out, shape_type, flatten(geometry), fields, field_names, flatten(records); inputs path: tree, read_geometry: tree of Boolean, read_records: tree of Boolean, field_ids: tree, enc: tree; same code as shp_import

# ----
# Level 6
toggle_10 = BooleanToggle(False)
number_slider_25 = Slider(1, range=0..10)

# ----
# Shops
path_43 = FilePath("E:\00 - Workdata of Research\01 - Paper writting\03 - Personalized Pedestrian Navigation Path Options\03 - Bondi Junction\Version 2\02 - ShapeFiles\L6 new Update\shops.shp")
shp_import_43 = ShapefileImport(path=path_43, read_geometry=toggle_10, read_records=toggle_10)  # -> out, shape_type, flatten(geometry), fields, field_names, flatten(records); inputs path: tree, read_geometry: tree of Boolean, read_records: tree of Boolean, field_ids: tree, enc: tree; same code as shp_import

# ----
# POIs
path_44 = FilePath("E:\00 - Workdata of Research\01 - Paper writting\03 - Personalized Pedestrian Navigation Path Options\03 - Bondi Junction\Version 2\02 - ShapeFiles\L6 new Update\POIs.shp")
shp_import_44 = ShapefileImport(path=path_44, read_geometry=toggle_10, read_records=toggle_10)  # -> out, shape_type, flatten(geometry), fields, field_names, flatten(records); inputs path: tree, read_geometry: tree of Boolean, read_records: tree of Boolean, field_ids: tree, enc: tree; same code as shp_import

# ----
# Corridor
path_45 = FilePath("E:\00 - Workdata of Research\01 - Paper writting\03 - Personalized Pedestrian Navigation Path Options\03 - Bondi Junction\Version 2\02 - ShapeFiles\L6 new Update\corridor.shp")
shp_import_45 = ShapefileImport(path=path_45, read_geometry=toggle_10, read_records=toggle_10)  # -> out, shape_type, flatten(geometry), fields, field_names, flatten(records); inputs path: tree, read_geometry: tree of Boolean, read_records: tree of Boolean, field_ids: tree, enc: tree; same code as shp_import

# ---- group: Corridor
# Corridor shape
path_46 = FilePath("E:\00 - Workdata of Research\01 - Paper writting\03 - Personalized Pedestrian Navigation Path Options\03 - Bondi Junction\Version 2\02 - ShapeFiles\L6\L6_corridor.shp")
shp_import_46 = ShapefileImport(path=path_46, read_geometry=toggle_10, read_records=toggle_10)  # -> out, shape_type, flatten(geometry), fields, field_names, flatten(records); inputs path: tree, read_geometry: tree of Boolean, read_records: tree of Boolean, field_ids: tree, enc: tree; same code as shp_import

# ----
panel_15 = Panel(path_46)

python_22 = GhPythonScript(deltaZ=Slider(0, range=0..10), x=shp_import_31.geometry)  # -> allV, deltaX, deltaY, myMove; inputs x: list of Brep; same code as python_10
movevector_9 = Vector(python_22.myMove)

python_23 = GhPythonScript(vector1=python.myMove, vector2=movevector_9)  # -> out, MoveVector2; inputs vector1: Vector3d, vector2: Vector3d
# ---------- python_23: Python ----------
MoveVector2 = vector1 + vector2
# ---------- end python_23 ----------

move_42 = Move(Geometry=shp_import_31.geometry, Motion=python_23.MoveVector2)  # -> Geometry, Transform
move_43 = Move(Geometry=shp_import_32.geometry, Motion=python_23.MoveVector2)  # -> Geometry, Transform
move_44 = Move(Geometry=shp_import_30.geometry, Motion=python_23.MoveVector2)  # -> Geometry, Transform
move_45 = Move(Geometry=shp_import_29.geometry, Motion=python_23.MoveVector2)  # -> Geometry, Transform
crv_8 = Curve(move_42.Geometry)
python_24 = GhPythonScript(run=Toggle(True), corridor=crv_8, rooms=move_45.Geometry)  # -> out, allinter, allIntermiddlePoints, flatten(QRcodes), flatten(QRcodesAttri); inputs corridor: Brep, rooms: list of Brep
# ---------- python_24: Python ----------
import ghpythonlib.components as gc
import Rhino.Geometry as rg
import scriptcontext as sc
import math


def getIntersectionPoints(curveA, curveB):
    tol = sc.doc.ModelAbsoluteTolerance
    FA, EA, VA = gc.DeconstructBrep(curveA)
    FB, EB, VB = gc.DeconstructBrep(curveB)
    
    interPoints = []
    R = 1
    
    for i in range(0,len(VA)):
        for j in range(0,len(VB)):
            if gc.Distance(VA[i],VB[j])<tol:
                
                circleA = rg.Circle(VA[i], R)
                AreaA, centroidA = gc.Area(gc.RegionIntersection(circleA, curveA))
                AreaB, centroidB = gc.Area(gc.RegionIntersection(circleA, curveB))
                
                if abs(AreaA + AreaB - math.pi*R*R) > tol:
                    interPoints.append(VA[i])
                break
                
    return interPoints


def getIntermiddlePoints(points,d,myZ):
    a = points[0]
    b = points[1]
    
    if a.X-b.X == 0:
        p1 = rg.Point3d(a.X+d,(a.Y+b.Y)/2,myZ)
        p2 = rg.Point3d(a.X-d,(a.Y+b.Y)/2,myZ)
        
    else:
        k = (a.Y-b.Y)/(a.X-b.X)
        
        x0 = (a.X + b.X)/2
        y0 = (a.Y + b.Y)/2
        
        myX0 = x0+k*d*(math.sqrt(1/(k*k+1)))
        myY0 = y0-d*(math.sqrt(1/(k*k+1)))
        
        myX1 = x0-k*d*(math.sqrt(1/(k*k+1)))
        myY1 = y0+d*(math.sqrt(1/(k*k+1)))
        
        p1 = rg.Point3d(myX0,myY0,myZ)
        p2 = rg.Point3d(myX1,myY1,myZ)
    return p1,p2

def isPointInsideBrep(point, brep):
    point_temp1 = rg.Point3d(point.X, point.Y, point.Z+20)
    point_temp2 = rg.Point3d(point.X, point.Y, point.Z-20)
    line_temp = rg.Line(point_temp1,point_temp2)
    
    interCurve, points = gc.BrepXLine(brep,line_temp)
    if points!= None:
        return True
    else:
        return False


allinter = []
allIntermiddlePoints = []
QRcodes = []

if run:
    myZ = corridor.Vertices[0].Location.Z
    d = 1
    
    for i in range(0,len(rooms)):
        interPoints = getIntersectionPoints(corridor, rooms[i])
        if len(interPoints)>1:#!=0
            allinter.append(interPoints[0])
            allinter.append(interPoints[1])
            p1,p2 = getIntermiddlePoints(interPoints,d,myZ)
            
            allIntermiddlePoints.append(p1)
            allIntermiddlePoints.append(p2)
            
            if isPointInsideBrep(p1, rooms[i]):
                QRcodes.append(p2)
            else:
                QRcodes.append(p1)

    QRcodesAttri = [None]*5*len(QRcodes)
# ---------- end python_24 ----------
python_25 = GhPythonScript(run=Toggle(True), corridor=crv_8)  # -> out, c_QRAddRemoveDup, c_points_inside, c_points_outside, obstaclesAdd, Atriums; inputs run: Boolean, corridor: list of Brep
# ---------- python_25: Python ----------
import ghpythonlib.components as gc
import Rhino.Geometry as rg
import math
import scriptcontext as sc

def getExtensionPoints(restV, myZ):
    #using the outer points to get the extension points
    
    extensionL = []
    extensionP = []
    originalP = []
    
    for i in range(0,len(restV)-1):
        a = restV[i]
        b = restV[i+1]
        
        eL, eP = getExtensionLP(a,b,myZ)
        extensionL.append(eL)
        extensionP.append(eP)
        originalP.append(a)
        
    eL, eP = getExtensionLP(restV[0],restV[-1],myZ)
    extensionL.append(eL)
    extensionP.append(eP)
    originalP.append(restV[0])
    
        
    for i in range(0,len(restV)-1):
        aa = restV[i+1]
        bb = restV[i]
        eL, eP = getExtensionLP(aa,bb,myZ)
        extensionL.append(eL)
        extensionP.append(eP)
        originalP.append(aa)
        
    eL, eP = getExtensionLP(restV[-1],restV[0],myZ)
    extensionL.append(eL)
    extensionP.append(eP)
    originalP.append(restV[-1])
        
    return extensionL, extensionP, originalP

def getExtensionLP(a,b,myZ):
    d=1500
    
    if a.X-b.X == 0:
        x0 = a.X
        y0 = a.Y
        
        myX0 = x0
        myY0 = y0+d
        
        myX1 = x0
        myY1 = y0-d
        
        p1 = rg.Point3d(myX0,myY0,myZ)
        p2 = rg.Point3d(myX1,myY1,myZ)
        
        if gc.Distance(p1,b) > gc.Distance(p2,b):
            extensionL = rg.Line(p1,a)
            extensionP = p1
        else:
            extensionL = rg.Line(p2,a)
            extensionP = p2
        
    else:    
        k = (a.Y-b.Y)/(a.X-b.X)
        
        x0 = a.X
        y0 = a.Y
        
        myX0 = x0+d*(math.sqrt(1/(k*k+1)))
        myY0 = y0+k*d*(math.sqrt(1/(k*k+1)))
        
        myX1 = x0-d*(math.sqrt(1/(k*k+1)))
        myY1 = y0-k*d*(math.sqrt(1/(k*k+1)))
        
        p1 = rg.Point3d(myX0,myY0,myZ)
        p2 = rg.Point3d(myX1,myY1,myZ)
        
        if gc.Distance(p1,b) > gc.Distance(p2,b):
            extensionL = rg.Line(p1,a)
            extensionP = p1
        else:
            extensionL = rg.Line(p2,a)
            extensionP = p2
    return extensionL, extensionP

def allQRAdd(originalP,extensionP):
    centralLines = []
    allQRAdd = []
    
    for i in range(0,len(originalP)):
        pairP = []
        myCurves = []
        for j in range(0,len(originalP)):
            if i != j and gc.Distance(originalP[i],originalP[j])==0:
                pairP.append(extensionP[i])
                pairP.append(extensionP[j])
                
                midPoint = (extensionP[i]+extensionP[j])/2
                centerL = rg.Line(originalP[i],midPoint)
                centralLines.append(gc.ExtendCurve(centerL,0,100,100))
                
                circleP = rg.Circle(originalP[i], 1)
                
                points, params_a, params_b = gc.CurveXCurve(centralLines[i],circleP)
                if points:
                    allQRAdd = allQRAdd + points
    QRAddRemoveDup = rg.Point3d.CullDuplicates(allQRAdd, 0.01)
    return QRAddRemoveDup

def polygon_ray_casting(bounding_points, bounding_box_positions):
    #bounding_points: nodes that make up the polygon.
    #bounding_box_positions: candidate points to filter. 
    
    # Arrays containing the x- and y-coordinates of the polygon's vertices.
    vertx = [point[0] for point in bounding_points]
    verty = [point[1] for point in bounding_points]
    # Number of vertices in the polygon
    nvert = len(bounding_points)
    # Points that are inside
    points_inside = []
    points_outside = []

    # For every candidate position within the bounding box
    for idx, pos in enumerate(bounding_box_positions):
        testx, testy = (pos[0], pos[1])
        c = 0
        for i in range(0, nvert):
            j = i - 1 if i != 0 else nvert - 1
            if( ((verty[i] > testy ) != (verty[j] > testy))   and
                    (testx < (vertx[j] - vertx[i]) * (testy - verty[i]) / (verty[j] - verty[i]) + vertx[i]) ):
                c += 1
        # If odd, that means that we are inside the polygon
        if c % 2 == 1: 
            points_inside.append(pos)
        else: 
            points_outside.append(pos)
    return points_inside, points_outside

#print corridor[0].Vertices[0].Location.Z

if run:
    
    myZ = corridor[0].Vertices[0].Location.Z
    
    Atriums = corridor[1:]
    FC, EC, VC = gc.DeconstructBrep(corridor[0])
    c_extensionL, c_extensionP, c_originalP = getExtensionPoints(VC, myZ)
    c_QRAddRemoveDup = allQRAdd(c_originalP,c_extensionP)
    c_points_inside, c_points_outside = polygon_ray_casting(VC, c_QRAddRemoveDup)
    
    obstaclesAdd = []
    
    for i in range(1,len(corridor)):
        FC, EC, VC = gc.DeconstructBrep(corridor[i])
        extensionL, extensionP, originalP = getExtensionPoints(VC,myZ)
        QRAddRemoveDup = allQRAdd(originalP,extensionP)
        points_inside, points_outside = polygon_ray_casting(VC, QRAddRemoveDup)
        obstaclesAdd = obstaclesAdd + points_outside
        """"""
# ---------- end python_25 ----------
pt_2 = Point(python_25.c_points_inside)
pt_3 = Point(python_25.obstaclesAdd)
qrcodes = Point([python_24.QRcodes, move_44.Geometry])
qrcodesattri = Text([python_24.QRcodesAttri, shp_import_30.records])
pt_4 = Point([pt_2, pt_3])
python_26 = GhPythonScript(QRcodes=qrcodes, potentialQRAdd=pt_4, R=Slider(2.5, range=0..10))  # -> out, QRcodesAdd, QRcodesAddAttri; inputs QRcodes: list of Point3d, potentialQRAdd: list of Point3d
# ---------- python_26: Python ----------
import Rhino.Geometry as rg
import ghpythonlib.components as gc

QRAdd = []
myQRAdd = []
#mypotentialQRAdd = potentialQRAdd

for i in range(0,len(QRcodes)):
    for j in range(0,len(potentialQRAdd)):
        if gc.Distance(QRcodes[i], potentialQRAdd[j])<R:
            QRAdd.append(potentialQRAdd[j])
            #mypotentialQRAdd[j] = None

QRcodesAdd = [i for i in potentialQRAdd if i not in QRAdd]

QRcodesAddAttri = [None]*5*len(QRcodesAdd)
# ---------- end python_26 ----------
qradd = Point(python_26.QRcodesAdd)
voronoi_5 = Voronoi(Points=flatten([qrcodes, qradd]), BruteForceOverride=False)
rint_5 = RegionIntersection(CurvesA=voronoi_5, CurvesB=move_43.Geometry)
rdiff_5 = RegionDifference(CurvesA=rint_5, CurvesB=python_25.Atriums)
python_27 = GhPythonScript(
    run=Toggle(True),
    shops=move_45.Geometry,
    shopAttri=shp_import_29.records,
    otherSpaces=rdiff_5,
    QRtagsOri=qrcodes,
    QRTagOriAttri=qrcodesattri,
    QRtagsAdd=qradd,
    QRTagAddAttri=python_26.QRcodesAddAttri,
    level=Slider(2, range=1..6))  # -> Network, NodeDic, Nodes, Links, Attri; inputs run: Boolean, shops: list of Curve, shopAttri: list, otherSpaces: list of Curve, QRtagsOri: list of Point3d, QRTagOriAttri: list, QRtagsAdd: list of Point3d, QRTagAddAttri: list, level: Int32
# ---------- python_27: Python ----------
from collections import deque, namedtuple
import Rhino.Geometry as rg
import ghpythonlib.components as gc
import re

# we'll use infinity as a default distance to nodes.
inf = float('inf')
Edge = namedtuple('Edge', 'start, end, cost')


def make_edge(start, end, cost=1):
  return Edge(start, end, cost)


class Graph:
    def __init__(self, edges):
        # let's check that the data is right
        wrong_edges = [i for i in edges if len(i) not in [2, 3]]
        if wrong_edges:
            raise ValueError('Wrong edges data: {}'.format(wrong_edges))

        self.edges = [make_edge(*edge) for edge in edges]
        
    @property
    def vertices(self):
        return set(
            sum(
                ([edge.start, edge.end] for edge in self.edges), []
            )
        )

    def get_node_pairs(self, n1, n2, both_ends=True):
        if both_ends:
            node_pairs = [[n1, n2], [n2, n1]]
        else:
            node_pairs = [[n1, n2]]
        return node_pairs

    def remove_edge(self, n1, n2, both_ends=True):
        node_pairs = self.get_node_pairs(n1, n2, both_ends)
        edges = self.edges[:]
        for edge in edges:
            if [edge.start, edge.end] in node_pairs:
                self.edges.remove(edge)

    def add_edge(self, n1, n2, cost=1, both_ends=True):
        node_pairs = self.get_node_pairs(n1, n2, both_ends)
        for edge in self.edges:
            if [edge.start, edge.end] in node_pairs:
                return ValueError('Edge {} {} already exists'.format(n1, n2))

        self.edges.append(Edge(start=n1, end=n2, cost=cost))
        if both_ends:
            self.edges.append(Edge(start=n2, end=n1, cost=cost))

    @property
    def neighbours(self):
        neighbours = {vertex: set() for vertex in self.vertices}
        for edge in self.edges:
            neighbours[edge.start].add((edge.end, edge.cost))

        return neighbours

    def dijkstra(self, source, dest):
        assert source in self.vertices, 'Such source node doesn\'t exist'
        distances = {vertex: inf for vertex in self.vertices}
        previous_vertices = {
            vertex: None for vertex in self.vertices
        }
        distances[source] = 0
        vertices = self.vertices.copy()

        while vertices:
            current_vertex = min(
                vertices, key=lambda vertex: distances[vertex])
            vertices.remove(current_vertex)
            if distances[current_vertex] == inf:
                break
            for neighbour, cost in self.neighbours[current_vertex]:
                alternative_route = distances[current_vertex] + cost
                if alternative_route < distances[neighbour]:
                    distances[neighbour] = alternative_route
                    previous_vertices[neighbour] = current_vertex

        path, current_vertex = deque(), dest
        while previous_vertices[current_vertex] is not None:
            path.appendleft(current_vertex)
            current_vertex = previous_vertices[current_vertex]
        if path:
            path.appendleft(current_vertex)
        return path

def createBooleanIntersection(curveA, curveB):
    #curveA is a brep or enclosed polyline
    #curveB is a curve, brep, or enclosed polyline
    points, params_a, params_b = gc.CurveXCurve(gc.JoinCurves(curveA,False),gc.JoinCurves(curveB,False))
    if isinstance(points, list):
        intersections = []
        mydirection = rg.Vector3d(0,0,1)
        brepA = gc.BoundarySurfaces(curveA)
        curves_B = curveB.DuplicateSegments()
        
        for cb in curves_B:
            overlaps = rg.Curve.ProjectToBrep(gc.JoinCurves(cb,False),brepA,mydirection,0.01)
            if len(overlaps)!=0:
                for ol in overlaps:
                    intersections.append(ol)

        return intersections
    else:
        return None

def networkDerivation(QRtagsOri,QRTagOriAttri,QRTagAddAttri,QRtagsAdd,shops,otherSpaces,shopAttri):

    Links = []
    Nodes = []
    allNodes = []
    
    Network = []
    NodeDic = []
    
    QRtags = QRtagsOri + QRtagsAdd
    Spaces = shops + otherSpaces
    QRTagAttri = QRTagOriAttri + QRTagAddAttri
    
    Attri = []
    for i in range(0,int(len(shopAttri)/6)):
        if shopAttri[6*i+1] == '':
            Attri.append('Shop_L'+str(level)+'_'+str(i))
        else:
            Attri.append(shopAttri[6*i+1])
    print len(Attri)
    print len(shops)
    print Attri
    print len(QRtags)
    print len(QRTagAttri)
    
    for i in range(0,len(otherSpaces)):
        Attri.append('Corridor_L'+str(level)+'_'+str(i))
        """
        for j in range(0,len(QRtags)):
            if str(otherSpaces[i].Contains(QRtags[j])) == 'Inside':
                if QRTagAttri[5*j+1]:
                    print QRTagAttri[5*j+1], '---', i, '----------', j
                    Attri.append(QRTagAttri[5*j+1])
                    
                else:
                    Attri.append('Corridor_L'+str(level)+'_'+str(i))
                    print 'i=', i
                    """
    #for i in range(len(QRtagsOri), len(otherSpaces)):

    print len(otherSpaces)
    print len(Attri)-57
    
    print Attri
    
    
    flag2QRtags = [0]*len(QRtags)
    for i in range(0,len(Spaces)):
        flag = 0
        for j in range(0,len(QRtags)):
            if str(Spaces[i].Contains(QRtags[j])) == 'Inside':
                Nodes.append(QRtags[j])

                if j < int(len(QRTagAttri)/5):
                    if QRTagAttri[5*j+1]:
                        NodeDic.append(QRTagAttri[5*j+1])
                    else:
                        NodeDic.append(Attri[i])
                    NodeDic.append(QRtags[j])
                
                else:
                    NodeDic.append(Attri[i])
                    NodeDic.append(QRtags[j])
                
                flag2QRtags[j] = 1
                flag = 1
                break
        if flag == 0:
            area, centroid = gc.Area(Spaces[i])
            Nodes.append(centroid)
            
            NodeDic.append(Attri[i])
            NodeDic.append(centroid)

    for i in range(0,len(Spaces)):
        for j in range(i+1,len(Spaces)):
            inter = createBooleanIntersection(Spaces[i], Spaces[j])
            if inter != None and len(inter)!=0:
                Links.append(gc.Line(Nodes[i],Nodes[j]))
                distance_ij = gc.Distance(Nodes[i],Nodes[j])
                edge_ij = make_edge(Attri[i], Attri[j], distance_ij)
                edge_ji = make_edge(Attri[j], Attri[i], distance_ij)
                Network.append(edge_ij)
                Network.append(edge_ji)
                    
    
    return Links, Nodes, Network, NodeDic

def createAttri_NodeDic(shops, otherSpaces, QRtagsOri, QRTagOriAttri, QRtagsAdd, QRTagAddAttri):
    
    QRtags = QRtagsOri + QRtagsAdd
    Spaces = shops + otherSpaces

    QRTagAttri = QRTagOriAttri + QRTagAddAttri
    
    NodeDic = []
    Nodes = []
    Attri = []

    for i in range(0,len(shops)):
        if shopAttri[6*i+1]:
            Attri.append(shopAttri[6*i+1])
            
            area, centroid = gc.Area(shops[i])
            NodeDic.append(shopAttri[6*i+1])
            NodeDic.append(centroid)
            Nodes.append(centroid)
            
        else:
            Attri.append('Shop_L'+str(level)+'_'+str(i))
            
            area, centroid = gc.Area(shops[i])
            NodeDic.append('Shop_L'+str(level)+'_'+str(i))
            NodeDic.append(centroid)
            Nodes.append(centroid)
    
    for i in range(0,len(otherSpaces)):
        flag_Inside =0
        for j in range(0,len(QRtags)):
            if str(otherSpaces[i].Contains(QRtags[j])) == 'Inside':
                flag_Inside =1
                Nodes.append(QRtags[j])
                
                if QRTagAttri[5*j+1]:
                    Attri.append(QRTagAttri[5*j+1])
                    
                    NodeDic.append(QRTagAttri[5*j+1])
                    NodeDic.append(QRtags[j])
                    
                    break
                else:
                    Attri.append('Corridor_L'+str(level)+'_'+str(i))
                    
                    NodeDic.append('Corridor_L'+str(level)+'_'+str(i))
                    NodeDic.append(QRtags[j])
                    
                    break
        if flag_Inside == 0:
            
            Attri.append('Corridor_L'+str(level)+'_'+str(i))
            
            area, centroid = gc.Area(otherSpaces[i])
            NodeDic.append('Corridor_L'+str(level)+'_'+str(i))
            NodeDic.append(centroid)
            Nodes.append(centroid)
    
    # Network derivation
    Links = []
    Network = []

    myNodeDict = {}
    for i in range (0,int(len(NodeDic)/2)):
        myNodeDict[NodeDic[2*i]] = NodeDic[2*i+1]

    for i in range(0,len(Spaces)):
        for j in range(i+1,len(Spaces)):
            inter = createBooleanIntersection(Spaces[i], Spaces[j])
            if inter != None and len(inter)!=0:
                Links.append(gc.Line(Nodes[i],Nodes[j]))
                
                myEdge = gc.Line(Nodes[i],Nodes[j])
                #for k in range(0,len(Spaces)):
                    #points, params_a, params_b = gc.CurveXCurve(myEdge,Spaces[k])
                #if points == None:
                distance_ij = gc.Distance(Nodes[i],Nodes[j])
                edge_ij = make_edge(Attri[i], Attri[j], distance_ij)
                edge_ji = make_edge(Attri[j], Attri[i], distance_ij)
                Network.append(edge_ij)
                Network.append(edge_ji)
    
    
    return Attri, NodeDic, Nodes, Links, Network
    
if run:
    #Links, Nodes, Network, NodeDic = networkDerivation(QRtagsOri,QRTagOriAttri,QRTagAddAttri,QRtagsAdd,shops,otherSpaces,shopAttri)
    Attri, NodeDic, Nodes, Links, Network = createAttri_NodeDic(shops, otherSpaces, QRtagsOri, QRTagOriAttri, QRtagsAdd, QRTagAddAttri)
# ---------- end python_27 ----------
line = Line(python_27.Links)

rectangle = Rectangle(Plane=qrcodes, XSize=dom_6, YSize=dom_5, Radius=0)  # -> Rectangle, Length
c_script_2 = CSharpScript(Curve=[move_45.Geometry, crv_8], Width=number_slider_15, Colour="black", Dash=list_5)  # -> out, A, B; inputs Curve: Curve, Width: Int32, Colour: Color, Dash: String; same code as c_script
brep = Brep(rectangle.Rectangle)  # disabled
cir = Circle(Plane=qrcodes, Radius=Slider(3, range=0..10))  # disabled
preview = CustomPreview(Geometry=brep, Material="black")
cir_2 = Circle(Plane=qradd, Radius=Slider(0.6, range=0..1))  # disabled
brep_2 = Brep(cir_2)
c_script_3 = CSharpScript(Curve=cir_2, Width=Slider(1, range=0..10), Colour="black", Dash=list_9)  # -> out, A, B; inputs Curve: Curve, Width: Int32, Colour: Color, Dash: String; same code as c_script
preview_2 = CustomPreview(Geometry=brep_2, Material="White")
c_script_4 = CSharpScript(Curve=rdiff_5, Width=Slider(0, range=0..10), Colour="green", Dash=list_11)  # -> out, A, B; inputs Curve: Curve, Width: Int32, Colour: Color, Dash: String; same code as c_script

# ---- group: Navigation Test
panel_16 = Panel("BenchA_L5")
python_28 = GhPythonScript(run=Toggle(False), Network=python_27.Network, NodeDic=python_27.NodeDic, departure="StairsA_L2", destination=panel_3)  # -> route, NodeDic; inputs run: Boolean, Network: list, NodeDic: list
# ---------- python_28: Python ----------
from collections import deque, namedtuple
import Rhino.Geometry as rg
import ghpythonlib.components as gc
import re

# we'll use infinity as a default distance to nodes.
inf = float('inf')
Edge = namedtuple('Edge', 'start, end, cost')


def make_edge(start, end, cost=1):
  return Edge(start, end, cost)


class Graph:
    def __init__(self, edges):
        # let's check that the data is right
        wrong_edges = [i for i in edges if len(i) not in [2, 3]]
        if wrong_edges:
            raise ValueError('Wrong edges data: {}'.format(wrong_edges))

        self.edges = [make_edge(*edge) for edge in edges]
        
    @property
    def vertices(self):
        return set(
            sum(
                ([edge.start, edge.end] for edge in self.edges), []
            )
        )

    def get_node_pairs(self, n1, n2, both_ends=True):
        if both_ends:
            node_pairs = [[n1, n2], [n2, n1]]
        else:
            node_pairs = [[n1, n2]]
        return node_pairs

    def remove_edge(self, n1, n2, both_ends=True):
        node_pairs = self.get_node_pairs(n1, n2, both_ends)
        edges = self.edges[:]
        for edge in edges:
            if [edge.start, edge.end] in node_pairs:
                self.edges.remove(edge)

    def add_edge(self, n1, n2, cost=1, both_ends=True):
        node_pairs = self.get_node_pairs(n1, n2, both_ends)
        for edge in self.edges:
            if [edge.start, edge.end] in node_pairs:
                return ValueError('Edge {} {} already exists'.format(n1, n2))

        self.edges.append(Edge(start=n1, end=n2, cost=cost))
        if both_ends:
            self.edges.append(Edge(start=n2, end=n1, cost=cost))

    @property
    def neighbours(self):
        neighbours = {vertex: set() for vertex in self.vertices}
        for edge in self.edges:
            neighbours[edge.start].add((edge.end, edge.cost))

        return neighbours

    def dijkstra(self, source, dest):
        assert source in self.vertices, 'Such source node doesn\'t exist'
        distances = {vertex: inf for vertex in self.vertices}
        previous_vertices = {
            vertex: None for vertex in self.vertices
        }
        distances[source] = 0
        vertices = self.vertices.copy()

        while vertices:
            current_vertex = min(
                vertices, key=lambda vertex: distances[vertex])
            vertices.remove(current_vertex)
            if distances[current_vertex] == inf:
                break
            for neighbour, cost in self.neighbours[current_vertex]:
                alternative_route = distances[current_vertex] + cost
                if alternative_route < distances[neighbour]:
                    distances[neighbour] = alternative_route
                    previous_vertices[neighbour] = current_vertex

        path, current_vertex = deque(), dest
        while previous_vertices[current_vertex] is not None:
            path.appendleft(current_vertex)
            current_vertex = previous_vertices[current_vertex]
        if path:
            path.appendleft(current_vertex)
        return path

if run:
    mygraph = Graph(Network)
    
    #graph = Graph([
    #("a", "b", 7),  ("a", "c", 9),  ("a", "f", 14), ("b", "c", 10),
    #("b", "d", 15), ("c", "d", 11), ("c", "f", 2),  ("d", "e", 6),
    #("e", "f", 9)])

    #print(graph.dijkstra("a", "e"))
    #route = mygraph.dijkstra("Papaya", "1919 Lanzhou Beef Noodle")
    route = mygraph.dijkstra(departure, destination)
# ---------- end python_28 ----------
python_29 = GhPythonScript(run=Toggle(False), route=python_28.route, NodeDic=python_28.NodeDic)  # -> out, Links; inputs run: Boolean, route: list, NodeDic: list
# ---------- python_29: Python ----------
import Rhino.Geometry as rg

myNodeDict = {}
Links = []

for i in range (0,int(len(NodeDic)/2)):
    myNodeDict[NodeDic[2*i]] = NodeDic[2*i+1]
#print myNodeDict['MyerL4']


if run:
    
    for i in range(0,len(route)-1):
        link = rg.Line(myNodeDict[route[i]],myNodeDict[route[i+1]])
        Links.append(link)
# ---------- end python_29 ----------
X_4 = UnitX(Factor=Slider(0, range=-101..1000))
list_45 = ValueList({"None": "", "Dot": "0.1 1.0", "Dash": "1.0", "DashDot": "1.0 1.0 0.1 1.0"}, selected="None")
move_46 = Move(Geometry=python_29.Links, Motion=X_4)  # -> Geometry, Transform
c_script_5 = CSharpScript(Curve=move_46.Geometry, Width=Slider(3, range=0..10), Colour="0,0,255", Dash=list_45)  # -> out, A, B; inputs Curve: Curve, Width: Int32, Colour: Color, Dash: String; same code as c_script

# ----
c_script_6 = CSharpScript(Curve=python_27.Links, Width=Slider(0, range=0..10), Colour="blue", Dash=list_20)  # -> out, A, B; inputs Curve: Curve, Width: Int32, Colour: Color, Dash: String; same code as c_script

python_30 = GhPythonScript(
    run=Toggle(False),
    Network=python_27.Network,
    NodeDic=python_27.NodeDic,
    allPlaces=python_27.Attri,
    walkableDistance="21.3",
    departure=list_21)  # -> potential_places, placesResult, sortedPlaces; inputs run: Boolean, Network: list, NodeDic: list, allPlaces: list
# ---------- python_30: Python ----------
from collections import deque, namedtuple
import Rhino.Geometry as rg
import ghpythonlib.components as gc
import re

# we'll use infinity as a default distance to nodes.
inf = float('inf')
Edge = namedtuple('Edge', 'start, end, cost')


def make_edge(start, end, cost=1):
  return Edge(start, end, cost)


class Graph:
    def __init__(self, edges):
        # let's check that the data is right
        wrong_edges = [i for i in edges if len(i) not in [2, 3]]
        if wrong_edges:
            raise ValueError('Wrong edges data: {}'.format(wrong_edges))

        self.edges = [make_edge(*edge) for edge in edges]
        
    @property
    def vertices(self):
        return set(
            sum(
                ([edge.start, edge.end] for edge in self.edges), []
            )
        )

    def get_node_pairs(self, n1, n2, both_ends=True):
        if both_ends:
            node_pairs = [[n1, n2], [n2, n1]]
        else:
            node_pairs = [[n1, n2]]
        return node_pairs

    def remove_edge(self, n1, n2, both_ends=True):
        node_pairs = self.get_node_pairs(n1, n2, both_ends)
        edges = self.edges[:]
        for edge in edges:
            if [edge.start, edge.end] in node_pairs:
                self.edges.remove(edge)

    def add_edge(self, n1, n2, cost=1, both_ends=True):
        node_pairs = self.get_node_pairs(n1, n2, both_ends)
        for edge in self.edges:
            if [edge.start, edge.end] in node_pairs:
                return ValueError('Edge {} {} already exists'.format(n1, n2))

        self.edges.append(Edge(start=n1, end=n2, cost=cost))
        if both_ends:
            self.edges.append(Edge(start=n2, end=n1, cost=cost))

    @property
    def neighbours(self):
        neighbours = {vertex: set() for vertex in self.vertices}
        for edge in self.edges:
            neighbours[edge.start].add((edge.end, edge.cost))

        return neighbours

    def dijkstra(self, source, dest):
        assert source in self.vertices, 'Such source node doesn\'t exist'
        distances = {vertex: inf for vertex in self.vertices}
        previous_vertices = {
            vertex: None for vertex in self.vertices
        }
        distances[source] = 0
        vertices = self.vertices.copy()

        while vertices:
            current_vertex = min(
                vertices, key=lambda vertex: distances[vertex])
            vertices.remove(current_vertex)
            if distances[current_vertex] == inf:
                break
            for neighbour, cost in self.neighbours[current_vertex]:
                alternative_route = distances[current_vertex] + cost
                if alternative_route < distances[neighbour]:
                    distances[neighbour] = alternative_route
                    previous_vertices[neighbour] = current_vertex

        path, current_vertex = deque(), dest
        while previous_vertices[current_vertex] is not None:
            path.appendleft(current_vertex)
            current_vertex = previous_vertices[current_vertex]
        if path:
            path.appendleft(current_vertex)
        return path

if run:
    print 'ok'

    myNodeDict = {}
    pd_distance_dic = {}
    potential_places = []
    
    for i in range (0,int(len(NodeDic)/2)):
        myNodeDict[NodeDic[2*i]] = NodeDic[2*i+1]
    for i in range(0,len(allPlaces)):
        distance = gc.Distance(myNodeDict[departure],myNodeDict[allPlaces[i]])
        if distance <= walkableDistance:
            pd_distance_dic[allPlaces[i]] = distance
            potential_places.append(allPlaces[i])

    sortedPlaces = []
    sortedD =  sorted(pd_distance_dic.items(), key=lambda pd_distance_dic:pd_distance_dic[1], reverse = True)
    for i in range(0,len(sortedD)):
        sortedPlaces.append(sortedD[i][0])
    GraphDic = {}
    for i in range(0,len(sortedPlaces)):
        kidList = []
        for j in range(0,len(Network)):
            if sortedPlaces[i] == Network[j].start:
                kidList.append(Network[j].end)
        GraphDic[sortedPlaces[i]] = kidList
    
    costDic = {}
    costList = []
    for i in range(0,len(Network)):
        costDic[Network[i].start+'+'+Network[i].end] = Network[i].cost

    validPlaces = []
    for i in range(0,len(sortedPlaces)):
        if 'Corridor' not in sortedPlaces[i]:
            validPlaces.append(sortedPlaces[i]) 
            #print sortedPlaces[i], '---', gc.Distance(myNodeDict[departure],myNodeDict[sortedPlaces[i]])
    print len(validPlaces)
    
    def pathLength(route, myNodeDict):
        Links = []
        for i in range(0,len(route)-1):
            link = rg.Line(myNodeDict[route[i]],myNodeDict[route[i+1]])
            Links.append(link)
        if len(Links) != 0:
            R, Pr = gc.MassAddition(gc.Length(Links))
            return R
        else:
            return 0
        
    
    mygraph = Graph(Network)
    placesResult = set()
    #route = mygraph.dijkstra(departure, 'Shoes & Sox')
    #print len(route)
    
    for i in range(0,len(validPlaces)):
        if validPlaces[i] not in placesResult: #and validPlaces[i] != 'Shoes & Sox' and validPlaces[i] != 'ToiletB_L5' and validPlaces[i] != 'ToiletC_L5' and validPlaces[i] != 'Superdry':
            route = mygraph.dijkstra(departure, validPlaces[i])
            pathL = pathLength(route, myNodeDict)
            if pathL <= walkableDistance and pathL !=0:
                for j in range(1,len(route)):
                    placesResult.add(route[j])

    """"""
# ---------- end python_30 ----------
python_31 = GhPythonScript(reachablePlaces=python_30.placesResult, places=python_27.Attri, locations=python_27.Nodes)  # -> a, myReachablePlaces; inputs reachablePlaces: list, places: list, locations: list of Point3d
# ---------- python_31: Python ----------
import Rhino.Geometry as rg

myNodeDict = {}
Links = []

for i in range (0,len(places)):
    myNodeDict[places[i]] = locations[i]
#print myNodeDict['MyerL4']
a = []

myReachablePlaces = []
for i in range(0,len(reachablePlaces)):
    if 'Corridor' not in reachablePlaces[i]:
        a.append(reachablePlaces[i])
        myReachablePlaces.append(myNodeDict[reachablePlaces[i]])
    if 'Stair' in reachablePlaces[i]:
        print reachablePlaces[i]
# ---------- end python_31 ----------
number_slider_26 = Slider(0.5, range=0..1)
dots_6 = DotDisplay(Point=python_31.myReachablePlaces, Colour="blue", Size=Slider(1.9, range=0..10))

python_32 = GhPythonScript(NodeDic=python_27.NodeDic, departure=list_21)  # -> out, D_location; inputs NodeDic: list
# ---------- python_32: Python ----------
myNodeDict = {}
pd_distance_dic = {}

for i in range (0,int(len(NodeDic)/2)):
    myNodeDict[NodeDic[2*i]] = NodeDic[2*i+1]

D_location = myNodeDict[departure]
# ---------- end python_32 ----------
cir_3 = Circle(Plane=python_32.D_location, Radius="21.3")  # disabled
brep_3 = Brep(cir_3)  # disabled
len = Length(Curve=python_29.Links)
c_script_7 = CSharpScript(Curve=cir_3, Width=Slider(2, range=0..10), Colour="red", Dash=list_30)  # -> out, A, B; inputs Curve: Curve, Width: Int32, Colour: Color, Dash: String; same code as c_script
ma = MassAddition(Input=len)  # -> Result, PartialResults
subtraction = Subtraction(A="80.35", B=ma.Result)
subtraction_2 = Subtraction(A=subtraction, B=list_31)
python_33 = GhPythonScript(placesResult=python_30.placesResult)  # -> a; inputs placesResult: list
# ---------- python_33: Python ----------
a = []

for i in range(0,len(placesResult)):
    if ('Lift' in placesResult[i] or 'Escalator' in placesResult[i] or 'Stairs' in placesResult[i]) and 'Door' not in placesResult[i]:
        a.append(placesResult[i])
        print placesResult[i]
# ---------- end python_33 ----------
panel_17 = Panel(ma.Result)
panel_18 = Panel(subtraction_2)
preview_3 = CustomPreview(Geometry=brep_3, Material=material)

python_34 = GhPythonScript(deltaZ=Slider(0, range=0..10), x=shp_import_37.geometry)  # -> allV, deltaX, deltaY, myMove; inputs x: list of Brep; same code as python_10
movevector_10 = Vector(python_34.myMove)

python_35 = GhPythonScript(vector1=python_4.myMove, vector2=movevector_10)  # -> out, MoveVector2; inputs vector1: Vector3d, vector2: Vector3d; same code as python_23
move_47 = Move(Geometry=shp_import_34.geometry, Motion=python_35.MoveVector2)  # -> Geometry, Transform
move_48 = Move(Geometry=shp_import_33.geometry, Motion=python_35.MoveVector2)  # -> Geometry, Transform
brep_4 = Brep([move_48.Geometry, move_47.Geometry])

move_49 = Move(Geometry=shp_import_38.geometry, Motion=python_35.MoveVector2)  # -> Geometry, Transform
move_50 = Move(Geometry=shp_import_37.geometry, Motion=python_35.MoveVector2)  # -> Geometry, Transform
move_51 = Move(Geometry=shp_import_35.geometry, Motion=python_35.MoveVector2)  # -> Geometry, Transform
move_52 = Move(Geometry=shp_import_36.geometry, Motion=python_35.MoveVector2)  # -> Geometry, Transform
crv_9 = Curve(move_50.Geometry)
python_36 = GhPythonScript(run=Toggle(True), corridor=crv_9, rooms=move_51.Geometry)  # -> out, allinter, allIntermiddlePoints, flatten(QRcodes), flatten(QRcodesAttri); inputs corridor: Brep, rooms: list of Brep; same code as python_24
python_37 = GhPythonScript(run=Toggle(True), corridor=crv_9)  # -> out, c_QRAddRemoveDup, c_points_inside, c_points_outside, obstaclesAdd, Atriums; inputs run: Boolean, corridor: list of Brep; same code as python_25
pt_5 = Point(python_37.c_points_inside)
pt_6 = Point(python_37.obstaclesAdd)
qrcodes_2 = Point([python_36.QRcodes, move_52.Geometry])
qrcodesattri_2 = Text([python_36.QRcodesAttri, shp_import_36.records])
pt_7 = Point([pt_5, pt_6])
python_38 = GhPythonScript(QRcodes=qrcodes_2, potentialQRAdd=pt_7, R=Slider(2, range=0..10))  # -> out, QRcodesAdd, QRcodesAddAttri; inputs QRcodes: list of Point3d, potentialQRAdd: list of Point3d; same code as python_26
qradd_2 = Point(python_38.QRcodesAdd)
voronoi_6 = Voronoi(Points=flatten([qrcodes_2, qradd_2]), BruteForceOverride=False)
rint_6 = RegionIntersection(CurvesA=voronoi_6, CurvesB=move_49.Geometry)
rdiff_6 = RegionDifference(CurvesA=rint_6, CurvesB=python_37.Atriums)
python_39 = GhPythonScript(
    run=Toggle(True),
    shops=move_51.Geometry,
    shopAttri=shp_import_35.records,
    otherSpaces=rdiff_6,
    QRtagsOri=qrcodes_2,
    QRTagOriAttri=qrcodesattri_2,
    QRtagsAdd=qradd_2,
    QRTagAddAttri=python_38.QRcodesAddAttri,
    walls=brep_4,
    level=Slider(5, range=1..6))  # -> Network, NodeDic, Nodes, Links, Attri; inputs run: Boolean, shops: list of Curve, shopAttri: list, otherSpaces: list of Curve, QRtagsOri: list of Point3d, QRTagOriAttri: list, QRtagsAdd: list of Point3d, QRTagAddAttri: list, walls: list of Brep, level: Int32
# ---------- python_39: Python ----------
from collections import deque, namedtuple
import Rhino.Geometry as rg
import ghpythonlib.components as gc
import re

# we'll use infinity as a default distance to nodes.
inf = float('inf')
Edge = namedtuple('Edge', 'start, end, cost')


def make_edge(start, end, cost=1):
  return Edge(start, end, cost)


class Graph:
    def __init__(self, edges):
        # let's check that the data is right
        wrong_edges = [i for i in edges if len(i) not in [2, 3]]
        if wrong_edges:
            raise ValueError('Wrong edges data: {}'.format(wrong_edges))

        self.edges = [make_edge(*edge) for edge in edges]
        
    @property
    def vertices(self):
        return set(
            sum(
                ([edge.start, edge.end] for edge in self.edges), []
            )
        )

    def get_node_pairs(self, n1, n2, both_ends=True):
        if both_ends:
            node_pairs = [[n1, n2], [n2, n1]]
        else:
            node_pairs = [[n1, n2]]
        return node_pairs

    def remove_edge(self, n1, n2, both_ends=True):
        node_pairs = self.get_node_pairs(n1, n2, both_ends)
        edges = self.edges[:]
        for edge in edges:
            if [edge.start, edge.end] in node_pairs:
                self.edges.remove(edge)

    def add_edge(self, n1, n2, cost=1, both_ends=True):
        node_pairs = self.get_node_pairs(n1, n2, both_ends)
        for edge in self.edges:
            if [edge.start, edge.end] in node_pairs:
                return ValueError('Edge {} {} already exists'.format(n1, n2))

        self.edges.append(Edge(start=n1, end=n2, cost=cost))
        if both_ends:
            self.edges.append(Edge(start=n2, end=n1, cost=cost))

    @property
    def neighbours(self):
        neighbours = {vertex: set() for vertex in self.vertices}
        for edge in self.edges:
            neighbours[edge.start].add((edge.end, edge.cost))

        return neighbours

    def dijkstra(self, source, dest):
        assert source in self.vertices, 'Such source node doesn\'t exist'
        distances = {vertex: inf for vertex in self.vertices}
        previous_vertices = {
            vertex: None for vertex in self.vertices
        }
        distances[source] = 0
        vertices = self.vertices.copy()

        while vertices:
            current_vertex = min(
                vertices, key=lambda vertex: distances[vertex])
            vertices.remove(current_vertex)
            if distances[current_vertex] == inf:
                break
            for neighbour, cost in self.neighbours[current_vertex]:
                alternative_route = distances[current_vertex] + cost
                if alternative_route < distances[neighbour]:
                    distances[neighbour] = alternative_route
                    previous_vertices[neighbour] = current_vertex

        path, current_vertex = deque(), dest
        while previous_vertices[current_vertex] is not None:
            path.appendleft(current_vertex)
            current_vertex = previous_vertices[current_vertex]
        if path:
            path.appendleft(current_vertex)
        return path

def createBooleanIntersection(curveA, curveB):
    #curveA is a brep or enclosed polyline
    #curveB is a curve, brep, or enclosed polyline
    points, params_a, params_b = gc.CurveXCurve(gc.JoinCurves(curveA,False),gc.JoinCurves(curveB,False))
    if isinstance(points, list):
        intersections = []
        mydirection = rg.Vector3d(0,0,1)
        brepA = gc.BoundarySurfaces(curveA)
        curves_B = curveB.DuplicateSegments()
        
        for cb in curves_B:
            overlaps = rg.Curve.ProjectToBrep(gc.JoinCurves(cb,False),brepA,mydirection,0.01)
            if len(overlaps)!=0:
                for ol in overlaps:
                    intersections.append(ol)

        return intersections
    else:
        return None

def networkDerivation(QRtagsOri,QRTagOriAttri,QRTagAddAttri,QRtagsAdd,shops,otherSpaces,shopAttri):

    Links = []
    Nodes = []
    allNodes = []
    
    Network = []
    NodeDic = []
    
    QRtags = QRtagsOri + QRtagsAdd
    Spaces = shops + otherSpaces
    QRTagAttri = QRTagOriAttri + QRTagAddAttri
    
    Attri = []
    for i in range(0,int(len(shopAttri)/6)):
        if shopAttri[6*i+1] == '':
            Attri.append('Shop_L'+str(level)+'_'+str(i))
        else:
            Attri.append(shopAttri[6*i+1])
    print len(Attri)
    print len(shops)
    print Attri
    print len(QRtags)
    print len(QRTagAttri)
    
    for i in range(0,len(otherSpaces)):
        Attri.append('Corridor_L'+str(level)+'_'+str(i))
        """
        for j in range(0,len(QRtags)):
            if str(otherSpaces[i].Contains(QRtags[j])) == 'Inside':
                if QRTagAttri[5*j+1]:
                    print QRTagAttri[5*j+1], '---', i, '----------', j
                    Attri.append(QRTagAttri[5*j+1])
                    
                else:
                    Attri.append('Corridor_L'+str(level)+'_'+str(i))
                    print 'i=', i
                    """
    #for i in range(len(QRtagsOri), len(otherSpaces)):

    print len(otherSpaces)
    print len(Attri)-57
    
    print Attri
    
    
    flag2QRtags = [0]*len(QRtags)
    for i in range(0,len(Spaces)):
        flag = 0
        for j in range(0,len(QRtags)):
            if str(Spaces[i].Contains(QRtags[j])) == 'Inside':
                Nodes.append(QRtags[j])

                if j < int(len(QRTagAttri)/5):
                    if QRTagAttri[5*j+1]:
                        NodeDic.append(QRTagAttri[5*j+1])
                    else:
                        NodeDic.append(Attri[i])
                    NodeDic.append(QRtags[j])
                
                else:
                    NodeDic.append(Attri[i])
                    NodeDic.append(QRtags[j])
                
                flag2QRtags[j] = 1
                flag = 1
                break
        if flag == 0:
            area, centroid = gc.Area(Spaces[i])
            Nodes.append(centroid)
            
            NodeDic.append(Attri[i])
            NodeDic.append(centroid)

    for i in range(0,len(Spaces)):
        for j in range(i+1,len(Spaces)):
            inter = createBooleanIntersection(Spaces[i], Spaces[j])
            if inter != None and len(inter)!=0:
                Links.append(gc.Line(Nodes[i],Nodes[j]))
                distance_ij = gc.Distance(Nodes[i],Nodes[j])
                edge_ij = make_edge(Attri[i], Attri[j], distance_ij)
                edge_ji = make_edge(Attri[j], Attri[i], distance_ij)
                Network.append(edge_ij)
                Network.append(edge_ji)
                    
    
    return Links, Nodes, Network, NodeDic

def createAttri_NodeDic(shops, otherSpaces, QRtagsOri, QRTagOriAttri, QRtagsAdd, QRTagAddAttri, walls):
    
    QRtags = QRtagsOri + QRtagsAdd
    Spaces = shops + otherSpaces

    QRTagAttri = QRTagOriAttri + QRTagAddAttri
    
    NodeDic = []
    Nodes = []
    Attri = []

    for i in range(0,len(shops)):
        if shopAttri[6*i+1]:
            Attri.append(shopAttri[6*i+1])
            
            area, centroid = gc.Area(shops[i])
            NodeDic.append(shopAttri[6*i+1])
            NodeDic.append(centroid)
            Nodes.append(centroid)
            
        else:
            Attri.append('Shop_L'+str(level)+'_'+str(i))
            
            area, centroid = gc.Area(shops[i])
            NodeDic.append('Shop_L'+str(level)+'_'+str(i))
            NodeDic.append(centroid)
            Nodes.append(centroid)
    
    for i in range(0,len(otherSpaces)):
        flag_Inside =0
        for j in range(0,len(QRtags)):
            if str(otherSpaces[i].Contains(QRtags[j])) == 'Inside':
                flag_Inside =1
                Nodes.append(QRtags[j])
                
                if QRTagAttri[5*j+1]:
                    Attri.append(QRTagAttri[5*j+1])
                    
                    NodeDic.append(QRTagAttri[5*j+1])
                    NodeDic.append(QRtags[j])
                    
                    break
                else:
                    Attri.append('Corridor_L'+str(level)+'_'+str(i))
                    
                    NodeDic.append('Corridor_L'+str(level)+'_'+str(i))
                    NodeDic.append(QRtags[j])
                    
                    break
        if flag_Inside == 0:
            
            Attri.append('Corridor_L'+str(level)+'_'+str(i))
            
            area, centroid = gc.Area(otherSpaces[i])
            NodeDic.append('Corridor_L'+str(level)+'_'+str(i))
            NodeDic.append(centroid)
            Nodes.append(centroid)
    
    # Network derivation
    
    def removeEdge(myEdge):
        allP = []
        for p in range(0,len(walls)):
            points, params_a, params_b = gc.CurveXCurve(myEdge,walls[p])
            if points != None:
                allP.append(points)
                break
        if len(allP)==0:
            return False
        else:
            return True
    
    Links = []
    Network = []

    myNodeDict = {}
    for i in range (0,int(len(NodeDic)/2)):
        myNodeDict[NodeDic[2*i]] = NodeDic[2*i+1]

    for i in range(0,len(Spaces)):
        for j in range(i+1,len(Spaces)):
            inter = createBooleanIntersection(Spaces[i], Spaces[j])
            if inter != None and len(inter)!=0:
                
                isShop_i = 1
                isShop_j = 1
                if 'Corridor_L' in Attri[i] or 'Bench' in Attri[i] or 'ATM' in Attri[i] or 'Escalator' in Attri[i]: 
                    isShop_i = 0
                if 'Corridor_L' in Attri[j] or 'Bench' in Attri[j] or 'ATM' in Attri[j] or 'Escalator' in Attri[i]:
                    isShop_j = 0
                
                if isShop_i == 1 or isShop_j == 1:
                    inter_start = inter[0].PointAtStart
                    inter_end = inter[0].PointAtEnd
                    midPoint = (inter_start+inter_end)/2
                    
                    link_i2midPoint = gc.Line(Nodes[i],midPoint)
                    link_midPoint2j = gc.Line(midPoint,Nodes[j])
                    
                    Links.append(link_i2midPoint)
                    Links.append(link_midPoint2j)
                    
                    distance_i_midPoint = gc.Distance(Nodes[i],midPoint)
                    distance_j_midPoint = gc.Distance(Nodes[j],midPoint)
                    
                    
                    edge_i_midPoint = make_edge(Attri[i], 'Door_'+Attri[i]+'_'+Attri[j], distance_i_midPoint)
                    edge_midPoint_i = make_edge('Door_'+Attri[i]+'_'+Attri[j], Attri[i], distance_i_midPoint)
                    edge_j_midPoint = make_edge(Attri[j], 'Door_'+Attri[i]+'_'+Attri[j], distance_j_midPoint)
                    edge_midPoint_j = make_edge('Door_'+Attri[i]+'_'+Attri[j], Attri[j], distance_j_midPoint)
                    
                    Network.append(edge_i_midPoint)
                    Network.append(edge_midPoint_i)
                    Network.append(edge_j_midPoint)
                    Network.append(edge_midPoint_j)
                    
                    NodeDic.append('Door_'+Attri[i]+'_'+Attri[j])
                    NodeDic.append(midPoint)
                    
                else:
                    myEdge = gc.Line(Nodes[i],Nodes[j])
                    if not removeEdge(myEdge):
                        Links.append(myEdge)
                        distance_ij = gc.Distance(Nodes[i],Nodes[j])
                        edge_ij = make_edge(Attri[i], Attri[j], distance_ij)
                        edge_ji = make_edge(Attri[j], Attri[i], distance_ij)
                        Network.append(edge_ij)
                        Network.append(edge_ji)
                
                
                """
                myEdge = gc.Line(Nodes[i],Nodes[j])
                allP = []
                for p in range(0,len(walls)):
                    points, params_a, params_b = gc.CurveXCurve(myEdge,walls[p])
                    if points != None:
                        allP.append(points)
                        break
                if len(allP)==0:
                    Links.append(gc.Line(Nodes[i],Nodes[j]))
                    
                    distance_ij = gc.Distance(Nodes[i],Nodes[j])
                    
                    edge_ij = make_edge(Attri[i], Attri[j], distance_ij)
                    edge_ji = make_edge(Attri[j], Attri[i], distance_ij)
                    Network.append(edge_ij)
                    Network.append(edge_ji)
                """
    
    return Attri, NodeDic, Nodes, Links, Network
    
if run:
    #Links, Nodes, Network, NodeDic = networkDerivation(QRtagsOri,QRTagOriAttri,QRTagAddAttri,QRtagsAdd,shops,otherSpaces,shopAttri)
    Attri, NodeDic, Nodes, Links, Network = createAttri_NodeDic(shops, otherSpaces, QRtagsOri, QRTagOriAttri, QRtagsAdd, QRTagAddAttri, walls)
# ---------- end python_39 ----------
line_2 = Line(python_39.Links)

c_script_8 = CSharpScript(Curve=[crv_9, move_51.Geometry], Width=Slider(1, range=0..10), Colour="black", Dash=list)  # -> out, A, B; inputs Curve: Curve, Width: Int32, Colour: Color, Dash: String; same code as c_script
rectangle_2 = Rectangle(Plane=qrcodes_2, XSize=dom_12, YSize=dom_11, Radius=0)  # -> Rectangle, Length
brep_5 = Brep(rectangle_2.Rectangle)  # disabled
preview_4 = CustomPreview(Geometry=brep_5, Material="black")
cir_4 = Circle(Plane=qradd_2, Radius=Slider(0.6, range=0..1))  # disabled
c_script_9 = CSharpScript(Curve=rdiff_6, Width=Slider(0, range=0..10), Colour="green", Dash=list_13)  # -> out, A, B; inputs Curve: Curve, Width: Int32, Colour: Color, Dash: String; same code as c_script
brep_6 = Brep(cir_4)
panel_19 = Panel(python_39.NodeDic)
c_script_10 = CSharpScript(Curve=cir_4, Width=Slider(0, range=0..10), Colour="black", Dash=list_16)  # -> out, A, B; inputs Curve: Curve, Width: Int32, Colour: Color, Dash: String; same code as c_script
preview_5 = CustomPreview(Geometry=brep_6, Material="White")
c_script_11 = CSharpScript(Curve=python_39.Links, Width=Slider(0, range=0..10), Colour="blue", Dash=list_27)  # -> out, A, B; inputs Curve: Curve, Width: Int32, Colour: Color, Dash: String; same code as c_script

# ---- group: Navigation Test
# Lobster Tail Seafood Restaurant
toggle_11 = BooleanToggle(False)
panel_20 = Panel("EscalatorB_L5")
python_40 = GhPythonScript(run=toggle_11, Network=python_39.Network, NodeDic=python_39.NodeDic, departure="Nespresso", destination=list_28)  # -> route, NodeDic; inputs run: Boolean, Network: list, NodeDic: list; same code as python_28
python_41 = GhPythonScript(run=Toggle(True), route=python_40.route, NodeDic=python_40.NodeDic)  # -> out, Links; inputs run: Boolean, route: list, NodeDic: list; same code as python_29
X_5 = UnitX(Factor=Slider(0, range=-101..1000))
list_46 = ValueList({"None": "", "Dot": "0.1 1.0", "Dash": "1.0", "DashDot": "1.0 1.0 0.1 1.0"}, selected="None")
len_2 = Length(Curve=python_41.Links)
move_53 = Move(Geometry=python_41.Links, Motion=X_5)  # -> Geometry, Transform
ma_2 = MassAddition(Input=len_2)  # -> Result, PartialResults
c_script_12 = CSharpScript(Curve=move_53.Geometry, Width=Slider(3, range=0..10), Colour="0,0,255", Dash=list_46)  # -> out, A, B; inputs Curve: Curve, Width: Int32, Colour: Color, Dash: String; same code as c_script
panel_23 = Panel(ma_2.Result)
subtraction_3 = Subtraction(A="143", B=ma_2.Result)
panel_24 = Panel(subtraction_3)

# ----
python_42 = GhPythonScript(run=Toggle(False), walls=brep_4, links=line_2)  # -> out, validLines; inputs run: Boolean, walls: list of Brep, links: list of Curve
# ---------- python_42: Python ----------
import ghpythonlib.components as gc

if run:
    validLines = []
    for i in range(0,len(links)):
        allP = []
        for j in range(0,len(walls)):
            points, params_a, params_b = gc.CurveXCurve(links[i],walls[j])
            if points != None:
                allP.append(points)
                break
        if len(allP)==0:
            validLines.append(links[i])
# ---------- end python_42 ----------
c_script_13 = CSharpScript(Curve=python_42.validLines, Width=Slider(3, range=0..10), Colour="blue", Dash=list_32)  # -> out, A, B; inputs Curve: Curve, Width: Int32, Colour: Color, Dash: String; same code as c_script

python_43 = GhPythonScript(deltaZ=Slider(0, range=0..10), x=shp_import_23.geometry)  # -> allV, deltaX, deltaY, myMove; inputs x: list of Brep; same code as python_10
movevector_11 = Vector(python_43.myMove)

python_44 = GhPythonScript(vector1=python_3.myMove, vector2=movevector_11)  # -> out, MoveVector2; inputs vector1: Vector3d, vector2: Vector3d; same code as python_23

move_54 = Move(Geometry=shp_import_23.geometry, Motion=python_44.MoveVector2)  # -> Geometry, Transform
move_55 = Move(Geometry=shp_import_24.geometry, Motion=python_44.MoveVector2)  # -> Geometry, Transform
move_56 = Move(Geometry=shp_import_22.geometry, Motion=python_44.MoveVector2)  # -> Geometry, Transform
move_57 = Move(Geometry=shp_import_21.geometry, Motion=python_44.MoveVector2)  # -> Geometry, Transform
crv_10 = Curve(move_54.Geometry)
python_45 = GhPythonScript(run=Toggle(True), corridor=crv_10, rooms=move_57.Geometry)  # -> out, allinter, allIntermiddlePoints, flatten(QRcodes), flatten(QRcodesAttri); inputs corridor: Brep, rooms: list of Brep; same code as python_24
python_46 = GhPythonScript(run=Toggle(True), corridor=crv_10)  # -> out, c_QRAddRemoveDup, c_points_inside, c_points_outside, obstaclesAdd, Atriums; inputs run: Boolean, corridor: list of Brep; same code as python_25
pt_8 = Point(python_46.c_points_inside)
pt_9 = Point(python_46.obstaclesAdd)
qrcodes_3 = Point([python_45.QRcodes, move_56.Geometry])
qrcodesattri_3 = Text([python_45.QRcodesAttri, shp_import_22.records])
pt_10 = Point([pt_8, pt_9])
python_47 = GhPythonScript(QRcodes=qrcodes_3, potentialQRAdd=pt_10, R=Slider(2.5, range=0..10))  # -> out, QRcodesAdd, QRcodesAddAttri; inputs QRcodes: list of Point3d, potentialQRAdd: list of Point3d; same code as python_26
qradd_3 = Point(python_47.QRcodesAdd)
voronoi_7 = Voronoi(Points=flatten([qrcodes_3, qradd_3]), BruteForceOverride=False)
rint_7 = RegionIntersection(CurvesA=voronoi_7, CurvesB=move_55.Geometry)
rdiff_7 = RegionDifference(CurvesA=rint_7, CurvesB=python_46.Atriums)
python_48 = GhPythonScript(
    run=Toggle(True),
    shops=move_57.Geometry,
    shopAttri=shp_import_21.records,
    otherSpaces=rdiff_7,
    QRtagsOri=qrcodes_3,
    QRTagOriAttri=qrcodesattri_3,
    QRtagsAdd=qradd_3,
    QRTagAddAttri=python_47.QRcodesAddAttri,
    level=Slider(1, range=1..6))  # -> Network, NodeDic, Nodes, Links, Attri; inputs run: Boolean, shops: list of Curve, shopAttri: list, otherSpaces: list of Curve, QRtagsOri: list of Point3d, QRTagOriAttri: list, QRtagsAdd: list of Point3d, QRTagAddAttri: list, level: Int32; same code as python_27
line_3 = Line(python_48.Links)

rectangle_3 = Rectangle(Plane=qrcodes_3, XSize=dom_2, YSize=dom, Radius=0)  # -> Rectangle, Length
c_script_14 = CSharpScript(Curve=[move_57.Geometry, crv_10], Width=number_slider_15, Colour="black", Dash=list_3)  # -> out, A, B; inputs Curve: Curve, Width: Int32, Colour: Color, Dash: String; same code as c_script
brep_7 = Brep(rectangle_3.Rectangle)  # disabled
cir_5 = Circle(Plane=qrcodes_3, Radius=Slider(3, range=0..10))  # disabled
preview_6 = CustomPreview(Geometry=brep_7, Material="black")
cir_6 = Circle(Plane=qradd_3, Radius=Slider(0.6, range=0..1))  # disabled
brep_8 = Brep(cir_6)
c_script_15 = CSharpScript(Curve=cir_6, Width=Slider(1, range=0..10), Colour="black", Dash=list_7)  # -> out, A, B; inputs Curve: Curve, Width: Int32, Colour: Color, Dash: String; same code as c_script
preview_7 = CustomPreview(Geometry=brep_8, Material="White")
c_script_16 = CSharpScript(Curve=python_48.Links, Width=Slider(0, range=0..10), Colour="blue", Dash=list_18)  # -> out, A, B; inputs Curve: Curve, Width: Int32, Colour: Color, Dash: String; same code as c_script
c_script_17 = CSharpScript(Curve=rdiff_7, Width=Slider(0, range=0..10), Colour="green", Dash=list_23)  # -> out, A, B; inputs Curve: Curve, Width: Int32, Colour: Color, Dash: String; same code as c_script

# ---- group: Navigation Test
python_49 = GhPythonScript(run=Toggle(False), Network=python_48.Network, NodeDic=python_48.NodeDic, departure="Fone King", destination=list_29)  # -> route, NodeDic; inputs run: Boolean, Network: list, NodeDic: list; same code as python_28
python_50 = GhPythonScript(run=Toggle(True), route=python_49.route, NodeDic=python_49.NodeDic)  # -> out, Links; inputs run: Boolean, route: list, NodeDic: list; same code as python_29
X_6 = UnitX(Factor=Slider(0, range=-101..1000))
list_47 = ValueList({"None": "", "Dot": "0.1 1.0", "Dash": "1.0", "DashDot": "1.0 1.0 0.1 1.0"}, selected="None")
move_58 = Move(Geometry=python_50.Links, Motion=X_6)  # -> Geometry, Transform
c_script_18 = CSharpScript(Curve=move_58.Geometry, Width=Slider(3, range=0..10), Colour="0,0,255", Dash=list_47)  # -> out, A, B; inputs Curve: Curve, Width: Int32, Colour: Color, Dash: String; same code as c_script

# ----
len_3 = Length(Curve=python_50.Links)
ma_3 = MassAddition(Input=len_3)  # -> Result, PartialResults
subtraction_4 = Subtraction(A="150", B=ma_3.Result)
subtraction_5 = Subtraction(A=subtraction_4, B=list_33)
panel_25 = Panel(ma_3.Result)
panel_26 = Panel(subtraction_5)

python_51 = GhPythonScript(deltaZ=Slider(0, range=0..10), x=shp_import_27.geometry)  # -> allV, deltaX, deltaY, myMove; inputs x: list of Brep; same code as python_10
movevector_12 = Vector(python_51.myMove)

python_52 = GhPythonScript(vector1=python_2.myMove, vector2=movevector_12)  # -> out, MoveVector2; inputs vector1: Vector3d, vector2: Vector3d; same code as python_23

move_59 = Move(Geometry=shp_import_27.geometry, Motion=python_52.MoveVector2)  # -> Geometry, Transform
move_60 = Move(Geometry=shp_import_28.geometry, Motion=python_52.MoveVector2)  # -> Geometry, Transform
move_61 = Move(Geometry=shp_import_26.geometry, Motion=python_52.MoveVector2)  # -> Geometry, Transform
move_62 = Move(Geometry=shp_import_25.geometry, Motion=python_52.MoveVector2)  # -> Geometry, Transform
crv_11 = Curve(move_59.Geometry)
python_53 = GhPythonScript(run=Toggle(True), corridor=crv_11, rooms=move_62.Geometry)  # -> out, allinter, allIntermiddlePoints, flatten(QRcodes), flatten(QRcodesAttri); inputs corridor: Brep, rooms: list of Brep; same code as python_24
python_54 = GhPythonScript(run=Toggle(True), corridor=crv_11)  # -> out, c_QRAddRemoveDup, c_points_inside, c_points_outside, obstaclesAdd, Atriums; inputs run: Boolean, corridor: list of Brep; same code as python_25
pt_11 = Point(python_54.c_points_inside)
pt_12 = Point(python_54.obstaclesAdd)
qrcodes_4 = Point([python_53.QRcodes, move_61.Geometry])
qrcodesattri_4 = Text([python_53.QRcodesAttri, shp_import_26.records])
pt_13 = Point([pt_11, pt_12])
python_55 = GhPythonScript(QRcodes=qrcodes_4, potentialQRAdd=pt_13, R=Slider(2, range=0..10))  # -> out, QRcodesAdd, QRcodesAddAttri; inputs QRcodes: list of Point3d, potentialQRAdd: list of Point3d; same code as python_26
qradd_4 = Point(python_55.QRcodesAdd)
voronoi_8 = Voronoi(Points=flatten([qrcodes_4, qradd_4]), BruteForceOverride=False)
rint_8 = RegionIntersection(CurvesA=voronoi_8, CurvesB=move_60.Geometry)
rdiff_8 = RegionDifference(CurvesA=rint_8, CurvesB=python_54.Atriums)
python_56 = GhPythonScript(
    run=Toggle(True),
    shops=move_62.Geometry,
    shopAttri=shp_import_25.records,
    otherSpaces=rdiff_8,
    QRtagsOri=qrcodes_4,
    QRTagOriAttri=qrcodesattri_4,
    QRtagsAdd=qradd_4,
    QRTagAddAttri=python_55.QRcodesAddAttri,
    level=Slider(4, range=1..6))  # -> Network, NodeDic, Nodes, Links, Attri; inputs run: Boolean, shops: list of Curve, shopAttri: list, otherSpaces: list of Curve, QRtagsOri: list of Point3d, QRTagOriAttri: list, QRtagsAdd: list of Point3d, QRTagAddAttri: list, level: Int32; same code as python_27
line_4 = Line(python_56.Links)

rectangle_4 = Rectangle(Plane=qrcodes_4, XSize=dom_4, YSize=dom_3, Radius=0)  # -> Rectangle, Length; disabled
c_script_19 = CSharpScript(Curve=[move_62.Geometry, crv_11], Width=Slider(1, range=0..10), Colour="black", Dash=list_4)  # -> out, A, B; inputs Curve: Curve, Width: Int32, Colour: Color, Dash: String; same code as c_script
brep_9 = Brep(rectangle_4.Rectangle)
preview_8 = CustomPreview(Geometry=brep_9, Material="black")
cir_7 = Circle(Plane=qradd_4, Radius=Slider(0.6, range=0..1))  # disabled
brep_10 = Brep(cir_7)  # disabled
c_script_20 = CSharpScript(Curve=cir_7, Width=Slider(1, range=0..10), Colour="black", Dash=list_8)  # -> out, A, B; inputs Curve: Curve, Width: Int32, Colour: Color, Dash: String; same code as c_script
preview_9 = CustomPreview(Geometry=brep_10, Material="White")
c_script_21 = CSharpScript(Curve=rdiff_8, Width=Slider(0, range=0..10), Colour="green", Dash=list_10)  # -> out, A, B; inputs Curve: Curve, Width: Int32, Colour: Color, Dash: String; same code as c_script

# ---- group: Navigation Test
python_57 = GhPythonScript(run=Toggle(False), Network=python_56.Network, NodeDic=python_56.NodeDic, departure="EscalatorA_L4", destination=panel)  # -> route, NodeDic; inputs run: Boolean, Network: list, NodeDic: list; same code as python_28
python_58 = GhPythonScript(run=Toggle(True), route=python_57.route, NodeDic=python_57.NodeDic)  # -> out, Links; inputs run: Boolean, route: list, NodeDic: list; same code as python_29
X_7 = UnitX(Factor=Slider(0, range=-101..1000))
list_48 = ValueList({"None": "", "Dot": "0.1 1.0", "Dash": "1.0", "DashDot": "1.0 1.0 0.1 1.0"}, selected="None")
move_63 = Move(Geometry=python_58.Links, Motion=X_7)  # -> Geometry, Transform
c_script_22 = CSharpScript(Curve=move_63.Geometry, Width=Slider(3, range=0..10), Colour="0,0,255", Dash=list_48)  # -> out, A, B; inputs Curve: Curve, Width: Int32, Colour: Color, Dash: String; same code as c_script

# ----
c_script_23 = CSharpScript(Curve=python_56.Links, Width=Slider(0, range=0..10), Colour="blue", Dash=list_19)  # -> out, A, B; inputs Curve: Curve, Width: Int32, Colour: Color, Dash: String; same code as c_script

python_59 = GhPythonScript(deltaZ=Slider(0, range=0..10), x=shp_import_41.geometry)  # -> allV, deltaX, deltaY, myMove; inputs x: list of Brep; same code as python_10
movevector_13 = Vector(python_59.myMove)

python_60 = GhPythonScript(vector1=python_5.myMove, vector2=movevector_13)  # -> out, MoveVector2; inputs vector1: Vector3d, vector2: Vector3d; same code as python_23

move_64 = Move(Geometry=shp_import_41.geometry, Motion=python_60.MoveVector2)  # -> Geometry, Transform
move_65 = Move(Geometry=shp_import_42.geometry, Motion=python_60.MoveVector2)  # -> Geometry, Transform
move_66 = Move(Geometry=shp_import_40.geometry, Motion=python_60.MoveVector2)  # -> Geometry, Transform
move_67 = Move(Geometry=shp_import_39.geometry, Motion=python_60.MoveVector2)  # -> Geometry, Transform
crv_12 = Curve(move_64.Geometry)
python_61 = GhPythonScript(run=Toggle(True), corridor=crv_12, rooms=move_67.Geometry)  # -> out, allinter, allIntermiddlePoints, flatten(QRcodes), flatten(QRcodesAttri); inputs corridor: Brep, rooms: list of Brep; same code as python_24
python_62 = GhPythonScript(run=Toggle(True), corridor=crv_12)  # -> out, c_QRAddRemoveDup, c_points_inside, c_points_outside, obstaclesAdd, Atriums; inputs run: Boolean, corridor: list of Brep; same code as python_25
pt_14 = Point(python_62.c_points_inside)
pt_15 = Point(python_62.obstaclesAdd)
qrcodes_5 = Point([python_61.QRcodes, move_66.Geometry])
qrcodesattri_5 = Text([python_61.QRcodesAttri, shp_import_40.records])
pt_16 = Point([pt_14, pt_15])
python_63 = GhPythonScript(QRcodes=qrcodes_5, potentialQRAdd=pt_16, R=Slider(2.5, range=0..10))  # -> out, QRcodesAdd, QRcodesAddAttri; inputs QRcodes: list of Point3d, potentialQRAdd: list of Point3d; same code as python_26
qradd_5 = Point(python_63.QRcodesAdd)
voronoi_9 = Voronoi(Points=flatten([qrcodes_5, qradd_5]), BruteForceOverride=False)
rint_9 = RegionIntersection(CurvesA=voronoi_9, CurvesB=move_65.Geometry)
rdiff_9 = RegionDifference(CurvesA=rint_9, CurvesB=python_62.Atriums)
python_64 = GhPythonScript(
    run=Toggle(True),
    shops=move_67.Geometry,
    shopAttri=shp_import_39.records,
    otherSpaces=rdiff_9,
    QRtagsOri=qrcodes_5,
    QRTagOriAttri=qrcodesattri_5,
    QRtagsAdd=qradd_5,
    QRTagAddAttri=python_63.QRcodesAddAttri,
    level=Slider(3, range=1..6))  # -> Network, NodeDic, Nodes, Links, Attri; inputs run: Boolean, shops: list of Curve, shopAttri: list, otherSpaces: list of Curve, QRtagsOri: list of Point3d, QRTagOriAttri: list, QRtagsAdd: list of Point3d, QRTagAddAttri: list, level: Int32; same code as python_27
line_5 = Line(python_64.Links)

rectangle_5 = Rectangle(Plane=qrcodes_5, XSize=dom_8, YSize=dom_7, Radius=0)  # -> Rectangle, Length
c_script_24 = CSharpScript(Curve=[move_67.Geometry, crv_12], Width=number_slider_15, Colour="black", Dash=list_2)  # -> out, A, B; inputs Curve: Curve, Width: Int32, Colour: Color, Dash: String; same code as c_script
brep_11 = Brep(rectangle_5.Rectangle)  # disabled
cir_8 = Circle(Plane=qrcodes_5, Radius=Slider(3, range=0..10))  # disabled
preview_10 = CustomPreview(Geometry=brep_11, Material="black")
cir_9 = Circle(Plane=qradd_5, Radius=Slider(0.6, range=0..1))  # disabled
brep_12 = Brep(cir_9)
c_script_25 = CSharpScript(Curve=cir_9, Width=Slider(1, range=0..10), Colour="black", Dash=list_12)  # -> out, A, B; inputs Curve: Curve, Width: Int32, Colour: Color, Dash: String; same code as c_script
preview_11 = CustomPreview(Geometry=brep_12, Material="White")
c_script_26 = CSharpScript(Curve=rdiff_9, Width=Slider(0, range=0..10), Colour="green", Dash=list_14)  # -> out, A, B; inputs Curve: Curve, Width: Int32, Colour: Color, Dash: String; same code as c_script

# ---- group: Navigation Test
python_65 = GhPythonScript(
    run=Toggle(False),
    Network=python_64.Network,
    NodeDic=python_64.NodeDic,
    departure="LiftC_L3",
    destination="EscalatorD_L3")  # -> route, NodeDic; inputs run: Boolean, Network: list, NodeDic: list; same code as python_28
python_66 = GhPythonScript(run=Toggle(True), route=python_65.route, NodeDic=python_65.NodeDic)  # -> out, Links; inputs run: Boolean, route: list, NodeDic: list; same code as python_29
X_8 = UnitX(Factor=Slider(0, range=-101..1000))
list_49 = ValueList({"None": "", "Dot": "0.1 1.0", "Dash": "1.0", "DashDot": "1.0 1.0 0.1 1.0"}, selected="None")
move_68 = Move(Geometry=python_66.Links, Motion=X_8)  # -> Geometry, Transform
c_script_27 = CSharpScript(Curve=move_68.Geometry, Width=Slider(3, range=0..10), Colour="0,0,255", Dash=list_49)  # -> out, A, B; inputs Curve: Curve, Width: Int32, Colour: Color, Dash: String; same code as c_script

# ----
c_script_28 = CSharpScript(Curve=python_64.Links, Width=Slider(0, range=0..10), Colour="blue", Dash=list_22)  # -> out, A, B; inputs Curve: Curve, Width: Int32, Colour: Color, Dash: String; same code as c_script
len_4 = Length(Curve=python_66.Links)
ma_4 = MassAddition(Input=len_4)  # -> Result, PartialResults

python_67 = GhPythonScript(deltaZ=Slider(0, range=0..10), x=shp_import_45.geometry)  # -> allV, deltaX, deltaY, myMove; inputs x: list of Brep; same code as python_10
movevector_14 = Vector(python_67.myMove)

python_68 = GhPythonScript(vector1=python_8.myMove, vector2=movevector_14)  # -> out, MoveVector2; inputs vector1: Vector3d, vector2: Vector3d; same code as python_23

move_69 = Move(Geometry=shp_import_45.geometry, Motion=python_68.MoveVector2)  # -> Geometry, Transform
move_70 = Move(Geometry=shp_import_46.geometry, Motion=python_68.MoveVector2)  # -> Geometry, Transform
move_71 = Move(Geometry=shp_import_44.geometry, Motion=python_68.MoveVector2)  # -> Geometry, Transform
move_72 = Move(Geometry=shp_import_43.geometry, Motion=python_68.MoveVector2)  # -> Geometry, Transform
crv_13 = Curve(move_69.Geometry)
python_69 = GhPythonScript(run=Toggle(True), corridor=crv_13, rooms=move_72.Geometry)  # -> out, allinter, allIntermiddlePoints, flatten(QRcodes), flatten(QRcodesAttri); inputs corridor: Brep, rooms: list of Brep; same code as python_24
python_70 = GhPythonScript(run=Toggle(True), corridor=crv_13)  # -> out, c_QRAddRemoveDup, c_points_inside, c_points_outside, obstaclesAdd, Atriums; inputs run: Boolean, corridor: list of Brep; same code as python_25
pt_17 = Point(python_70.c_points_inside)
pt_18 = Point(python_70.obstaclesAdd)
qrcodes_6 = Point([python_69.QRcodes, move_71.Geometry])
qrcodesattri_6 = Text([python_69.QRcodesAttri, shp_import_44.records])
pt_19 = Point([pt_17, pt_18])
python_71 = GhPythonScript(QRcodes=qrcodes_6, potentialQRAdd=pt_19, R=Slider(2.5, range=0..10))  # -> out, QRcodesAdd, QRcodesAddAttri; inputs QRcodes: list of Point3d, potentialQRAdd: list of Point3d; same code as python_26
qradd_6 = Point(python_71.QRcodesAdd)
voronoi_10 = Voronoi(Points=flatten([qrcodes_6, qradd_6]), BruteForceOverride=False)
rint_10 = RegionIntersection(CurvesA=voronoi_10, CurvesB=move_70.Geometry)
rdiff_10 = RegionDifference(CurvesA=rint_10, CurvesB=python_70.Atriums)
python_72 = GhPythonScript(
    run=Toggle(True),
    shops=move_72.Geometry,
    shopAttri=shp_import_43.records,
    otherSpaces=rdiff_10,
    QRtagsOri=qrcodes_6,
    QRTagOriAttri=qrcodesattri_6,
    QRtagsAdd=qradd_6,
    QRTagAddAttri=python_71.QRcodesAddAttri,
    level=Slider(6, range=1..6))  # -> Network, NodeDic, Nodes, Links, Attri; inputs run: Boolean, shops: list of Curve, shopAttri: list, otherSpaces: list of Curve, QRtagsOri: list of Point3d, QRTagOriAttri: list, QRtagsAdd: list of Point3d, QRTagAddAttri: list, level: Int32
# ---------- python_72: Python ----------
from collections import deque, namedtuple
import Rhino.Geometry as rg
import ghpythonlib.components as gc
import re

# we'll use infinity as a default distance to nodes.
inf = float('inf')
Edge = namedtuple('Edge', 'start, end, cost')


def make_edge(start, end, cost=1):
  return Edge(start, end, cost)


class Graph:
    def __init__(self, edges):
        # let's check that the data is right
        wrong_edges = [i for i in edges if len(i) not in [2, 3]]
        if wrong_edges:
            raise ValueError('Wrong edges data: {}'.format(wrong_edges))

        self.edges = [make_edge(*edge) for edge in edges]
        
    @property
    def vertices(self):
        return set(
            sum(
                ([edge.start, edge.end] for edge in self.edges), []
            )
        )

    def get_node_pairs(self, n1, n2, both_ends=True):
        if both_ends:
            node_pairs = [[n1, n2], [n2, n1]]
        else:
            node_pairs = [[n1, n2]]
        return node_pairs

    def remove_edge(self, n1, n2, both_ends=True):
        node_pairs = self.get_node_pairs(n1, n2, both_ends)
        edges = self.edges[:]
        for edge in edges:
            if [edge.start, edge.end] in node_pairs:
                self.edges.remove(edge)

    def add_edge(self, n1, n2, cost=1, both_ends=True):
        node_pairs = self.get_node_pairs(n1, n2, both_ends)
        for edge in self.edges:
            if [edge.start, edge.end] in node_pairs:
                return ValueError('Edge {} {} already exists'.format(n1, n2))

        self.edges.append(Edge(start=n1, end=n2, cost=cost))
        if both_ends:
            self.edges.append(Edge(start=n2, end=n1, cost=cost))

    @property
    def neighbours(self):
        neighbours = {vertex: set() for vertex in self.vertices}
        for edge in self.edges:
            neighbours[edge.start].add((edge.end, edge.cost))

        return neighbours

    def dijkstra(self, source, dest):
        assert source in self.vertices, 'Such source node doesn\'t exist'
        distances = {vertex: inf for vertex in self.vertices}
        previous_vertices = {
            vertex: None for vertex in self.vertices
        }
        distances[source] = 0
        vertices = self.vertices.copy()

        while vertices:
            current_vertex = min(
                vertices, key=lambda vertex: distances[vertex])
            vertices.remove(current_vertex)
            if distances[current_vertex] == inf:
                break
            for neighbour, cost in self.neighbours[current_vertex]:
                alternative_route = distances[current_vertex] + cost
                if alternative_route < distances[neighbour]:
                    distances[neighbour] = alternative_route
                    previous_vertices[neighbour] = current_vertex

        path, current_vertex = deque(), dest
        while previous_vertices[current_vertex] is not None:
            path.appendleft(current_vertex)
            current_vertex = previous_vertices[current_vertex]
        if path:
            path.appendleft(current_vertex)
        return path

def createBooleanIntersection(curveA, curveB):
    #curveA is a brep or enclosed polyline
    #curveB is a curve, brep, or enclosed polyline
    points, params_a, params_b = gc.CurveXCurve(gc.JoinCurves(curveA,False),gc.JoinCurves(curveB,False))
    if isinstance(points, list):
        intersections = []
        mydirection = rg.Vector3d(0,0,1)
        brepA = gc.BoundarySurfaces(curveA)
        curves_B = curveB.DuplicateSegments()
        
        for cb in curves_B:
            overlaps = rg.Curve.ProjectToBrep(gc.JoinCurves(cb,False),brepA,mydirection,0.01)
            if len(overlaps)!=0:
                for ol in overlaps:
                    intersections.append(ol)

        return intersections
    else:
        return None

def networkDerivation(QRtagsOri,QRTagOriAttri,QRTagAddAttri,QRtagsAdd,shops,otherSpaces,shopAttri):

    Links = []
    Nodes = []
    allNodes = []
    
    Network = []
    NodeDic = []
    
    QRtags = QRtagsOri + QRtagsAdd
    Spaces = shops + otherSpaces
    QRTagAttri = QRTagOriAttri + QRTagAddAttri
    
    Attri = []
    for i in range(0,int(len(shopAttri)/6)):
        if shopAttri[6*i+1] == '':
            Attri.append('Shop_L'+str(level)+'_'+str(i))
        else:
            Attri.append(shopAttri[6*i+1])
    print len(Attri)
    print len(shops)
    print Attri
    print len(QRtags)
    print len(QRTagAttri)
    
    for i in range(0,len(otherSpaces)):
        Attri.append('Corridor_L'+str(level)+'_'+str(i))
        """
        for j in range(0,len(QRtags)):
            if str(otherSpaces[i].Contains(QRtags[j])) == 'Inside':
                if QRTagAttri[5*j+1]:
                    print QRTagAttri[5*j+1], '---', i, '----------', j
                    Attri.append(QRTagAttri[5*j+1])
                    
                else:
                    Attri.append('Corridor_L'+str(level)+'_'+str(i))
                    print 'i=', i
                    """
    #for i in range(len(QRtagsOri), len(otherSpaces)):

    print len(otherSpaces)
    print len(Attri)-57
    
    print Attri
    
    
    flag2QRtags = [0]*len(QRtags)
    for i in range(0,len(Spaces)):
        flag = 0
        for j in range(0,len(QRtags)):
            if str(Spaces[i].Contains(QRtags[j])) == 'Inside':
                Nodes.append(QRtags[j])

                if j < int(len(QRTagAttri)/5):
                    if QRTagAttri[5*j+1]:
                        NodeDic.append(QRTagAttri[5*j+1])
                    else:
                        NodeDic.append(Attri[i])
                    NodeDic.append(QRtags[j])
                
                else:
                    NodeDic.append(Attri[i])
                    NodeDic.append(QRtags[j])
                
                flag2QRtags[j] = 1
                flag = 1
                break
        if flag == 0:
            area, centroid = gc.Area(Spaces[i])
            Nodes.append(centroid)
            
            NodeDic.append(Attri[i])
            NodeDic.append(centroid)

    for i in range(0,len(Spaces)):
        for j in range(i+1,len(Spaces)):
            inter = createBooleanIntersection(Spaces[i], Spaces[j])
            if inter != None and len(inter)!=0:
                Links.append(gc.Line(Nodes[i],Nodes[j]))
                distance_ij = gc.Distance(Nodes[i],Nodes[j])
                edge_ij = make_edge(Attri[i], Attri[j], distance_ij)
                edge_ji = make_edge(Attri[j], Attri[i], distance_ij)
                Network.append(edge_ij)
                Network.append(edge_ji)
                    
    
    return Links, Nodes, Network, NodeDic

def createAttri_NodeDic(shops, otherSpaces, QRtagsOri, QRTagOriAttri, QRtagsAdd, QRTagAddAttri):
    
    QRtags = QRtagsOri + QRtagsAdd
    Spaces = shops + otherSpaces

    QRTagAttri = QRTagOriAttri + QRTagAddAttri
    
    NodeDic = []
    Nodes = []
    Attri = []

    for i in range(0,len(shops)):
        if shopAttri[6*i+1]:
            Attri.append(shopAttri[6*i+1])
            
            area, centroid = gc.Area(shops[i])
            NodeDic.append(shopAttri[6*i+1])
            NodeDic.append(centroid)
            Nodes.append(centroid)
            
        else:
            Attri.append('Shop_L'+str(level)+'_'+str(i))
            
            area, centroid = gc.Area(shops[i])
            NodeDic.append('Shop_L'+str(level)+'_'+str(i))
            NodeDic.append(centroid)
            Nodes.append(centroid)
    
    for i in range(0,len(otherSpaces)):
        flag_Inside =0
        for j in range(0,len(QRtags)):
            if str(otherSpaces[i].Contains(QRtags[j])) == 'Inside':
                flag_Inside =1
                Nodes.append(QRtags[j])
                
                if QRTagAttri[5*j+1]:
                    print QRTagAttri[5*j+1]
                    Attri.append(QRTagAttri[5*j+1])
                    
                    NodeDic.append(QRTagAttri[5*j+1])
                    NodeDic.append(QRtags[j])
                    
                    break
                else:
                    Attri.append('Corridor_L'+str(level)+'_'+str(i))
                    
                    NodeDic.append('Corridor_L'+str(level)+'_'+str(i))
                    NodeDic.append(QRtags[j])
                    
                    break
        if flag_Inside == 0:
            
            Attri.append('Corridor_L'+str(level)+'_'+str(i))
            
            area, centroid = gc.Area(otherSpaces[i])
            NodeDic.append('Corridor_L'+str(level)+'_'+str(i))
            NodeDic.append(centroid)
            Nodes.append(centroid)
    
    # Network derivation
    Links = []
    Network = []

    myNodeDict = {}
    for i in range (0,int(len(NodeDic)/2)):
        myNodeDict[NodeDic[2*i]] = NodeDic[2*i+1]

    for i in range(0,len(Spaces)):
        for j in range(i+1,len(Spaces)):
            inter = createBooleanIntersection(Spaces[i], Spaces[j])
            if inter != None and len(inter)!=0:
                Links.append(gc.Line(Nodes[i],Nodes[j]))
                
                myEdge = gc.Line(Nodes[i],Nodes[j])
                #for k in range(0,len(Spaces)):
                    #points, params_a, params_b = gc.CurveXCurve(myEdge,Spaces[k])
                #if points == None:
                distance_ij = gc.Distance(Nodes[i],Nodes[j])
                edge_ij = make_edge(Attri[i], Attri[j], distance_ij)
                edge_ji = make_edge(Attri[j], Attri[i], distance_ij)
                Network.append(edge_ij)
                Network.append(edge_ji)
    
    
    return Attri, NodeDic, Nodes, Links, Network
    
if run:
    #Links, Nodes, Network, NodeDic = networkDerivation(QRtagsOri,QRTagOriAttri,QRTagAddAttri,QRtagsAdd,shops,otherSpaces,shopAttri)
    Attri, NodeDic, Nodes, Links, Network = createAttri_NodeDic(shops, otherSpaces, QRtagsOri, QRTagOriAttri, QRtagsAdd, QRTagAddAttri)
# ---------- end python_72 ----------
line_6 = Line(python_72.Links)

rectangle_6 = Rectangle(Plane=qrcodes_6, XSize=dom_10, YSize=dom_9, Radius=0)  # -> Rectangle, Length; disabled
c_script_29 = CSharpScript(Curve=[move_72.Geometry, crv_13], Width=Slider(1, range=0..10), Colour="black", Dash=list_6)  # -> out, A, B; inputs Curve: Curve, Width: Int32, Colour: Color, Dash: String; same code as c_script
brep_13 = Brep(rectangle_6.Rectangle)
preview_12 = CustomPreview(Geometry=brep_13, Material="black")
cir_10 = Circle(Plane=qradd_6, Radius=Slider(0.6, range=0..1))  # disabled
brep_14 = Brep(cir_10)
c_script_30 = CSharpScript(Curve=cir_10, Width=Slider(1, range=0..10), Colour="black", Dash=list_15)  # -> out, A, B; inputs Curve: Curve, Width: Int32, Colour: Color, Dash: String; same code as c_script
preview_13 = CustomPreview(Geometry=brep_14, Material="White")
c_script_31 = CSharpScript(Curve=rdiff_10, Width=Slider(0, range=0..10), Colour="green", Dash=list_17)  # -> out, A, B; inputs Curve: Curve, Width: Int32, Colour: Color, Dash: String; same code as c_script
panel_29 = Panel(python_72.Network)

# ---- group: Navigation Test
panel_30 = Panel("BenchB L6")
python_73 = GhPythonScript(
    run=Toggle(False),
    Network=python_72.Network,
    NodeDic=python_72.NodeDic,
    departure="LiftB_L6",
    destination="Fitness First")  # -> route, NodeDic; inputs run: Boolean, Network: list, NodeDic: list; same code as python_28
python_74 = GhPythonScript(run=Toggle(True), route=python_73.route, NodeDic=python_73.NodeDic)  # -> out, Links; inputs run: Boolean, route: list, NodeDic: list; same code as python_29
X_9 = UnitX(Factor=Slider(0, range=-101..1000))
list_50 = ValueList({"None": "", "Dot": "0.1 1.0", "Dash": "1.0", "DashDot": "1.0 1.0 0.1 1.0"}, selected="None")
move_73 = Move(Geometry=python_74.Links, Motion=X_9)  # -> Geometry, Transform
c_script_32 = CSharpScript(Curve=move_73.Geometry, Width=Slider(3, range=0..10), Colour="0,0,255", Dash=list_50)  # -> out, A, B; inputs Curve: Curve, Width: Int32, Colour: Color, Dash: String; same code as c_script

# ----
# FD-path
number_slider_27 = Slider(150, range=0..1000)
python_75 = GhPythonScript(NodeDic=python_72.NodeDic, departure="LiftB_L6")  # -> out, D_location; inputs NodeDic: list; same code as python_32
python_76 = GhPythonScript(
    run=Toggle(True),
    Network=python_72.Network,
    NodeDic=python_72.NodeDic,
    allPlaces=python_72.Attri,
    walkableDistance=num,
    departure="LiftB_L6")  # -> potential_places, placesResult, sortedPlaces; inputs run: Boolean, Network: list, NodeDic: list, allPlaces: list
# ---------- python_76: Python ----------
from collections import deque, namedtuple
import Rhino.Geometry as rg
import ghpythonlib.components as gc
import re

# we'll use infinity as a default distance to nodes.
inf = float('inf')
Edge = namedtuple('Edge', 'start, end, cost')


def make_edge(start, end, cost=1):
  return Edge(start, end, cost)


class Graph:
    def __init__(self, edges):
        # let's check that the data is right
        wrong_edges = [i for i in edges if len(i) not in [2, 3]]
        if wrong_edges:
            raise ValueError('Wrong edges data: {}'.format(wrong_edges))

        self.edges = [make_edge(*edge) for edge in edges]
        
    @property
    def vertices(self):
        return set(
            sum(
                ([edge.start, edge.end] for edge in self.edges), []
            )
        )

    def get_node_pairs(self, n1, n2, both_ends=True):
        if both_ends:
            node_pairs = [[n1, n2], [n2, n1]]
        else:
            node_pairs = [[n1, n2]]
        return node_pairs

    def remove_edge(self, n1, n2, both_ends=True):
        node_pairs = self.get_node_pairs(n1, n2, both_ends)
        edges = self.edges[:]
        for edge in edges:
            if [edge.start, edge.end] in node_pairs:
                self.edges.remove(edge)

    def add_edge(self, n1, n2, cost=1, both_ends=True):
        node_pairs = self.get_node_pairs(n1, n2, both_ends)
        for edge in self.edges:
            if [edge.start, edge.end] in node_pairs:
                return ValueError('Edge {} {} already exists'.format(n1, n2))

        self.edges.append(Edge(start=n1, end=n2, cost=cost))
        if both_ends:
            self.edges.append(Edge(start=n2, end=n1, cost=cost))

    @property
    def neighbours(self):
        neighbours = {vertex: set() for vertex in self.vertices}
        for edge in self.edges:
            neighbours[edge.start].add((edge.end, edge.cost))

        return neighbours

    def dijkstra(self, source, dest):
        assert source in self.vertices, 'Such source node doesn\'t exist'
        distances = {vertex: inf for vertex in self.vertices}
        previous_vertices = {
            vertex: None for vertex in self.vertices
        }
        distances[source] = 0
        vertices = self.vertices.copy()

        while vertices:
            current_vertex = min(
                vertices, key=lambda vertex: distances[vertex])
            vertices.remove(current_vertex)
            if distances[current_vertex] == inf:
                break
            for neighbour, cost in self.neighbours[current_vertex]:
                alternative_route = distances[current_vertex] + cost
                if alternative_route < distances[neighbour]:
                    distances[neighbour] = alternative_route
                    previous_vertices[neighbour] = current_vertex

        path, current_vertex = deque(), dest
        while previous_vertices[current_vertex] is not None:
            path.appendleft(current_vertex)
            current_vertex = previous_vertices[current_vertex]
        if path:
            path.appendleft(current_vertex)
        return path

if run:
    print 'ok'

    myNodeDict = {}
    pd_distance_dic = {}
    potential_places = []
    
    for i in range (0,int(len(NodeDic)/2)):
        myNodeDict[NodeDic[2*i]] = NodeDic[2*i+1]
    for i in range(0,len(allPlaces)):
        distance = gc.Distance(myNodeDict[departure],myNodeDict[allPlaces[i]])
        if distance <= walkableDistance:
            pd_distance_dic[allPlaces[i]] = distance
            potential_places.append(allPlaces[i])

    sortedPlaces = []
    sortedD =  sorted(pd_distance_dic.items(), key=lambda pd_distance_dic:pd_distance_dic[1], reverse = True)
    for i in range(0,len(sortedD)):
        sortedPlaces.append(sortedD[i][0])
    GraphDic = {}
    for i in range(0,len(sortedPlaces)):
        kidList = []
        for j in range(0,len(Network)):
            if sortedPlaces[i] == Network[j].start:
                kidList.append(Network[j].end)
        GraphDic[sortedPlaces[i]] = kidList
    
    costDic = {}
    costList = []
    for i in range(0,len(Network)):
        costDic[Network[i].start+'+'+Network[i].end] = Network[i].cost

    validPlaces = []
    for i in range(0,len(sortedPlaces)):
        if 'Corridor' not in sortedPlaces[i]:
            validPlaces.append(sortedPlaces[i]) 
            #print sortedPlaces[i], '---', gc.Distance(myNodeDict[departure],myNodeDict[sortedPlaces[i]])
    print len(validPlaces), '-->', validPlaces
    
    def pathLength(route, myNodeDict):
        Links = []
        for i in range(0,len(route)-1):
            link = rg.Line(myNodeDict[route[i]],myNodeDict[route[i+1]])
            Links.append(link)
        if len(Links) != 0:
            R, Pr = gc.MassAddition(gc.Length(Links))
            return R
        else:
            return 0
        
    
    mygraph = Graph(Network)
    placesResult = set()
    #route = mygraph.dijkstra(departure, 'Shoes & Sox')
    #print len(route)
    
    for i in range(0,len(validPlaces)):
        if validPlaces[i] not in placesResult: #and validPlaces[i] != 'Shoes & Sox' and validPlaces[i] != 'ToiletB_L5' and validPlaces[i] != 'ToiletC_L5' and validPlaces[i] != 'Superdry':
            print validPlaces[i]
            route = mygraph.dijkstra(departure, validPlaces[i])
            pathL = pathLength(route, myNodeDict)
            print pathL
            if pathL <= walkableDistance and pathL !=0:
                for j in range(1,len(route)):
                    placesResult.add(route[j])

    """"""
# ---------- end python_76 ----------
cir_11 = Circle(Plane=python_75.D_location, Radius=num)
number_slider_28 = Slider(1, range=0..10)
python_77 = GhPythonScript(reachablePlaces=python_76.potential_places, places=python_72.Attri, locations=python_72.Nodes)  # -> a, myReachablePlaces; inputs reachablePlaces: list, places: list, locations: list of Point3d
# ---------- python_77: Python ----------
import Rhino.Geometry as rg

myNodeDict = {}
Links = []

for i in range (0,len(places)):
    myNodeDict[places[i]] = locations[i]
#print myNodeDict['MyerL4']
a = []

myReachablePlaces = []
for i in range(0,len(reachablePlaces)):
    if 'Corridor' not in reachablePlaces[i]:
        a.append(reachablePlaces[i])
        myReachablePlaces.append(myNodeDict[reachablePlaces[i]])
# ---------- end python_77 ----------
number_slider_29 = Slider(0.5, range=0..1)
number_slider_30 = Slider(2, range=0..10)
dots_7 = DotDisplay(Point=python_77.myReachablePlaces, Colour="blue", Size=Slider(1.8, range=0..10))

c_script_33 = CSharpScript(Curve=python_72.Links, Width=Slider(0, range=0..10), Colour="blue", Dash=list_25)  # -> out, A, B; inputs Curve: Curve, Width: Int32, Colour: Color, Dash: String; same code as c_script
panel_31 = Panel(python_72.NodeDic)
python_78 = GhPythonScript(placesResult=python_76.placesResult)  # -> a; inputs placesResult: list; same code as python_33
panel_32 = Panel(python_77.a)
# Level 6: Goodstart Early Learning
# 3
# Fresh Therapeutics Pharmacy and Compounding Chemist
# Westfield Suite for WBJ
# Laser Clinics Australia
# Star Car Wash - R1
# Shop_L6_8
# EscalatorE_L6
# EscalatorD_L6
panel_33 = Panel(python_78)

list_51 = ValueList({"All": 0, "Lift + Escalator": 1, "Lift only": 2}, selected="All")
python_79 = GhPythonScript(
    run=Toggle(False),
    NetworkL1=python_48.Network,
    NetworkL2=python_27.Network,
    NetworkL3=python_64.Network,
    NetworkL4=python_56.Network,
    NetworkL5=python_39.Network,
    NetworkL6=python_72.Network,
    NodeDicL1=python_48.NodeDic,
    NodeDicL2=python_27.NodeDic,
    NodeDicL3=python_64.NodeDic,
    NodeDicL4=python_56.NodeDic,
    NodeDicL5=python_39.NodeDic,
    NodeDicL6=python_72.NodeDic,
    departure="Target",
    destination="McDonald's",
    flag=list_51)  # -> Network, NodeDic, route, Transition_links; inputs run: Boolean, NetworkL1: list, NetworkL2: list, NetworkL3: list, NetworkL4: list, NetworkL5: list, NetworkL6: list, NodeDicL1: list, NodeDicL2: list, NodeDicL3: list, NodeDicL4: list, NodeDicL5: list, NodeDicL6: list, flag: Int32
# ---------- python_79: Python ----------
from collections import deque, namedtuple
import Rhino.Geometry as rg
import ghpythonlib.components as gc
import re

# we'll use infinity as a default distance to nodes.
inf = float('inf')
Edge = namedtuple('Edge', 'start, end, cost')


def make_edge(start, end, cost=1):
  return Edge(start, end, cost)


class Graph:
    def __init__(self, edges):
        # let's check that the data is right
        wrong_edges = [i for i in edges if len(i) not in [2, 3]]
        if wrong_edges:
            raise ValueError('Wrong edges data: {}'.format(wrong_edges))

        self.edges = [make_edge(*edge) for edge in edges]
        
    @property
    def vertices(self):
        return set(
            sum(
                ([edge.start, edge.end] for edge in self.edges), []
            )
        )

    def get_node_pairs(self, n1, n2, both_ends=True):
        if both_ends:
            node_pairs = [[n1, n2], [n2, n1]]
        else:
            node_pairs = [[n1, n2]]
        return node_pairs

    def remove_edge(self, n1, n2, both_ends=True):
        node_pairs = self.get_node_pairs(n1, n2, both_ends)
        edges = self.edges[:]
        for edge in edges:
            if [edge.start, edge.end] in node_pairs:
                self.edges.remove(edge)

    def add_edge(self, n1, n2, cost=1, both_ends=True):
        node_pairs = self.get_node_pairs(n1, n2, both_ends)
        for edge in self.edges:
            if [edge.start, edge.end] in node_pairs:
                return ValueError('Edge {} {} already exists'.format(n1, n2))

        self.edges.append(Edge(start=n1, end=n2, cost=cost))
        if both_ends:
            self.edges.append(Edge(start=n2, end=n1, cost=cost))

    @property
    def neighbours(self):
        neighbours = {vertex: set() for vertex in self.vertices}
        for edge in self.edges:
            neighbours[edge.start].add((edge.end, edge.cost))

        return neighbours

    def dijkstra(self, source, dest):
        assert source in self.vertices, 'Such source node doesn\'t exist'
        distances = {vertex: inf for vertex in self.vertices}
        previous_vertices = {
            vertex: None for vertex in self.vertices
        }
        distances[source] = 0
        vertices = self.vertices.copy()

        while vertices:
            current_vertex = min(
                vertices, key=lambda vertex: distances[vertex])
            vertices.remove(current_vertex)
            if distances[current_vertex] == inf:
                break
            for neighbour, cost in self.neighbours[current_vertex]:
                alternative_route = distances[current_vertex] + cost
                if alternative_route < distances[neighbour]:
                    distances[neighbour] = alternative_route
                    previous_vertices[neighbour] = current_vertex

        path, current_vertex = deque(), dest
        while previous_vertices[current_vertex] is not None:
            path.appendleft(current_vertex)
            current_vertex = previous_vertices[current_vertex]
        if path:
            path.appendleft(current_vertex)
        return path

def Transition(NodeDic):
    
    myNodeDict = {}
    for i in range (0,int(len(NodeDic)/2)):
        myNodeDict[NodeDic[2*i]] = NodeDic[2*i+1]
    
    Transition_Network = []
    Transition_links = []
    
    Lift_Network = []
    Escalator_Network = []
    Stair_Network = []
    
    # Level 5 to Level 6
    edge_L5_L6_Lift1 = make_edge("LiftB_L5", "LiftB_L6", 100)
    edge_L6_L5_Lift1  = make_edge("LiftB_L6", "LiftB_L5", 100)
    Transition_links.append(rg.Line(myNodeDict["LiftB_L5"],myNodeDict["LiftB_L6"]))
    
    edge_L5_L6_Lift2 = make_edge("LiftC_L5", "LiftA_L6", 100)
    edge_L6_L5_Lift2  = make_edge("LiftA_L6", "LiftC_L5", 100)
    Transition_links.append(rg.Line(myNodeDict["LiftC_L5"],myNodeDict["LiftA_L6"]))
    
    edge_L5_L6_Escalator1= make_edge("EscalatorA_L5", "EscalatorE_L6", 100)
    edge_L6_L5_Escalator1= make_edge("EscalatorE_L6", "EscalatorA_L5", 100)
    Transition_links.append(rg.Line(myNodeDict["EscalatorE_L6"],myNodeDict["EscalatorA_L5"]))
    
    edge_L5_L6_Escalator2= make_edge("EscalatorD_L5", "EscalatorF_L6", 100)
    edge_L6_L5_Escalator2= make_edge("EscalatorF_L6", "EscalatorD_L5", 100)
    Transition_links.append(rg.Line(myNodeDict["EscalatorD_L5"],myNodeDict["EscalatorF_L6"]))
    
    edge_L5_L6_Escalator3= make_edge("EscalatorF_L5", "EscalatorC_L6", 100)
    edge_L6_L5_Escalator3= make_edge("EscalatorC_L6", "EscalatorF_L5", 100)
    Transition_links.append(rg.Line(myNodeDict["EscalatorC_L6"],myNodeDict["EscalatorF_L5"]))
    
    edge_L5_L6_Escalator4= make_edge("EscalatorC_L5", "EscalatorB_L6", 100)
    edge_L6_L5_Escalator4= make_edge("EscalatorB_L6", "EscalatorC_L5", 100)
    Transition_links.append(rg.Line(myNodeDict["EscalatorB_L6"],myNodeDict["EscalatorC_L5"]))
    
    Lift_Network.append(edge_L5_L6_Lift1)
    Lift_Network.append(edge_L6_L5_Lift1)
    Lift_Network.append(edge_L5_L6_Lift2)
    Lift_Network.append(edge_L6_L5_Lift2)
    Escalator_Network.append(edge_L5_L6_Escalator1)
    Escalator_Network.append(edge_L6_L5_Escalator1)
    Escalator_Network.append(edge_L5_L6_Escalator2)
    Escalator_Network.append(edge_L6_L5_Escalator2)
    Escalator_Network.append(edge_L5_L6_Escalator3)
    Escalator_Network.append(edge_L6_L5_Escalator3)
    Escalator_Network.append(edge_L5_L6_Escalator4)
    Escalator_Network.append(edge_L6_L5_Escalator4)
    
    # Level 4 to Level 5
    edge_L4_L5_Lift1 = make_edge("LiftA_L5", "LiftC_L4", 100)
    edge_L5_L4_Lift1  = make_edge("LiftC_L4", "LiftA_L5", 100)
    Transition_links.append(rg.Line(myNodeDict["LiftA_L5"],myNodeDict["LiftC_L4"]))
    
    edge_L4_L5_Lift2 = make_edge("LiftB_L5", "LiftB_L4", 100)
    edge_L5_L4_Lift2  = make_edge("LiftB_L4", "LiftB_L5", 100)
    Transition_links.append(rg.Line(myNodeDict["LiftB_L5"],myNodeDict["LiftB_L4"]))
    
    edge_L4_L5_Lift3 = make_edge("LiftC_L5", "LiftA_L4", 100)
    edge_L5_L4_Lift3  = make_edge("LiftA_L4", "LiftC_L5", 100)
    Transition_links.append(rg.Line(myNodeDict["LiftC_L5"],myNodeDict["LiftA_L4"]))
    
    edge_L4_L5_Escalator1= make_edge("EscalatorC_L4", "EscalatorB_L5", 100)
    edge_L5_L4_Escalator1= make_edge("EscalatorB_L5", "EscalatorC_L4", 100)
    Transition_links.append(rg.Line(myNodeDict["EscalatorC_L4"],myNodeDict["EscalatorB_L5"]))

    edge_L4_L5_Escalator2= make_edge("EscalatorF_L4", "EscalatorF_L5", 100)
    edge_L5_L4_Escalator2= make_edge("EscalatorF_L5", "EscalatorF_L4", 100)
    Transition_links.append(rg.Line(myNodeDict["EscalatorF_L4"],myNodeDict["EscalatorF_L5"]))
    
    edge_L4_L5_Escalator3= make_edge("EscalatorA_L4", "EscalatorD_L5",100)
    edge_L5_L4_Escalator3= make_edge("EscalatorD_L5", "EscalatorA_L4",100)
    Transition_links.append(rg.Line(myNodeDict["EscalatorA_L4"],myNodeDict["EscalatorD_L5"]))
    
    Lift_Network.append(edge_L4_L5_Lift1)
    Lift_Network.append(edge_L5_L4_Lift1)
    Lift_Network.append(edge_L4_L5_Lift2)
    Lift_Network.append(edge_L5_L4_Lift2)
    Lift_Network.append(edge_L4_L5_Lift3)
    Lift_Network.append(edge_L5_L4_Lift3)
    Escalator_Network.append(edge_L4_L5_Escalator1)
    Escalator_Network.append(edge_L5_L4_Escalator1)
    Escalator_Network.append(edge_L4_L5_Escalator2)
    Escalator_Network.append(edge_L5_L4_Escalator2)
    Escalator_Network.append(edge_L4_L5_Escalator3)
    Escalator_Network.append(edge_L5_L4_Escalator3)
    """"""
    
    
    # Level 3 to Level 4
    edge_L4_L3_Lift1 = make_edge("LiftA_L3", "LiftA_L4", 100)
    edge_L3_L4_Lift1  = make_edge("LiftA_L4", "LiftA_L3", 100)
    Transition_links.append(rg.Line(myNodeDict["LiftA_L3"],myNodeDict["LiftA_L4"]))
    
    edge_L4_L3_Lift2 = make_edge("LiftB_L3", "LiftB_L4", 100)
    edge_L3_L4_Lift2  = make_edge("LiftB_L4", "LiftB_L3", 100)
    Transition_links.append(rg.Line(myNodeDict["LiftB_L3"],myNodeDict["LiftB_L4"]))
    
    edge_L4_L3_Lift3 = make_edge("LiftC_L3", "LiftC_L4", 100)
    edge_L3_L4_Lift3  = make_edge("LiftC_L4", "LiftC_L3", 100)
    Transition_links.append(rg.Line(myNodeDict["LiftC_L3"],myNodeDict["LiftC_L4"]))
    
    edge_L4_L3_Escalator1= make_edge("EscalatorC_L4", "EscalatorF_L3", 100)
    edge_L3_L4_Escalator1= make_edge("EscalatorF_L3", "EscalatorC_L4", 100)
    Transition_links.append(rg.Line(myNodeDict["EscalatorC_L4"],myNodeDict["EscalatorF_L3"]))

    edge_L4_L3_Escalator2= make_edge("EscalatorD_L3", "EscalatorB_L4", 100)
    edge_L3_L4_Escalator2= make_edge("EscalatorB_L4", "EscalatorD_L3", 100)
    Transition_links.append(rg.Line(myNodeDict["EscalatorD_L3"],myNodeDict["EscalatorB_L4"]))
    
    edge_L4_L3_Escalator3= make_edge("EscalatorE_L3", "EscalatorA_L4",100)
    edge_L3_L4_Escalator3= make_edge("EscalatorA_L4", "EscalatorE_L3",100)
    Transition_links.append(rg.Line(myNodeDict["EscalatorA_L4"],myNodeDict["EscalatorE_L3"]))
    
    edge_L4_L3_Escalator4= make_edge("EscalatorB_L3", "EscalatorD_L4",100)
    edge_L3_L4_Escalator4= make_edge("EscalatorD_L4", "EscalatorB_L3",100)
    Transition_links.append(rg.Line(myNodeDict["EscalatorB_L3"],myNodeDict["EscalatorD_L4"]))
    
    Lift_Network.append(edge_L4_L3_Lift1)
    Lift_Network.append(edge_L3_L4_Lift1)
    Lift_Network.append(edge_L4_L3_Lift2)
    Lift_Network.append(edge_L3_L4_Lift3)
    Lift_Network.append(edge_L4_L3_Lift3)
    Lift_Network.append(edge_L3_L4_Lift3)
    
    Escalator_Network.append(edge_L4_L3_Escalator1)
    Escalator_Network.append(edge_L3_L4_Escalator1)
    Escalator_Network.append(edge_L4_L3_Escalator2)
    Escalator_Network.append(edge_L3_L4_Escalator2)
    Escalator_Network.append(edge_L4_L3_Escalator3)
    Escalator_Network.append(edge_L3_L4_Escalator3)
    Escalator_Network.append(edge_L4_L3_Escalator4)
    Escalator_Network.append(edge_L3_L4_Escalator4)
    
    # Level 2 to Level 3
    edge_L2_L3_Lift1 = make_edge("LiftA_L2", "LiftB_L3", 100)
    edge_L3_L2_Lift1  = make_edge("LiftB_L3", "LiftA_L2", 100)
    Transition_links.append(rg.Line(myNodeDict["LiftA_L2"],myNodeDict["LiftB_L3"]))
    
    edge_L2_L3_Lift2 = make_edge("LiftB_L2", "LiftC_L3", 100)
    edge_L3_L2_Lift2  = make_edge("LiftC_L3", "LiftB_L2", 100)
    Transition_links.append(rg.Line(myNodeDict["LiftC_L3"],myNodeDict["LiftB_L2"]))
    
    edge_L2_L3_Escalator1= make_edge("EscalatorB_L2", "EscalatorF_L3", 100)
    edge_L3_L2_Escalator1= make_edge("EscalatorF_L3", "EscalatorB_L2", 100)
    Transition_links.append(rg.Line(myNodeDict["EscalatorB_L2"],myNodeDict["EscalatorF_L3"]))
    
    edge_L2_L3_Escalator2= make_edge("EscalatorA_L2", "EscalatorD_L3", 100)
    edge_L3_L2_Escalator2= make_edge("EscalatorD_L3", "EscalatorA_L2", 100)
    Transition_links.append(rg.Line(myNodeDict["EscalatorA_L2"],myNodeDict["EscalatorD_L3"]))
    
    edge_L2_L3_Escalator3= make_edge("EscalatorC_L2", "EscalatorE_L3", 100)
    edge_L3_L2_Escalator3= make_edge("EscalatorE_L3", "EscalatorC_L2", 100)
    Transition_links.append(rg.Line(myNodeDict["EscalatorC_L2"],myNodeDict["EscalatorE_L3"]))
    
    Lift_Network.append(edge_L2_L3_Lift1)
    Lift_Network.append(edge_L3_L2_Lift1)
    Lift_Network.append(edge_L2_L3_Lift2)
    Lift_Network.append(edge_L3_L2_Lift2)
    
    Escalator_Network.append(edge_L2_L3_Escalator1)
    Escalator_Network.append(edge_L3_L2_Escalator1)
    Escalator_Network.append(edge_L2_L3_Escalator2)
    Escalator_Network.append(edge_L3_L2_Escalator2)
    Escalator_Network.append(edge_L2_L3_Escalator3)
    Escalator_Network.append(edge_L3_L2_Escalator3)
    
    # Level 1 to Level 2
    edge_L1_L2_Lift1 = make_edge("LiftA_L1", "LiftA_L2", 100)
    edge_L2_L1_Lift1  = make_edge("LiftA_L2", "LiftA_L1", 100)
    Transition_links.append(rg.Line(myNodeDict["LiftA_L2"],myNodeDict["LiftA_L1"]))
    
    edge_L1_L2_Lift2 = make_edge("LiftB_L1", "LiftB_L2", 100)
    edge_L2_L1_Lift2  = make_edge("LiftB_L2", "LiftB_L1", 100)
    Transition_links.append(rg.Line(myNodeDict["LiftB_L1"],myNodeDict["LiftB_L2"]))
    
    edge_L1_L2_Escalator1= make_edge("EscalatorC_L1", "EscalatorB_L2", 100)
    edge_L2_L1_Escalator1= make_edge("EscalatorB_L2", "EscalatorC_L1", 100)
    Transition_links.append(rg.Line(myNodeDict["EscalatorC_L1"],myNodeDict["EscalatorB_L2"]))
    
    edge_L1_L2_Escalator2= make_edge("EscalatorA_L1", "EscalatorC_L2", 100)
    edge_L2_L1_Escalator2= make_edge("EscalatorC_L2", "EscalatorA_L1", 100)
    Transition_links.append(rg.Line(myNodeDict["EscalatorA_L1"],myNodeDict["EscalatorC_L2"]))
    
    edge_L1_L2_stair= make_edge("StairsA_L1", "StairsA_L2", 100)
    edge_L2_L1_stair= make_edge("StairsA_L2", "StairsA_L1", 100)
    Transition_links.append(rg.Line(myNodeDict["StairsA_L1"],myNodeDict["StairsA_L2"]))
    
    Lift_Network.append(edge_L1_L2_Lift1)
    Lift_Network.append(edge_L2_L1_Lift1)
    Lift_Network.append(edge_L1_L2_Lift2)
    Lift_Network.append(edge_L2_L1_Lift2)
    
    Escalator_Network.append(edge_L1_L2_Escalator1)
    Escalator_Network.append(edge_L2_L1_Escalator1)
    Escalator_Network.append(edge_L1_L2_Escalator2)
    Escalator_Network.append(edge_L2_L1_Escalator2)
    
    Stair_Network.append(edge_L1_L2_stair)
    Stair_Network.append(edge_L2_L1_stair)
    """"""

    return Lift_Network, Escalator_Network, Stair_Network, Transition_links

if run:
    print len(NetworkL4)
    print len(NetworkL5)

    
    #route = mygraph.dijkstra("MyerL4", "Target")
    #route = mygraph.dijkstra("MyerL4", "Myer L5")
    #route = mygraph.dijkstra("MyerL4", "Pochana")
    
    NodeDic = NodeDicL1 + NodeDicL2 + NodeDicL3 + NodeDicL4 + NodeDicL5 + NodeDicL6
    Lift_Network, Escalator_Network, Stair_Network, Transition_links = Transition(NodeDic)
    
    NetworkFloors = NetworkL1 + NetworkL2 + NetworkL3 + NetworkL4 + NetworkL5 + NetworkL6
    
    if flag == 0:
        Network =  NetworkFloors + Lift_Network + Escalator_Network + Stair_Network
    elif flag == 1:
        Network = NetworkFloors + Lift_Network + Escalator_Network
    else:
        Network = NetworkFloors + Lift_Network
    
    
    #mygraph = Graph(Network)
    #route = mygraph.dijkstra(departure, destination)
# ---------- end python_79 ----------
line_7 = Line(python_79.Transition_links)
python_80 = GhPythonScript(run=Toggle(True), Network=python_79.Network, departure="Fone King", destination="ToiletA_L5")  # -> route; inputs run: Boolean, Network: list
# ---------- python_80: Python ----------
from collections import deque, namedtuple
import Rhino.Geometry as rg
import ghpythonlib.components as gc
import re

# we'll use infinity as a default distance to nodes.
inf = float('inf')
Edge = namedtuple('Edge', 'start, end, cost')


def make_edge(start, end, cost=1):
  return Edge(start, end, cost)


class Graph:
    def __init__(self, edges):
        # let's check that the data is right
        wrong_edges = [i for i in edges if len(i) not in [2, 3]]
        if wrong_edges:
            raise ValueError('Wrong edges data: {}'.format(wrong_edges))

        self.edges = [make_edge(*edge) for edge in edges]
        
    @property
    def vertices(self):
        return set(
            sum(
                ([edge.start, edge.end] for edge in self.edges), []
            )
        )

    def get_node_pairs(self, n1, n2, both_ends=True):
        if both_ends:
            node_pairs = [[n1, n2], [n2, n1]]
        else:
            node_pairs = [[n1, n2]]
        return node_pairs

    def remove_edge(self, n1, n2, both_ends=True):
        node_pairs = self.get_node_pairs(n1, n2, both_ends)
        edges = self.edges[:]
        for edge in edges:
            if [edge.start, edge.end] in node_pairs:
                self.edges.remove(edge)

    def add_edge(self, n1, n2, cost=1, both_ends=True):
        node_pairs = self.get_node_pairs(n1, n2, both_ends)
        for edge in self.edges:
            if [edge.start, edge.end] in node_pairs:
                return ValueError('Edge {} {} already exists'.format(n1, n2))

        self.edges.append(Edge(start=n1, end=n2, cost=cost))
        if both_ends:
            self.edges.append(Edge(start=n2, end=n1, cost=cost))

    @property
    def neighbours(self):
        neighbours = {vertex: set() for vertex in self.vertices}
        for edge in self.edges:
            neighbours[edge.start].add((edge.end, edge.cost))

        return neighbours

    def dijkstra(self, source, dest):
        assert source in self.vertices, 'Such source node doesn\'t exist'
        distances = {vertex: inf for vertex in self.vertices}
        previous_vertices = {
            vertex: None for vertex in self.vertices
        }
        distances[source] = 0
        vertices = self.vertices.copy()

        while vertices:
            current_vertex = min(
                vertices, key=lambda vertex: distances[vertex])
            vertices.remove(current_vertex)
            if distances[current_vertex] == inf:
                break
            for neighbour, cost in self.neighbours[current_vertex]:
                alternative_route = distances[current_vertex] + cost
                if alternative_route < distances[neighbour]:
                    distances[neighbour] = alternative_route
                    previous_vertices[neighbour] = current_vertex

        path, current_vertex = deque(), dest
        while previous_vertices[current_vertex] is not None:
            path.appendleft(current_vertex)
            current_vertex = previous_vertices[current_vertex]
        if path:
            path.appendleft(current_vertex)
        return path

if run:
    mygraph = Graph(Network)
    route = mygraph.dijkstra(departure, destination)
# ---------- end python_80 ----------
python_81 = GhPythonScript(run=Toggle(True), route=python_80, NodeDic=python_79.NodeDic)  # -> out, Links; inputs run: Boolean, route: list, NodeDic: list
# ---------- python_81: Python ----------
import Rhino.Geometry as rg

myNodeDict = {}
Links = []

for i in range (0,int(len(NodeDic)/2)):
    myNodeDict[NodeDic[2*i]] = NodeDic[2*i+1]
#print myNodeDict['MyerL4']


for i in range(0,len(route)-1):
    link = rg.Line(myNodeDict[route[i]],myNodeDict[route[i+1]])
    Links.append(link)
# ---------- end python_81 ----------
panel_34 = Panel(python_79.route)
list_52 = ValueList({"None": "", "Dot": "0.1 1.0", "Dash": "1.0", "DashDot": "1.0 1.0 0.1 1.0"}, selected="None")
panel_35 = Panel("0,0,255")
len_5 = Length(Curve=python_81.Links)
c_script_34 = CSharpScript(Curve=python_81.Links, Width=Slider(7, range=0..10), Colour="purple", Dash=list_52)  # -> out, A, B; inputs Curve: Curve, Width: Int32, Colour: Color, Dash: String; same code as c_script
ma_5 = MassAddition(Input=len_5)  # -> Result, PartialResults
panel_36 = Panel(ma_5.Result)

crv_14 = Curve([line_6, line_2, line_4, line_5, line, line_3, line_7])  # disabled
move_74 = Move(Geometry=crv_14, Motion=X)  # -> Geometry, Transform
c_script_35 = CSharpScript(Curve=move_74.Geometry, Width=Slider(3, range=0..10), Colour="black", Dash=list_34)  # -> out, A, B; inputs Curve: Curve, Width: Int32, Colour: Color, Dash: String; same code as c_script
python_82 = GhPythonScript(run=Toggle(False), Network=python_79.Network, NodeDic=python_79.NodeDic, departure="Coles", MiddlePlaces=panel_9)  # -> NodeDic, interRoutes, RouteAuto, min_cost, TSP_path, links; inputs run: Boolean, Network: list, NodeDic: list, MiddlePlaces: list
# ---------- python_82: Python ----------
from collections import deque, namedtuple
import Rhino.Geometry as rg
import ghpythonlib.components as gc
import re

# we'll use infinity as a default distance to nodes.
inf = float('inf')
Edge = namedtuple('Edge', 'start, end, cost')


def make_edge(start, end, cost=1):
  return Edge(start, end, cost)


class Graph:
    def __init__(self, edges):
        # let's check that the data is right
        wrong_edges = [i for i in edges if len(i) not in [2, 3]]
        if wrong_edges:
            raise ValueError('Wrong edges data: {}'.format(wrong_edges))

        self.edges = [make_edge(*edge) for edge in edges]
        
    @property
    def vertices(self):
        return set(
            sum(
                ([edge.start, edge.end] for edge in self.edges), []
            )
        )

    def get_node_pairs(self, n1, n2, both_ends=True):
        if both_ends:
            node_pairs = [[n1, n2], [n2, n1]]
        else:
            node_pairs = [[n1, n2]]
        return node_pairs

    def remove_edge(self, n1, n2, both_ends=True):
        node_pairs = self.get_node_pairs(n1, n2, both_ends)
        edges = self.edges[:]
        for edge in edges:
            if [edge.start, edge.end] in node_pairs:
                self.edges.remove(edge)

    def add_edge(self, n1, n2, cost=1, both_ends=True):
        node_pairs = self.get_node_pairs(n1, n2, both_ends)
        for edge in self.edges:
            if [edge.start, edge.end] in node_pairs:
                return ValueError('Edge {} {} already exists'.format(n1, n2))

        self.edges.append(Edge(start=n1, end=n2, cost=cost))
        if both_ends:
            self.edges.append(Edge(start=n2, end=n1, cost=cost))

    @property
    def neighbours(self):
        neighbours = {vertex: set() for vertex in self.vertices}
        for edge in self.edges:
            neighbours[edge.start].add((edge.end, edge.cost))

        return neighbours

    def dijkstra(self, source, dest):
        assert source in self.vertices, 'Such source node doesn\'t exist'
        distances = {vertex: inf for vertex in self.vertices}
        previous_vertices = {
            vertex: None for vertex in self.vertices
        }
        distances[source] = 0
        vertices = self.vertices.copy()

        while vertices:
            current_vertex = min(
                vertices, key=lambda vertex: distances[vertex])
            vertices.remove(current_vertex)
            if distances[current_vertex] == inf:
                break
            for neighbour, cost in self.neighbours[current_vertex]:
                alternative_route = distances[current_vertex] + cost
                if alternative_route < distances[neighbour]:
                    distances[neighbour] = alternative_route
                    previous_vertices[neighbour] = current_vertex

        path, current_vertex = deque(), dest
        while previous_vertices[current_vertex] is not None:
            path.appendleft(current_vertex)
            current_vertex = previous_vertices[current_vertex]
        if path:
            path.appendleft(current_vertex)
        return path


"""
new functions for the TSP
https://zhuanlan.zhihu.com/p/159266077
"""

def find_path(c,j):
    path_vertexs.append(j)
    row=c[j]
    
    copy_row = [value for value in row]
    walked_vertex = []
    for i in path_vertexs:
        walked_vertex.append(copy_row[i])
    for vertex in walked_vertex:
        copy_row.remove(vertex)

    if len(path_vertexs)<5:
        min_e = min(copy_row)
        j = row.index(min_e)
        path_length.append(min_e)
        find_path(c,j)
    else:
        min_e=c[j][0]
        path_length.append(min_e)
        path_vertexs.append(0)
    return path_vertexs, path_length

def print_path(vertexs,lengths):
    path_index = []
    path =''
    vertexs = [vertex+1 for vertex in vertexs]
    for i, vertex in enumerate(vertexs):
        path_index.append(vertex)
        path += str(vertex)
        if i ==5:
            break
        path += '->'
    print ('Distance', sum(lengths))
    print ("path", path)
    return path_index

#===========================================


if run:
    mygraph = Graph(Network)
    
    myNodeDict = {}
    
    
    for i in range (0,int(len(NodeDic)/2)):
        myNodeDict[NodeDic[2*i]] = NodeDic[2*i+1]

    def routeLength(myNodeDict,route):
        Links = []
        for i in range(0,len(route)-1):
            link = rg.Line(myNodeDict[route[i]],myNodeDict[route[i+1]])
            Links.append(link)
        return Links
    
    allPlaces = []
    interRoutes = []
    interRoutesDic = {}
    
    
    allPlaces.append(departure)
    allPlaces = allPlaces + MiddlePlaces
    print allPlaces
    
    weights = []
    TSPGraph = []
    
    for i in range(0,len(allPlaces)):
        weight = []
        weightsDic ={}
        for j in range(0,len(allPlaces)):
            if i != j:
                temp_departure = allPlaces[i]
                temp_destination = allPlaces[j] 
                
                route = mygraph.dijkstra(temp_departure, temp_destination)
                links = routeLength(myNodeDict,route)
                #print 'fuuuuuuuck', links[0].Length #gc.Length(links[0])
                
                sumLen = 0
                for k in range(0,len(links)):
                    sumLen = sumLen + links[k].Length
                
                #print "sumLen=", sumLen
                interRoutes.append(temp_departure)
                interRoutes.append(temp_destination)
                interRoutes.append(route)
                interRoutes.append(sumLen)
                
                interRoutesDic[temp_departure+'->'+temp_destination] = route
                interRoutesDic[temp_destination+'->'+temp_departure] = mygraph.dijkstra(temp_destination, temp_departure)
                
                print temp_departure, '---', temp_destination, '---', route, '---', sumLen
                weight.append(sumLen)
                weightsDic[j] = sumLen
                
                weight.append(sumLen)
                weightsDic[j] = sumLen
                
            else:
                weight.append(0)
        
        weights.append(weight)
        TSPGraph.append(weightsDic)



    # 用邻接表表示带权图
    # https://www.jb51.net/article/122938.htm
    #本文实例讲述了Python基于回溯法子集树模板解决旅行商问题（TSP）
    
    graph = TSPGraph
    
    n = len(allPlaces) # 节点数
    
    x = [0]*(n+1) # 一个解（n+1元数组，长度固定）
    X = []     # 一组解
    best_x = [0]*(n+1) # 已找到的最佳解（路径）
    min_cost = 0    # 最小旅费
    # 冲突检测
    def conflict(k):
      global n,graph,x,best_x,min_cost
      # 第k个节点，是否前面已经走过
      if k < n and x[k] in x[:k]:
        return True
      # 回到出发节点
      if k == n and x[k] != x[0]:
        return True
      # 前面部分解的旅费之和超出已经找到的最小总旅费
      cost = sum([graph[node1][node2] for node1,node2 in zip(x[:k], x[1:k+1])])
      if 0 < min_cost < cost:
        return True
      return False # 无冲突
    # 旅行商问题（TSP）
    def tsp(k): 
      global n,graph,x,X,min_cost,best_x # 到达（解x的）第k个节点
      if k > n: # 解的长度超出，已走遍n+1个节点 （若不回到出发节点，则 k==n）
        cost = sum([graph[node1][node2] for node1,node2 in zip(x[:-1], x[1:])]) # 计算总旅费
        if min_cost == 0 or cost < min_cost:
          best_x = x[:]
          min_cost = cost
          #print(x)
      else:
        for node in graph[x[k-1]]: # 遍历节点x[k-1]的邻接节点（状态空间）
          x[k] = node
          if not conflict(k): # 剪枝
            tsp(k+1)
    # 测试
    def change2ID (allPlaces,name):
        if name in allPlaces:
            return allPlaces.index(name)
        else:
            return 'NULL'
    
    x[0] = change2ID (allPlaces,departure) # 出发节点：路径x的第一个节点（随便哪个）
    tsp(1)  # 开始处理解x中的第2个节点 不要修改，只修改上面的
    print 'path = ',best_x
    
    TSP_path = []
    for item in best_x:
        TSP_path.append(allPlaces[item])
    
    print allPlaces
    print TSP_path
    print(min_cost)
    
    tempPathList = []
    for i in range(len(TSP_path)-1):
        #print TSP_path[i]+'->'+TSP_path[i+1]
        interPath = interRoutesDic[TSP_path[i]+'->'+TSP_path[i+1]]
        interPath.pop()
        #print interPath
        tempPathList += interPath
    tempPathList.append(str(TSP_path[0]))
    print tempPathList
    
    #RouteAuto = 'deque('+tempPathList+')'
    #print RouteAuto
    
    RouteAuto = tempPathList
    
""""""
# ---------- end python_82 ----------
panel_37 = Panel(python_82.interRoutes)
c_script_36 = CSharpScript(Curve=line_7, Width=Slider(1, range=0..10), Colour="black", Dash=list_35)  # -> out, A, B; inputs Curve: Curve, Width: Int32, Colour: Color, Dash: String; same code as c_script
python_83 = GhPythonScript(run=Toggle(True), route=python_82.RouteAuto, NodeDic=python_82.NodeDic)  # -> out, Links; inputs run: Boolean, route: list, NodeDic: list; same code as python_81

# ----
# Fresh Therapeutics Pharmacy and Compounding Chemist
# EscalatorF_L6
# EscalatorB_L6
# Westfield Suite for WBJ
# Laser Clinics Australia
# Star Car Wash - R1
# Shop_L6_8
# EscalatorE_L6
# EscalatorD_L6
# The Cancer Council
# Shoes & Sox
# The Trybe
# Gro Urban Oasis
# Jacobson's Jewellery
# BenchC_L5
# BenchB_L5
# Shaver Shop
# Dusk
# Joh Bailey
# EI Topo
# Le Creuset
# Leah's Wax Works
# Eckersley's Art & Craft
# Speedo
# LiftA_L5
# EscalatorA_L5
# Harry Hartog Bookseller
# Pavement
# Ripe Maternity
# ECCO
# EscalatorB_L5
# LookSmart Alterations- Level 5
# BenchA_L5
# Holistic Massage & Acupuncture
# Harper Hair
# The Body Shop
# LiftB_L5
# Adairs
# ToiletA_L5
# Kikki.K
# Body Catalyst
# Karitane
# EscalatorC_L5
# Target
# Priceline
# Haigh's Chocolates
# Shop_L5_12
# ATM_L5
# Rojank
# Adairs Kids
# EscalatorE_L5
# Boost Juice L5
# T2
# Pearl Nails
# BenchD_L5
# Vodafone
# Bang & Olufsen
# Butt Shoe Repair
# The North Face
# Sheriden
# Kidstuff
# Stokke
# Bed Bath N' Table
# EscalatorD_L5
# Bonds Kids
# EscalatorE_L4
# BenchB L4
# BenchA L4
# L'Occitane en Provence
# ToiletA_L4
# Rodd & Gunn
# Simone Perele
# LiftC_L4
# EscalatorA_L4
# FD-path Visualization
python_84 = GhPythonScript(NodeDic=python_79.NodeDic, y=panel_10)  # -> out, a; inputs NodeDic: list, y: list
# ---------- python_84: Python ----------
myNodeDict = {}

for i in range (0,int(len(NodeDic)/2)):
    myNodeDict[NodeDic[2*i]] = NodeDic[2*i+1]


a = y
# ---------- end python_84 ----------
locations = Point([python_48.Nodes, python_27.Nodes, python_64.Nodes, python_56.Nodes, python_39.Nodes, python_72.Nodes])
places = Text([python_48.Attri, python_27.Attri, python_64.Attri, python_56.Attri, python_39.Attri, python_72.Attri])
python_85 = GhPythonScript(reachablePlaces=python_84.a, places=places, locations=locations)  # -> a, myReachablePlaces; inputs reachablePlaces: list, places: list, locations: list of Point3d
# ---------- python_85: Python ----------
import Rhino.Geometry as rg

myNodeDict = {}
Links = []

for i in range (0,len(places)):
    myNodeDict[places[i]] = locations[i]
#print myNodeDict['MyerL4']
a = []

myReachablePlaces = []
for i in range(0,len(reachablePlaces)):
    if 'Corridor' not in reachablePlaces[i]:
        a.append(reachablePlaces[i])
        if myNodeDict[reachablePlaces[i]]:
            print 'found'
            myReachablePlaces.append(myNodeDict[reachablePlaces[i]])
# ---------- end python_85 ----------
dots_8 = DotDisplay(Point=python_85.myReachablePlaces, Colour="blue", Size=Slider(1.8, range=0..10))

panel_38 = Panel(python_82.TSP_path)
move_75 = Move(Geometry=python_83.Links, Motion=X_2)  # -> Geometry, Transform
python_86 = GhPythonScript(x=move_75.Geometry)  # -> out, a; inputs x: list of Line; disabled
# ---------- python_86: Python ----------
a = []
for i in range(0,len(x)):
    a.append(x[i].From)
# ---------- end python_86 ----------
c_script_37 = CSharpScript(Curve=move_75.Geometry, Width=Slider(6, range=0..10), Colour="blue", Dash=list_36)  # -> out, A, B; inputs Curve: Curve, Width: Int32, Colour: Color, Dash: String; same code as c_script
dots_9 = DotDisplay(Point=python_86.a, Colour="Deeppink", Size=Slider(2, range=0..10))

# ----
# Level 5
panel_39 = Panel("LiftA_L5")
python_87 = GhPythonScript(NodeDic=python_79.NodeDic, departure=panel_39)  # -> out, D_location; inputs NodeDic: list; same code as python_32
python_88 = GhPythonScript(NodeDic=python_79.NodeDic, departure="LiftB_L5")  # -> out, D_location; inputs NodeDic: list; same code as python_32
python_89 = GhPythonScript(NodeDic=python_79.NodeDic, departure="EscalatorD_L5")  # -> out, D_location; inputs NodeDic: list; same code as python_32
cir_12 = Circle(Plane=python_87.D_location, Radius=Slider(43.93, range=0..100))
cir_13 = Circle(Plane=python_88.D_location, Radius=Slider(29.62, range=0..100))
cir_14 = Circle(Plane=python_89.D_location, Radius=Slider(14.51, range=0..100))
brep_15 = Brep(cir_12)  # disabled
brep_16 = Brep(cir_13)  # disabled
brep_17 = Brep(cir_14)  # disabled
material_4 = CreateMaterial(Diffuse="128,0,128", Specular="128,0,128", Emission="128,0,128", Transparency=Slider(0.9, range=0..1), Shine=0)
material_5 = CreateMaterial(Diffuse="128,0,128", Specular="128,0,128", Emission="128,0,128", Transparency=Slider(0.9, range=0..1), Shine=0)
material_6 = CreateMaterial(Diffuse="128,0,128", Specular="128,0,128", Emission="128,0,128", Transparency=Slider(0.9, range=0..1), Shine=0)
preview_14 = CustomPreview(Geometry=brep_15, Material=material_4)
preview_15 = CustomPreview(Geometry=brep_16, Material=material_5)
preview_16 = CustomPreview(Geometry=brep_17, Material=material_6)
list_53 = ValueList({"None": "", "Dot": "0.1 1.0", "Dash": "1.0", "DashDot": "1.0 1.0 0.1 1.0"}, selected="Dash")
c_script_38 = CSharpScript(Curve=[cir_13, cir_12, cir_14], Width=Slider(0, range=0..10), Colour="DeepSkyBlue", Dash=list_53)  # -> out, A, B; inputs Curve: Curve, Width: Int32, Colour: Color, Dash: String; same code as c_script

# ----
# Level 6
panel_40 = Panel("LiftB_L6")
python_90 = GhPythonScript(NodeDic=python_79.NodeDic, departure=panel_40)  # -> out, D_location; inputs NodeDic: list; same code as python_32
python_91 = GhPythonScript(NodeDic=python_79.NodeDic, departure="EscalatorF_L6")  # -> out, D_location; inputs NodeDic: list; same code as python_32
cir_15 = Circle(Plane=python_90.D_location, Radius=Slider(25.12, range=0..100))
cir_16 = Circle(Plane=python_91.D_location, Radius=Slider(14.51, range=0..100))
brep_18 = Brep(cir_15)  # disabled
brep_19 = Brep(cir_16)  # disabled
material_7 = CreateMaterial(Diffuse="128,0,128", Specular="128,0,128", Emission="128,0,128", Transparency=Slider(0.9, range=0..1), Shine=0)
material_8 = CreateMaterial(Diffuse="128,0,128", Specular="128,0,128", Emission="128,0,128", Transparency=Slider(0.9, range=0..1), Shine=0)
preview_17 = CustomPreview(Geometry=brep_18, Material=material_7)
preview_18 = CustomPreview(Geometry=brep_19, Material=material_8)
list_54 = ValueList({"None": "", "Dot": "0.1 1.0", "Dash": "1.0", "DashDot": "1.0 1.0 0.1 1.0"}, selected="Dash")
c_script_39 = CSharpScript(Curve=[cir_15, cir_16], Width=Slider(0, range=0..10), Colour="Cyan", Dash=list_54)  # -> out, A, B; inputs Curve: Curve, Width: Int32, Colour: Color, Dash: String; same code as c_script

# ----
# Level 3
panel_41 = Panel("EscalatorF_L3")
python_92 = GhPythonScript(NodeDic=python_79.NodeDic, departure=panel_41)  # -> out, D_location; inputs NodeDic: list; same code as python_32
python_93 = GhPythonScript(NodeDic=python_79.NodeDic, departure="LiftB_L3")  # -> out, D_location; inputs NodeDic: list; same code as python_32
python_94 = GhPythonScript(NodeDic=python_79.NodeDic, departure="EscalatorE_L3")  # -> out, D_location; inputs NodeDic: list; same code as python_32
python_95 = GhPythonScript(NodeDic=python_79.NodeDic, departure="LiftC_L3")  # -> out, D_location; inputs NodeDic: list; same code as python_32
cir_17 = Circle(Plane=python_92.D_location, Radius=Slider(6.05, range=0..100))
cir_18 = Circle(Plane=python_93.D_location, Radius=Slider(38.62, range=0..100))
cir_19 = Circle(Plane=python_94.D_location, Radius=Slider(41.51, range=0..100))
cir_20 = Circle(Plane=python_95.D_location, Radius=Slider(52.93, range=0..100))
brep_20 = Brep(cir_17)  # disabled
brep_21 = Brep(cir_18)  # disabled
brep_22 = Brep(cir_19)  # disabled
brep_23 = Brep(cir_20)  # disabled
material_9 = CreateMaterial(Diffuse="128,0,128", Specular="128,0,128", Emission="128,0,128", Transparency=Slider(0.9, range=0..1), Shine=0)
material_10 = CreateMaterial(Diffuse="128,0,128", Specular="128,0,128", Emission="128,0,128", Transparency=Slider(0.9, range=0..1), Shine=0)
material_11 = CreateMaterial(Diffuse="128,0,128", Specular="128,0,128", Emission="128,0,128", Transparency=Slider(0.9, range=0..1), Shine=0)
material_12 = CreateMaterial(Diffuse="128,0,128", Specular="128,0,128", Emission="128,0,128", Transparency=Slider(0.9, range=0..1), Shine=0)
preview_19 = CustomPreview(Geometry=brep_20, Material=material_9)
preview_20 = CustomPreview(Geometry=brep_21, Material=material_10)
preview_21 = CustomPreview(Geometry=brep_22, Material=material_11)
preview_22 = CustomPreview(Geometry=brep_23, Material=material_12)
list_55 = ValueList({"None": "", "Dot": "0.1 1.0", "Dash": "1.0", "DashDot": "1.0 1.0 0.1 1.0"}, selected="Dash")
c_script_40 = CSharpScript(Curve=[cir_18, cir_17, cir_19, cir_20], Width=Slider(0, range=0..10), Colour="green", Dash=list_55)  # -> out, A, B; inputs Curve: Curve, Width: Int32, Colour: Color, Dash: String; same code as c_script

# ----
# Level 4
panel_42 = Panel("LiftC_L4")
python_96 = GhPythonScript(NodeDic=python_79.NodeDic, departure=panel_42)  # -> out, D_location; inputs NodeDic: list; same code as python_32
python_97 = GhPythonScript(NodeDic=python_79.NodeDic, departure="LiftB_L4")  # -> out, D_location; inputs NodeDic: list; same code as python_32
python_98 = GhPythonScript(NodeDic=python_79.NodeDic, departure="EscalatorA_L4")  # -> out, D_location; inputs NodeDic: list; same code as python_32
cir_21 = Circle(Plane=python_96.D_location, Radius=Slider(48.43, range=0..100))
cir_22 = Circle(Plane=python_97.D_location, Radius=Slider(34.12, range=0..100))
cir_23 = Circle(Plane=python_98.D_location, Radius=Slider(32.51, range=0..100))
brep_24 = Brep(cir_21)  # disabled
brep_25 = Brep(cir_22)  # disabled
brep_26 = Brep(cir_23)  # disabled
material_13 = CreateMaterial(Diffuse="128,0,128", Specular="128,0,128", Emission="128,0,128", Transparency=Slider(0.9, range=0..1), Shine=0)
material_14 = CreateMaterial(Diffuse="128,0,128", Specular="128,0,128", Emission="128,0,128", Transparency=Slider(0.9, range=0..1), Shine=0)
material_15 = CreateMaterial(Diffuse="128,0,128", Specular="128,0,128", Emission="128,0,128", Transparency=Slider(0.9, range=0..1), Shine=0)
preview_23 = CustomPreview(Geometry=brep_24, Material=material_13)
preview_24 = CustomPreview(Geometry=brep_25, Material=material_14)
preview_25 = CustomPreview(Geometry=brep_26, Material=material_15)
list_56 = ValueList({"None": "", "Dot": "0.1 1.0", "Dash": "1.0", "DashDot": "1.0 1.0 0.1 1.0"}, selected="Dash")
c_script_41 = CSharpScript(Curve=[cir_22, cir_21, cir_23], Width=Slider(0, range=0..10), Colour="purple", Dash=list_56)  # -> out, A, B; inputs Curve: Curve, Width: Int32, Colour: Color, Dash: String; same code as c_script

# ----
# Level 2
panel_43 = Panel("EscalatorB_L2")
python_99 = GhPythonScript(NodeDic=python_79.NodeDic, departure=panel_43)  # -> out, D_location; inputs NodeDic: list; same code as python_32
python_100 = GhPythonScript(NodeDic=python_79.NodeDic, departure="LiftA_L2")  # -> out, D_location; inputs NodeDic: list; same code as python_32
python_101 = GhPythonScript(NodeDic=python_79.NodeDic, departure="EscalatorD_L2")  # -> out, D_location; inputs NodeDic: list; same code as python_32
python_102 = GhPythonScript(NodeDic=python_79.NodeDic, departure="EscalatorC_L2")  # -> out, D_location; inputs NodeDic: list; same code as python_32
python_103 = GhPythonScript(NodeDic=python_79.NodeDic, departure="StairsA_L2")  # -> out, D_location; inputs NodeDic: list; same code as python_32
python_104 = GhPythonScript(NodeDic=python_79.NodeDic, departure="LiftB_L2")  # -> out, D_location; inputs NodeDic: list; same code as python_32
cir_24 = Circle(Plane=python_99.D_location, Radius=Slider(15.05, range=0..100))
cir_25 = Circle(Plane=python_100.D_location, Radius=Slider(43.12, range=0..100))
cir_26 = Circle(Plane=python_101.D_location, Radius=Slider(21.3, range=0..100))
cir_27 = Circle(Plane=python_102.D_location, Radius=Slider(50.51, range=0..100))
cir_28 = Circle(Plane=python_103.D_location, Radius=Slider(80.35, range=0..100))
cir_29 = Circle(Plane=python_104.D_location, Radius=Slider(57.43, range=0..100))
brep_27 = Brep(cir_24)  # disabled
brep_28 = Brep(cir_25)  # disabled
brep_29 = Brep(cir_26)  # disabled
brep_30 = Brep(cir_27)  # disabled
brep_31 = Brep(cir_28)  # disabled
brep_32 = Brep(cir_29)  # disabled
material_16 = CreateMaterial(Diffuse="255,0,255", Specular="255,0,255", Emission="255,0,255", Transparency=Slider(0.9, range=0..1), Shine=0)
material_17 = CreateMaterial(Diffuse="255,0,255", Specular="255,0,255", Emission="255,0,255", Transparency=Slider(0.9, range=0..1), Shine=0)
material_18 = CreateMaterial(Diffuse="255,0,255", Specular="255,0,255", Emission="255,0,255", Transparency=Slider(0.9, range=0..1), Shine=0)
material_19 = CreateMaterial(Diffuse="255,0,255", Specular="255,0,255", Emission="255,0,255", Transparency=Slider(0.9, range=0..1), Shine=0)
material_20 = CreateMaterial(Diffuse="255,0,255", Specular="255,0,255", Emission="255,0,255", Transparency=Slider(0.9, range=0..1), Shine=0)
material_21 = CreateMaterial(Diffuse="255,0,255", Specular="255,0,255", Emission="255,0,255", Transparency=Slider(0.9, range=0..1), Shine=0)
preview_26 = CustomPreview(Geometry=brep_27, Material=material_16)
preview_27 = CustomPreview(Geometry=brep_28, Material=material_17)
preview_28 = CustomPreview(Geometry=brep_29, Material=material_18)
preview_29 = CustomPreview(Geometry=brep_30, Material=material_19)
preview_30 = CustomPreview(Geometry=brep_31, Material=material_20)
preview_31 = CustomPreview(Geometry=brep_32, Material=material_21)
list_57 = ValueList({"None": "", "Dot": "0.1 1.0", "Dash": "1.0", "DashDot": "1.0 1.0 0.1 1.0"}, selected="Dash")
c_script_42 = CSharpScript(Curve=[cir_25, cir_24, cir_27, cir_29, cir_28], Width=Slider(0, range=0..10), Colour="green", Dash=list_57)  # -> out, A, B; inputs Curve: Curve, Width: Int32, Colour: Color, Dash: String; same code as c_script

circle = Circle([cir_22, cir_21, cir_23])
circle_2 = Circle([cir_13, cir_12, cir_14])
circle_3 = Circle([cir_15, cir_16])
circle_4 = Circle([cir_18, cir_17, cir_20, cir_19])
circle_5 = Circle([cir_25, cir_24, cir_29, cir_27, cir_26, cir_28])
move_76 = Move(Geometry=circle_3, Motion=Y)  # -> Geometry, Transform
move_77 = Move(Geometry=circle_2, Motion=Y_3)  # -> Geometry, Transform
move_78 = Move(Geometry=circle, Motion=Y_4)  # -> Geometry, Transform
move_79 = Move(Geometry=circle_5, Motion=Y_5)  # -> Geometry, Transform
move_80 = Move(Geometry=circle_4, Motion=Y_6)  # -> Geometry, Transform
move_81 = Move(Geometry=line_7, Motion=Y_7)  # -> Geometry, Transform

brep_33 = Brep(move_77.Geometry)  # disabled
material_22 = CreateMaterial(Diffuse="127,255,170", Specular="127,255,170", Emission="127,255,170", Transparency=Slider(0, range=0..1), Shine=0)
preview_32 = CustomPreview(Geometry=brep_33, Material=material_22)

brep_34 = Brep(move_76.Geometry)  # disabled
material_23 = CreateMaterial(Diffuse="255,215,0", Specular="255,215,0", Emission="255,215,0", Transparency=Slider(0, range=0..1), Shine=0)
preview_33 = CustomPreview(Geometry=brep_34, Material=material_23)

c_script_43 = CSharpScript(Curve=move_76.Geometry, Width=number_slider_19, Colour="Orange", Dash=list_37)  # -> out, A, B; inputs Curve: Curve, Width: Int32, Colour: Color, Dash: String; same code as c_script

brep_35 = Brep(move_80.Geometry)  # disabled
material_24 = CreateMaterial(Diffuse="0,255,0", Specular="0,255,0", Emission="0,255,0", Transparency=Slider(0.9, range=0..1), Shine=0)
preview_34 = CustomPreview(Geometry=brep_35, Material=material_24)

c_script_44 = CSharpScript(Curve=move_79.Geometry, Width=number_slider_19, Colour="Blue", Dash=list_38)  # -> out, A, B; inputs Curve: Curve, Width: Int32, Colour: Color, Dash: String; same code as c_script

brep_36 = Brep(circle_5)  # disabled
material_25 = CreateMaterial(Diffuse="0,255,255", Specular="0,255,255", Emission="0,255,255", Transparency=Slider(0.9, range=0..1), Shine=0)
preview_35 = CustomPreview(Geometry=brep_36, Material=material_25)

c_script_45 = CSharpScript(Curve=move_77.Geometry, Width=number_slider_19, Colour="Chartreuse", Dash=list_39)  # -> out, A, B; inputs Curve: Curve, Width: Int32, Colour: Color, Dash: String; same code as c_script

brep_37 = Brep(move_78.Geometry)  # disabled
material_26 = CreateMaterial(Diffuse="128,128,0", Specular="128,128,0", Emission="128,128,0", Transparency=Slider(0.8, range=0..1), Shine=0)
preview_36 = CustomPreview(Geometry=brep_37, Material=material_26)

c_script_46 = CSharpScript(Curve=move_81.Geometry, Width=Slider(1, range=0..10), Colour="black", Dash=list_41)  # -> out, A, B; inputs Curve: Curve, Width: Int32, Colour: Color, Dash: String; same code as c_script

brep_38 = Brep(move_80.Geometry)  # disabled
material_27 = CreateMaterial(Diffuse="0,255,0", Specular="0,255,0", Emission="0,255,0", Transparency=Slider(0.8, range=0..1), Shine=0)
preview_37 = CustomPreview(Geometry=brep_38, Material=material_27)

c_script_47 = CSharpScript(Curve=move_78.Geometry, Width=number_slider_19, Colour="Cyan", Dash=list_42)  # -> out, A, B; inputs Curve: Curve, Width: Int32, Colour: Color, Dash: String; same code as c_script
c_script_48 = CSharpScript(Curve=move_80.Geometry, Width=number_slider_19, Colour="DeepSkyBlue", Dash=list_43)  # -> out, A, B; inputs Curve: Curve, Width: Int32, Colour: Color, Dash: String; same code as c_script

# ----
# FD-path
number_slider_31 = Slider(150, range=0..1000)
python_105 = GhPythonScript(NodeDic=python_56.NodeDic, departure="EscalatorA_L4")  # -> out, D_location; inputs NodeDic: list; same code as python_32
number_slider_32 = Slider(1, range=0..10)
number_slider_33 = Slider(0.5, range=0..1)
number_slider_34 = Slider(2, range=0..10)

num_2 = Number(Slider(32.51, range=0..1000))

python_106 = GhPythonScript(
    run=Toggle(False),
    Network=python_56.Network,
    NodeDic=python_56.NodeDic,
    allPlaces=python_56.Attri,
    walkableDistance=num_2,
    departure="EscalatorA_L4")  # -> potential_places, placesResult, sortedPlaces; inputs run: Boolean, Network: list, NodeDic: list, allPlaces: list; same code as python_76
cir_30 = Circle(Plane=python_105.D_location, Radius=num_2)
python_107 = GhPythonScript(reachablePlaces=python_106.placesResult, places=python_56.Attri, locations=python_56.Nodes)  # -> a, myReachablePlaces; inputs reachablePlaces: list, places: list, locations: list of Point3d; same code as python_77
dots_10 = DotDisplay(Point=python_107.myReachablePlaces, Colour="blue", Size=Slider(1.8, range=0..10))

python_108 = GhPythonScript(placesResult=python_106.placesResult)  # -> a; inputs placesResult: list; same code as python_33
panel_44 = Panel(python_107.a)
panel_45 = Panel(python_108)

number_slider_35 = Slider(30, range=0..1000)
python_109 = GhPythonScript(
    run=Toggle(True),
    Network=python_39.Network,
    NodeDic=python_39.NodeDic,
    allPlaces=python_39.Attri,
    walkableDistance=Slider(43.93, range=0..100),
    departure="LiftA_L5")  # -> potential_places, placesResult, sortedPlaces; inputs run: Boolean, Network: list, NodeDic: list, allPlaces: list; same code as python_30
python_110 = GhPythonScript(reachablePlaces=python_109.placesResult, places=python_39.Attri, locations=python_39.Nodes)  # -> a, myReachablePlaces; inputs reachablePlaces: list, places: list, locations: list of Point3d; same code as python_77
number_slider_36 = Slider(0.5, range=0..1)

# ----
# Path Planning with Fuzzy Destination
toggle_12 = BooleanToggle(False)
python_111 = GhPythonScript(
    run=toggle_12,
    Network=python_39.Network,
    NodeDic=python_39.NodeDic,
    allPlaces=python_39.Attri,
    walkableDistance=Slider(100, range=0..1000),
    departure="Target")  # -> reachablePlaces, validPlaces; inputs run: Boolean, Network: list, NodeDic: list, allPlaces: list
# ---------- python_111: Python ----------
import ghpythonlib.components as gc

def searchGraph(graph, start, end, costDic, walkableDistance): 
    # 搜索树
    results = []                
    generatePath(graph, [start], end, results, costDic, walkableDistance)    # 生成路径
    results.sort(key=lambda x:len(x))    # 按路径长短排序
    return results

def generatePath(graph, path, end, results, costDic, walkableDistance):
     # 生成路径
    state = path[-1]
    #print 'state = ', state
    if state == end and len(results) == 0:
        results.append(path)
        #print path
    else:
        for arc in graph[state]:
            if arc not in path: 
                tempPath = path + [arc]
                cost = 0
                for i in range(0,len(tempPath)-1):
                    cost = cost + costDic[tempPath[i]+'+'+tempPath[i+1]]
                if cost <= walkableDistance:
                    generatePath(graph, path + [arc], end, results, costDic, walkableDistance)


def findReachablePlaces(allNodes, Graph, costDic, departure, walkableDistance):
    reachableNodes = set()
    for i in range(0,len(allNodes)):
        if allNodes[i] != departure:
            path_i = searchGraph(Graph, departure,allNodes[i], costDic, walkableDistance)
            if len(path_i) != 0:
                for j in range(0,len(path_i)):
                    for k in range(0,len(path_i[j])):
                        reachableNodes.add(path_i[j][k])
    return reachableNodes

if run:
    print 'ok'

    myNodeDict = {}
    pd_distance_dic = {}
    
    for i in range (0,int(len(NodeDic)/2)):
        myNodeDict[NodeDic[2*i]] = NodeDic[2*i+1]
    for i in range(0,len(allPlaces)):
        distance = gc.Distance(myNodeDict[departure],myNodeDict[allPlaces[i]])
        if distance <= walkableDistance:
            pd_distance_dic[allPlaces[i]] = distance

    sortedPlaces = []
    sortedD =  sorted(pd_distance_dic.items(), key=lambda pd_distance_dic:pd_distance_dic[1], reverse = True)
    for i in range(0,len(sortedD)):
        sortedPlaces.append(sortedD[i][0])
    
    #print 'sortedPlaces = ', len(sortedPlaces), '---', sortedPlaces
    
    GraphDic = {}
    for i in range(0,len(sortedPlaces)):
        kidList = []
        for j in range(0,len(Network)):
            if sortedPlaces[i] == Network[j].start:
                kidList.append(Network[j].end)
        GraphDic[sortedPlaces[i]] = kidList
    
    costDic = {}
    costList = []
    for i in range(0,len(Network)):
        #costList.append([Network[i].start, Network[i].end, Network[i].cost])
        costDic[Network[i].start+'+'+Network[i].end] = Network[i].cost

    validPlaces = []
    for i in range(0,len(sortedPlaces)):
        if 'Corridor' not in sortedPlaces[i]:
            validPlaces.append(sortedPlaces[i]) 
            print sortedPlaces[i], '---', gc.Distance(myNodeDict[departure],myNodeDict[sortedPlaces[i]])
    #print 'validPlaces = ', len(validPlaces), '---', validPlaces
"""
    placesResult = set()
    for i in range(0,len(validPlaces)):
        if validPlaces[i] not in placesResult:
            reachablePlaces = findReachablePlaces(validPlaces[i], GraphDic, costDic, departure, walkableDistance)
            placesResult = placesResult.union(reachablePlaces)
            #print 'reachablePlaces = ', reachablePlaces
            #print 'placesResult.union = ', placesResult
    #print 'placesResult = ', len(allPlaces), '---', len(placesResult), placesResult
"""




"""
    print 'ok'
    
    myNodeDict = {}
    potentialDestinations = []
    
    for i in range (0,int(len(NodeDic)/2)):
        myNodeDict[NodeDic[2*i]] = NodeDic[2*i+1]
    for i in range(0,len(allPlaces)):
        distance = gc.Distance(myNodeDict[departure],myNodeDict[allPlaces[i]])
        if distance <= walkableDistance and allPlaces[i].find("Toilet") != -1:
            potentialDestinations.append(allPlaces[i])
    
    reachablePlaces = potentialDestinations
    
    GraphDic = {}
    for i in range(0,len(potentialDestinations)):
        kidList = []
        for j in range(0,len(Network)):
            if potentialDestinations[i] == Network[j].start:
                kidList.append(Network[j].end)
        GraphDic[potentialDestinations[i]] = kidList
    #print GraphDic
    
    
    costDic = {}
    costList = []
    for i in range(0,len(Network)):
        #costList.append([Network[i].start, Network[i].end, Network[i].cost])
        costDic[Network[i].start+'+'+Network[i].end] = Network[i].cost
    #print costDic
    
    
"""
    
    
    
"""
    reachablePlaces, allPath = findReachablePlaces(potentialDestinations, GraphDic, costDic, departure, walkableDistance)
    print reachablePlaces
    
    def pathLength(costDic, path, destination):
        pathLen = 0
        for i in range(0,len(path)-1):
            pathLen = pathLen + costDic[path[i]+'+'+path[i+1]]
        return pathLen
    
    paths_candidate = []
    path_candidate_len = []
    destination = 'N14'
    for i in range(0,len(allPath)):
        #print allPath[i]
        if allPath[i][-1] == destination:
            #print allPath[i]
            paths_candidate.append(allPath[i])
            path_candidate_len.append(pathLength(costDic, allPath[i], destination))
            #print pathLength(costDic, allPath[i], destination)
    
    min_index = path_candidate_len.index(min(path_candidate_len))
    print min_index
    print departure, '->' , destination, ':', paths_candidate[min_index]
    """
# ---------- end python_111 ----------
python_112 = GhPythonScript(reachablePlaces=python_109.placesResult, places=python_39.Attri, locations=python_39.Nodes)  # -> myReachablePlaces; inputs reachablePlaces: list, places: list, locations: list of Point3d
# ---------- python_112: Python ----------
import Rhino.Geometry as rg

myNodeDict = {}
Links = []

for i in range (0,len(places)):
    myNodeDict[places[i]] = locations[i]
#print myNodeDict['MyerL4']

myReachablePlaces = []
for i in range(0,len(reachablePlaces)):
    if 'Corridor' not in reachablePlaces[i]:
        myReachablePlaces.append(myNodeDict[reachablePlaces[i]])
# ---------- end python_112 ----------
dots_11 = DotDisplay(Point=python_112, Colour="red", Size=Slider(1, range=0..10))  # disabled

python_113 = GhPythonScript(NodeDic=python_39.NodeDic, departure="LiftA_L5")  # -> out, D_location; inputs NodeDic: list; disabled; same code as python_32
cir_31 = Circle(Plane=python_113.D_location, Radius=Slider(150, range=0..1000))
list_58 = ValueList({"None": "", "Dot": "0.1 1.0", "Dash": "1.0", "DashDot": "1.0 1.0 0.1 1.0"}, selected="Dash")
c_script_49 = CSharpScript(Curve=cir_31, Width=Slider(2, range=0..10), Colour="red", Dash=list_58)  # -> out, A, B; inputs Curve: Curve, Width: Int32, Colour: Color, Dash: String; same code as c_script
python_114 = GhPythonScript(placesResult=python_109.placesResult)  # -> a; inputs placesResult: list; same code as python_33
panel_46 = Panel(python_110.a)
# Level5: The Cancer Council
# Shoes & Sox
# The Trybe
# Gro Urban Oasis
# Jacobson's Jewellery
# BenchC_L5
# BenchB_L5
# Shaver Shop
# Dusk
# Joh Bailey
# EI Topo
# Le Creuset
# Leah's Wax Works
# Eckersley's Art & Craft
# Speedo
# LiftA_L5
# EscalatorA_L5
# Harry Hartog Bookseller
# Pavement
# Ripe Maternity
# ECCO
# EscalatorB_L5
# LookSmart Alterations- Level 5
# BenchA_L5
# Holistic Massage & Acupuncture
# Harper Hair
# The Body Shop
# LiftB_L5
# Adairs
# ToiletA_L5
# Kikki.K
# Body Catalyst
# Karitane
# EscalatorC_L5
# Target
# Priceline
# Haigh's Chocolates
# Shop_L5_12
# ATM_L5
# Rojank
# Adairs Kids
# EscalatorE_L5
# Boost Juice L5
# T2
# Pearl Nails
# BenchD_L5
# Vodafone
# Bang & Olufsen
# Butt Shoe Repair
# The North Face
# Sheriden
# Kidstuff
# Stokke
# Bed Bath N' Table
# EscalatorD_L5
# Bonds Kids
panel_47 = Panel(python_114)

brep_39 = Brep(cir_31)  # disabled

dots_12 = DotDisplay(Point=python_110.myReachablePlaces, Colour="blue", Size=Slider(1.9, range=0..10))

preview_38 = CustomPreview(Geometry=brep_39, Material=material_2)

number_slider_37 = Slider(150, range=0..1000)
python_115 = GhPythonScript(NodeDic=python_64.NodeDic, departure=list_26)  # -> out, D_location; inputs NodeDic: list; same code as python_32
cir_32 = Circle(Plane=python_115.D_location, Radius="32.51")
list_59 = ValueList({"None": "", "Dot": "0.1 1.0", "Dash": "1.0", "DashDot": "1.0 1.0 0.1 1.0"}, selected="Dash")
brep_40 = Brep(cir_32)  # disabled
c_script_50 = CSharpScript(Curve=cir_32, Width=Slider(3, range=0..10), Colour="red", Dash=list_59)  # -> out, A, B; inputs Curve: Curve, Width: Int32, Colour: Color, Dash: String; same code as c_script
material_28 = CreateMaterial(
    Diffuse=RGB(255, 105, 180),
    Specular=RGB(255, 255, 255),
    Emission=RGB(0, 0, 0),
    Transparency=Slider(0.9, range=0..1),
    Shine=0)
preview_39 = CustomPreview(Geometry=brep_40, Material=material_28)

python_116 = GhPythonScript(
    run=Toggle(False),
    Network=python_64.Network,
    NodeDic=python_64.NodeDic,
    allPlaces=python_64.Attri,
    walkableDistance="32.51",
    departure=list_26)  # -> potential_places, placesResult, sortedPlaces; inputs run: Boolean, Network: list, NodeDic: list, allPlaces: list
# ---------- python_116: Python ----------
from collections import deque, namedtuple
import Rhino.Geometry as rg
import ghpythonlib.components as gc
import re

# we'll use infinity as a default distance to nodes.
inf = float('inf')
Edge = namedtuple('Edge', 'start, end, cost')


def make_edge(start, end, cost=1):
  return Edge(start, end, cost)


class Graph:
    def __init__(self, edges):
        # let's check that the data is right
        wrong_edges = [i for i in edges if len(i) not in [2, 3]]
        if wrong_edges:
            raise ValueError('Wrong edges data: {}'.format(wrong_edges))

        self.edges = [make_edge(*edge) for edge in edges]
        
    @property
    def vertices(self):
        return set(
            sum(
                ([edge.start, edge.end] for edge in self.edges), []
            )
        )

    def get_node_pairs(self, n1, n2, both_ends=True):
        if both_ends:
            node_pairs = [[n1, n2], [n2, n1]]
        else:
            node_pairs = [[n1, n2]]
        return node_pairs

    def remove_edge(self, n1, n2, both_ends=True):
        node_pairs = self.get_node_pairs(n1, n2, both_ends)
        edges = self.edges[:]
        for edge in edges:
            if [edge.start, edge.end] in node_pairs:
                self.edges.remove(edge)

    def add_edge(self, n1, n2, cost=1, both_ends=True):
        node_pairs = self.get_node_pairs(n1, n2, both_ends)
        for edge in self.edges:
            if [edge.start, edge.end] in node_pairs:
                return ValueError('Edge {} {} already exists'.format(n1, n2))

        self.edges.append(Edge(start=n1, end=n2, cost=cost))
        if both_ends:
            self.edges.append(Edge(start=n2, end=n1, cost=cost))

    @property
    def neighbours(self):
        neighbours = {vertex: set() for vertex in self.vertices}
        for edge in self.edges:
            neighbours[edge.start].add((edge.end, edge.cost))

        return neighbours

    def dijkstra(self, source, dest):
        assert source in self.vertices, 'Such source node doesn\'t exist'
        distances = {vertex: inf for vertex in self.vertices}
        previous_vertices = {
            vertex: None for vertex in self.vertices
        }
        distances[source] = 0
        vertices = self.vertices.copy()

        while vertices:
            current_vertex = min(
                vertices, key=lambda vertex: distances[vertex])
            vertices.remove(current_vertex)
            if distances[current_vertex] == inf:
                break
            for neighbour, cost in self.neighbours[current_vertex]:
                alternative_route = distances[current_vertex] + cost
                if alternative_route < distances[neighbour]:
                    distances[neighbour] = alternative_route
                    previous_vertices[neighbour] = current_vertex

        path, current_vertex = deque(), dest
        if previous_vertices.has_key(current_vertex) == True:
            while previous_vertices[current_vertex] is not None:
                path.appendleft(current_vertex)
                current_vertex = previous_vertices[current_vertex]
        if path:
            path.appendleft(current_vertex)
        return path

if run:
    print 'ok'

    myNodeDict = {}
    pd_distance_dic = {}
    potential_places = []
    
    for i in range (0,int(len(NodeDic)/2)):
        myNodeDict[NodeDic[2*i]] = NodeDic[2*i+1]
    for i in range(0,len(allPlaces)):
        distance = gc.Distance(myNodeDict[departure],myNodeDict[allPlaces[i]])
        if distance <= walkableDistance:
            pd_distance_dic[allPlaces[i]] = distance
            potential_places.append(allPlaces[i])

    sortedPlaces = []
    sortedD =  sorted(pd_distance_dic.items(), key=lambda pd_distance_dic:pd_distance_dic[1], reverse = True)
    for i in range(0,len(sortedD)):
        sortedPlaces.append(sortedD[i][0])
    GraphDic = {}
    for i in range(0,len(sortedPlaces)):
        kidList = []
        for j in range(0,len(Network)):
            if sortedPlaces[i] == Network[j].start:
                kidList.append(Network[j].end)
        GraphDic[sortedPlaces[i]] = kidList
    
    costDic = {}
    costList = []
    for i in range(0,len(Network)):
        costDic[Network[i].start+'+'+Network[i].end] = Network[i].cost

    validPlaces = []
    for i in range(0,len(sortedPlaces)):
        if 'Corridor' not in sortedPlaces[i]:
            validPlaces.append(sortedPlaces[i]) 
            #print sortedPlaces[i], '---', gc.Distance(myNodeDict[departure],myNodeDict[sortedPlaces[i]])
    print len(validPlaces)
    
    def pathLength(route, myNodeDict):
        Links = []
        for i in range(0,len(route)-1):
            link = rg.Line(myNodeDict[route[i]],myNodeDict[route[i+1]])
            Links.append(link)
        if len(Links) != 0:
            R, Pr = gc.MassAddition(gc.Length(Links))
            return R
        else:
            return 0
        
    
    mygraph = Graph(Network)
    placesResult = set()
    #route = mygraph.dijkstra(departure, 'Shoes & Sox')
    #print len(route)
    
    for i in range(0,len(validPlaces)):
        if validPlaces[i] not in placesResult: #and validPlaces[i] != 'Shoes & Sox' and validPlaces[i] != 'ToiletB_L5' and validPlaces[i] != 'ToiletC_L5' and validPlaces[i] != 'Superdry':
            route = mygraph.dijkstra(departure, validPlaces[i])
            pathL = pathLength(route, myNodeDict)
            if pathL <= walkableDistance and pathL !=0:
                for j in range(1,len(route)):
                    placesResult.add(route[j])

    """"""
# ---------- end python_116 ----------
python_117 = GhPythonScript(reachablePlaces=python_116.placesResult, places=python_64.Attri, locations=python_64.Nodes)  # -> a, myReachablePlaces; inputs reachablePlaces: list, places: list, locations: list of Point3d; same code as python_31
number_slider_38 = Slider(0.5, range=0..1)
dots_13 = DotDisplay(Point=python_117.myReachablePlaces, Colour="blue", Size=Slider(1.9, range=0..10))

python_118 = GhPythonScript(placesResult=python_116.placesResult)  # -> a; inputs placesResult: list; same code as python_33
panel_48 = Panel(python_117.a)

python_119 = GhPythonScript(
    run=Toggle(False),
    Network=python_48.Network,
    NodeDic=python_48.NodeDic,
    allPlaces=python_48.Attri,
    walkableDistance=Slider(150, range=0..1000),
    departure="Fone King")  # -> potential_places, placesResult, sortedPlaces; inputs run: Boolean, Network: list, NodeDic: list, allPlaces: list; same code as python_30
python_120 = GhPythonScript(reachablePlaces=python_119.placesResult, places=python_48.Attri, locations=python_48.Nodes)  # -> a, myReachablePlaces; inputs reachablePlaces: list, places: list, locations: list of Point3d; same code as python_31
number_slider_39 = Slider(0.5, range=0..1)

python_121 = GhPythonScript(NodeDic=python_48.NodeDic, departure="Fone King")  # -> out, D_location; inputs NodeDic: list; same code as python_32
cir_33 = Circle(Plane=python_121.D_location, Radius=Slider(150, range=0..1000))
list_60 = ValueList({"None": "", "Dot": "0.1 1.0", "Dash": "1.0", "DashDot": "1.0 1.0 0.1 1.0"}, selected="Dash")
brep_41 = Brep(cir_33)  # disabled
c_script_51 = CSharpScript(Curve=cir_33, Width=Slider(0, range=0..10), Colour="red", Dash=list_60)  # -> out, A, B; inputs Curve: Curve, Width: Int32, Colour: Color, Dash: String; same code as c_script
material_29 = CreateMaterial(
    Diffuse=RGB(255, 105, 180),
    Specular=RGB(255, 255, 255),
    Emission=RGB(0, 0, 0),
    Transparency=Slider(0.9, range=0..1),
    Shine=0)
python_122 = GhPythonScript(placesResult=python_119.placesResult)  # -> a; inputs placesResult: list; same code as python_33
preview_40 = CustomPreview(Geometry=brep_41, Material=material_29)
panel_49 = Panel(python_120.a)

dots_14 = DotDisplay(Point=python_120.myReachablePlaces, Colour="blue", Size=Slider(1.9, range=0..10))

circle_6 = Circle(cir_33)
move_82 = Move(Geometry=circle_6, Motion=Y_2)  # -> Geometry, Transform
brep_42 = Brep(move_82.Geometry)  # disabled
c_script_52 = CSharpScript(Curve=move_82.Geometry, Width=number_slider_19, Colour="green", Dash=list_40)  # -> out, A, B; inputs Curve: Curve, Width: Int32, Colour: Color, Dash: String; same code as c_script
preview_41 = CustomPreview(Geometry=brep_42, Material=material_3)

# ----
# Old version
# Lobster Tail Seafood Restaurant
path_47 = FilePath("E:\00 - Workdata of Research\01 - Paper writting\03 - Personalized Pedestrian Navigation Path Options\03 - Bondi Junction\Version 2\02 - ShapeFiles\L5 new\POIs.shp")
path_48 = FilePath("E:\00 - Workdata of Research\01 - Paper writting\03 - Personalized Pedestrian Navigation Path Options\03 - Bondi Junction\Version 2\02 - ShapeFiles\L5\L5_corridor.shp")
toggle_13 = BooleanToggle(True)
X_10 = UnitX(Factor=Slider(400, range=0..1000))
number_slider_40 = Slider(0.5, range=0..1)
panel_50 = Panel("Pochana")

# ----
# Level 6
toggle_14 = BooleanToggle(False)
path_49 = FilePath("E:\00 - Workdata of Research\01 - Paper writting\03 - Personalized Pedestrian Navigation Path Options\03 - Bondi Junction\Version 2\02 - ShapeFiles\L6\L6_QRTags_Add.shp")
path_50 = FilePath("E:\00 - Workdata of Research\01 - Paper writting\03 - Personalized Pedestrian Navigation Path Options\03 - Bondi Junction\Version 2\02 - ShapeFiles\L6\L6_QRTags.shp")
path_51 = FilePath("E:\00 - Workdata of Research\01 - Paper writting\03 - Personalized Pedestrian Navigation Path Options\03 - Bondi Junction\Version 2\02 - ShapeFiles\L6\L6_shop.shp")
path_52 = FilePath("E:\00 - Workdata of Research\01 - Paper writting\03 - Personalized Pedestrian Navigation Path Options\03 - Bondi Junction\Version 2\02 - ShapeFiles\L6\L6_corridor_holes.shp")
path_53 = FilePath("E:\00 - Workdata of Research\01 - Paper writting\03 - Personalized Pedestrian Navigation Path Options\03 - Bondi Junction\Version 2\02 - ShapeFiles\L6\L6_corridor.shp")
shp_import_47 = ShapefileImport(path=path_51, read_geometry=toggle_14, read_records=toggle_14)  # -> out, shape_type, flatten(geometry), fields, field_names, flatten(records); inputs path: tree, read_geometry: tree of Boolean, read_records: tree of Boolean, field_ids: tree, enc: tree; same code as shp_import
shp_import_48 = ShapefileImport(path=path_50, read_geometry=toggle_14, read_records=toggle_14)  # -> out, shape_type, flatten(geometry), fields, field_names, flatten(records); inputs path: tree, read_geometry: tree of Boolean, read_records: tree of Boolean, field_ids: tree, enc: tree; same code as shp_import
shp_import_49 = ShapefileImport(path=path_52, read_geometry=toggle_14, read_records=toggle_14)  # -> out, shape_type, flatten(geometry), fields, field_names, flatten(records); inputs path: tree, read_geometry: tree of Boolean, read_records: tree of Boolean, field_ids: tree, enc: tree; same code as shp_import
shp_import_50 = ShapefileImport(path=path_53, read_geometry=toggle_14, read_records=toggle_14)  # -> out, shape_type, flatten(geometry), fields, field_names, flatten(records); inputs path: tree, read_geometry: tree of Boolean, read_records: tree of Boolean, field_ids: tree, enc: tree; same code as shp_import
shp_import_51 = ShapefileImport(path=path_49, read_geometry=toggle_13, read_records=toggle_13)  # -> out, shape_type, flatten(geometry), fields, field_names, flatten(records); inputs path: tree, read_geometry: tree of Boolean, read_records: tree of Boolean, field_ids: tree, enc: tree; same code as shp_import
python_123 = GhPythonScript(deltaZ=Slider(0, range=0..10), x=shp_import_50.geometry)  # -> allV, deltaX, deltaY, myMove; inputs x: list of Brep; same code as python_10
movevector_15 = Vector(python_123.myMove)
move_83 = Move(Geometry=shp_import_50.geometry, Motion=movevector_15)  # -> Geometry, Transform
move_84 = Move(Geometry=shp_import_49.geometry, Motion=movevector_15)  # -> Geometry, Transform
move_85 = Move(Geometry=shp_import_47.geometry, Motion=movevector_15)  # -> Geometry, Transform
move_86 = Move(Geometry=shp_import_48.geometry, Motion=movevector_15)  # -> Geometry, Transform
move_87 = Move(Geometry=shp_import_51.geometry, Motion=movevector_15)  # -> Geometry, Transform
qrtagaddattri_5 = Text(shp_import_51.records)
qrtagoriattri_5 = Text(shp_import_48.records)
qrtagadd_5 = Point(move_87.Geometry)
qrtagori_5 = Point(move_86.Geometry)
holes_5 = Curve([move_84.Geometry, move_85.Geometry])
shops_5 = Curve(move_85.Geometry)
crv_15 = Curve(move_83.Geometry)
python_124 = GhPythonScript(deltaX=Slider(420, range=-1000..10000), deltaY=Slider(710, range=0..10000), deltaZ=Slider(250, range=0..500))  # -> out, myMove; same code as python
movevector_16 = Vector(python_124.myMove)
move_88 = Move(Geometry=crv_15, Motion=movevector_16)  # -> Geometry, Transform
move_89 = Move(Geometry=shops_5, Motion=movevector_16)  # -> Geometry, Transform
move_90 = Move(Geometry=qrtagori_5, Motion=movevector_16)  # -> Geometry, Transform
move_91 = Move(Geometry=qrtagadd_5, Motion=movevector_16)  # -> Geometry, Transform
move_92 = Move(Geometry=holes_5, Motion=movevector_16)  # -> Geometry, Transform
qr_tags_add_5 = Point(move_91.Geometry)
holes_shops_5 = Curve(move_92.Geometry)
qr_tags_5 = Point(move_90.Geometry)
corridor_5 = Curve(move_88.Geometry)
duppt_5 = RemoveDuplicatePts(Points=[qr_tags_5, qr_tags_add_5], Tolerance=0.01)
voronoi_11 = Voronoi(Points=duppt_5, BruteForceOverride=False)
rint_11 = RegionIntersection(CurvesA=voronoi_11, CurvesB=corridor_5)
rdiff_11 = RegionDifference(CurvesA=rint_11, CurvesB=holes_shops_5)
python_125 = GhPythonScript(
    run=Toggle(True),
    shops=move_89.Geometry,
    shopAttri=shp_import_47.records,
    otherSpaces=rdiff_11,
    QRtagsOri=qr_tags_5,
    QRTagOriAttri=qrtagoriattri_5,
    QRtagsAdd=qr_tags_add_5,
    QRTagAddAttri=qrtagaddattri_5,
    level=Slider(6, range=1..6))  # -> Network, NodeDic, Nodes, Links, Attri; inputs run: Boolean, shops: list of Curve, shopAttri: list, otherSpaces: list of Curve, QRtagsOri: list of Point3d, QRTagOriAttri: list, QRtagsAdd: list of Point3d, QRTagAddAttri: list, level: Int32; same code as python_12

dots_15 = DotDisplay(Colour="0,255,0", Size=number_slider_40)

# ----
# Level 5
toggle_15 = BooleanToggle(False)
path_54 = FilePath("E:\00 - Workdata of Research\01 - Paper writting\03 - Personalized Pedestrian Navigation Path Options\03 - Bondi Junction\Version 2\02 - ShapeFiles\L5 new Update\Corridor.shp")
path_55 = FilePath("E:\00 - Workdata of Research\01 - Paper writting\03 - Personalized Pedestrian Navigation Path Options\03 - Bondi Junction\Version 2\02 - ShapeFiles\L5\L5_QRTags_Add.shp")
path_56 = FilePath("E:\00 - Workdata of Research\01 - Paper writting\03 - Personalized Pedestrian Navigation Path Options\03 - Bondi Junction\Version 2\02 - ShapeFiles\L5\L5_QRTags.shp")
path_57 = FilePath("E:\00 - Workdata of Research\01 - Paper writting\03 - Personalized Pedestrian Navigation Path Options\03 - Bondi Junction\Version 2\02 - ShapeFiles\L5 new Update\Atriums.shp")
path_58 = FilePath("E:\00 - Workdata of Research\01 - Paper writting\03 - Personalized Pedestrian Navigation Path Options\03 - Bondi Junction\Version 2\02 - ShapeFiles\L5 new Update\shops.shp")
shp_import_52 = ShapefileImport(path=path_58, read_geometry=toggle_15, read_records=toggle_15)  # -> out, shape_type, flatten(geometry), fields, field_names, flatten(records); inputs path: tree, read_geometry: tree of Boolean, read_records: tree of Boolean, field_ids: tree, enc: tree; same code as shp_import
shp_import_53 = ShapefileImport(path=path_56, read_geometry=toggle_15, read_records=toggle_15)  # -> out, shape_type, flatten(geometry), fields, field_names, flatten(records); inputs path: tree, read_geometry: tree of Boolean, read_records: tree of Boolean, field_ids: tree, enc: tree; same code as shp_import
shp_import_54 = ShapefileImport(path=path_57, read_geometry=toggle_15, read_records=toggle_15)  # -> out, shape_type, flatten(geometry), fields, field_names, flatten(records); inputs path: tree, read_geometry: tree of Boolean, read_records: tree of Boolean, field_ids: tree, enc: tree; same code as shp_import
shp_import_55 = ShapefileImport(path=path_55, read_geometry=toggle_15, read_records=toggle_15)  # -> out, shape_type, flatten(geometry), fields, field_names, flatten(records); inputs path: tree, read_geometry: tree of Boolean, read_records: tree of Boolean, field_ids: tree, enc: tree; same code as shp_import
shp_import_56 = ShapefileImport(path=path_54, read_geometry=toggle_15, read_records=toggle_15)  # -> out, shape_type, flatten(geometry), fields, field_names, flatten(records); inputs path: tree, read_geometry: tree of Boolean, read_records: tree of Boolean, field_ids: tree, enc: tree; same code as shp_import
python_126 = GhPythonScript(deltaZ=Slider(0, range=0..10), x=shp_import_56.geometry)  # -> allV, deltaX, deltaY, myMove; inputs x: list of Brep; same code as python_10
movevector_17 = Vector(python_126.myMove)
move_93 = Move(Geometry=shp_import_56.geometry, Motion=movevector_17)  # -> Geometry, Transform
move_94 = Move(Geometry=shp_import_54.geometry, Motion=movevector_17)  # -> Geometry, Transform
move_95 = Move(Geometry=shp_import_52.geometry, Motion=movevector_17)  # -> Geometry, Transform
move_96 = Move(Geometry=shp_import_55.geometry, Motion=movevector_17)  # -> Geometry, Transform
qrtagaddattri_6 = Text(shp_import_55.records)
qrtagadd_6 = Point(move_96.Geometry)
holes_6 = Curve([move_94.Geometry, move_95.Geometry])
shops_6 = Curve(move_95.Geometry)
crv_16 = Curve(move_93.Geometry)
python_127 = GhPythonScript(deltaX=Slider(505, range=-1000..10000), deltaY=Slider(520, range=0..10000), deltaZ=Slider(200, range=0..500))  # -> out, myMove; same code as python
movevector_18 = Vector(python_127.myMove)
move_97 = Move(Geometry=crv_16, Motion=movevector_18)  # -> Geometry, Transform
move_98 = Move(Geometry=shops_6, Motion=movevector_18)  # -> Geometry, Transform
move_99 = Move(Geometry=qrtagadd_6, Motion=movevector_18)  # -> Geometry, Transform
move_100 = Move(Geometry=holes_6, Motion=movevector_18)  # -> Geometry, Transform
qr_tags_add_6 = Point(move_99.Geometry)
holes_shops_6 = Curve(move_100.Geometry)
corridor_6 = Curve(move_97.Geometry)

# ---- group: Curve Visulization
crv_17 = Curve([holes_shops_6, corridor_6])
X_11 = UnitX(Factor=Slider(400, range=0..1000))
move_101 = Move(Geometry=crv_17, Motion=X_11)  # -> Geometry, Transform
list_61 = ValueList({"None": "", "Dot": "0.1 1.0", "Dash": "1.0", "DashDot": "1.0 1.0 0.1 1.0"}, selected="None")
c_script_53 = CSharpScript(Curve=move_101.Geometry, Width=Slider(1, range=0..10), Colour="black", Dash=list_61)  # -> out, A, B; inputs Curve: Curve, Width: Int32, Colour: Color, Dash: String; same code as c_script

# ----
shp_import_57 = ShapefileImport(path=path_47, read_geometry=toggle_15, read_records=toggle_15)  # -> out, shape_type, flatten(geometry), fields, field_names, flatten(records); inputs path: tree, read_geometry: tree of Boolean, read_records: tree of Boolean, field_ids: tree, enc: tree; same code as shp_import
panel_51 = Panel(path_58)
shp_import_58 = ShapefileImport(path=path_48, read_geometry=toggle_15, read_records=toggle_15)  # -> out, shape_type, flatten(geometry), fields, field_names, flatten(records); inputs path: tree, read_geometry: tree of Boolean, read_records: tree of Boolean, field_ids: tree, enc: tree; same code as shp_import
python_128 = GhPythonScript(x=shp_import_51.records)  # -> out, a; inputs x: list
# ---------- python_128: Python ----------
a = [None]*len(x)
# ---------- end python_128 ----------
move_102 = Move(Geometry=shp_import_58.geometry, Motion=movevector_17)  # -> Geometry, Transform
panel_52 = Panel(python_128.a)
move_103 = Move(Geometry=move_102.Geometry, Motion=movevector_18)  # -> Geometry, Transform
move_104 = Move(Geometry=move_94.Geometry, Motion=movevector_18)  # -> Geometry, Transform
python_129 = GhPythonScript(run=Toggle(False), corridor=crv_16, rooms=move_95.Geometry)  # -> out, allinter, allIntermiddlePoints, flatten(QRcodes); inputs corridor: Brep, rooms: list of Brep
# ---------- python_129: Python ----------
import ghpythonlib.components as gc
import Rhino.Geometry as rg
import scriptcontext as sc
import math


def getIntersectionPoints(curveA, curveB):
    tol = sc.doc.ModelAbsoluteTolerance
    FA, EA, VA = gc.DeconstructBrep(curveA)
    FB, EB, VB = gc.DeconstructBrep(curveB)
    
    interPoints = []
    R = 1
    
    for i in range(0,len(VA)):
        for j in range(0,len(VB)):
            if gc.Distance(VA[i],VB[j])<tol:
                
                circleA = rg.Circle(VA[i], R)
                AreaA, centroidA = gc.Area(gc.RegionIntersection(circleA, curveA))
                AreaB, centroidB = gc.Area(gc.RegionIntersection(circleA, curveB))
                
                if abs(AreaA + AreaB - math.pi*R*R) > tol:
                    interPoints.append(VA[i])
                break
                
    return interPoints


def getIntermiddlePoints(points,d):
    a = points[0]
    b = points[1]
    
    if a.X-b.X == 0:
        p1 = rg.Point3d(a.X+d,(a.Y+b.Y)/2,0)
        p1 = rg.Point3d(a.X-d,(a.Y+b.Y)/2,0)
        
    else:
        k = (a.Y-b.Y)/(a.X-b.X)
        
        x0 = (a.X + b.X)/2
        y0 = (a.Y + b.Y)/2
        
        myX0 = x0+k*d*(math.sqrt(1/(k*k+1)))
        myY0 = y0-d*(math.sqrt(1/(k*k+1)))
        
        myX1 = x0-k*d*(math.sqrt(1/(k*k+1)))
        myY1 = y0+d*(math.sqrt(1/(k*k+1)))
        
        p1 = rg.Point3d(myX0,myY0,0)
        p2 = rg.Point3d(myX1,myY1,0)
    return p1,p2

def isPointInsideBrep(point, brep):
    point_temp1 = rg.Point3d(point.X, point.Y, point.Z+20)
    point_temp2 = rg.Point3d(point.X, point.Y, point.Z-20)
    line_temp = rg.Line(point_temp1,point_temp2)
    
    interCurve, points = gc.BrepXLine(brep,line_temp)
    if points!= None:
        return True
    else:
        return False


allinter = []
allIntermiddlePoints = []
QRcodes = []

if run:
    
    d = 1
    
    for i in range(0,len(rooms)):
        interPoints = getIntersectionPoints(corridor, rooms[i])
        if len(interPoints)!=0:
            allinter.append(interPoints[0])
            allinter.append(interPoints[1])
            p1,p2 = getIntermiddlePoints(interPoints,d)
            
            allIntermiddlePoints.append(p1)
            allIntermiddlePoints.append(p2)
            
            if isPointInsideBrep(p1, rooms[i]):
                QRcodes.append(p2)
            else:
                QRcodes.append(p1)
# ---------- end python_129 ----------
pt_20 = Point(python_129.QRcodes)
crv_18 = Curve(holes_shops_6)
move_105 = Move(Geometry=corridor_6, Motion=X_10)  # -> Geometry, Transform
voronoi_12 = Voronoi(Points=pt_20, BruteForceOverride=False)
rint_12 = RegionIntersection(CurvesA=voronoi_12, CurvesB=move_102.Geometry)
rdiff_12 = RegionDifference(CurvesA=rint_12, CurvesB=holes_6)

move_106 = Move(Geometry=[shp_import_53.geometry, shp_import_57.geometry], Motion=movevector_17)  # -> Geometry, Transform
qrtagoriattri_6 = Text([shp_import_53.records, shp_import_57.records])
qrtagori_6 = Point(move_106.Geometry)
move_107 = Move(Geometry=qrtagori_6, Motion=movevector_18)  # -> Geometry, Transform
qr_tags_6 = Point(move_107.Geometry)
duppt_6 = RemoveDuplicatePts(Points=[qr_tags_6, qr_tags_add_6], Tolerance=0.01)
voronoi_13 = Voronoi(Points=duppt_6, BruteForceOverride=False)
rint_13 = RegionIntersection(CurvesA=voronoi_13, CurvesB=corridor_6)

rint_14 = RegionIntersection(CurvesA=voronoi_13, CurvesB=move_103.Geometry)
move_108 = Move(Geometry=qr_tags_6, Motion=X_10)  # -> Geometry, Transform
cir_34 = Circle(Plane=move_108.Geometry, Radius=number_slider_40)  # disabled

rdiff_13 = RegionDifference(CurvesA=rint_14, CurvesB=holes_shops_6)
python_130 = GhPythonScript(
    run=Toggle(False),
    shops=move_98.Geometry,
    shopAttri=shp_import_52.records,
    otherSpaces=rdiff_13,
    QRtagsOri=qr_tags_6,
    QRTagOriAttri=qrtagoriattri_6,
    QRtagsAdd=qr_tags_add_6,
    QRTagAddAttri=qrtagaddattri_6,
    level=Slider(5, range=1..6))  # -> Network, NodeDic, Nodes, Links, Attri; inputs run: Boolean, shops: list of Curve, shopAttri: list, otherSpaces: list of Curve, QRtagsOri: list of Point3d, QRTagOriAttri: list, QRtagsAdd: list of Point3d, QRTagAddAttri: list, level: Int32; same code as python_12

# ---- group: Navigation Test
python_131 = GhPythonScript(
    run=Toggle(False),
    Network=python_130.Network,
    NodeDic=python_130.NodeDic,
    departure="Myer L5",
    destination="Gro Urban Oasis")  # -> route, NodeDic; inputs run: Boolean, Network: list, NodeDic: list; same code as python_28
python_132 = GhPythonScript(run=Toggle(True), route=python_131.route, NodeDic=python_131.NodeDic)  # -> out, Links; inputs run: Boolean, route: list, NodeDic: list; same code as python_29
X_12 = UnitX(Factor=Slider(400, range=-101..1000))
list_62 = ValueList({"None": "", "Dot": "0.1 1.0", "Dash": "1.0", "DashDot": "1.0 1.0 0.1 1.0"}, selected="None")
move_109 = Move(Geometry=python_132.Links, Motion=X_12)  # -> Geometry, Transform
c_script_54 = CSharpScript(Curve=move_109.Geometry, Width=Slider(3, range=0..10), Colour="0,0,255", Dash=list_62)  # -> out, A, B; inputs Curve: Curve, Width: Int32, Colour: Color, Dash: String; same code as c_script

# ----
list_63 = ValueList({"All": 0, "Lift + Escalator": 1, "Lift only": 2}, selected="Lift only")
python_133 = GhPythonScript(
    run=Toggle(False),
    NetworkL1=python_21.Network,
    NetworkL2=python_15.Network,
    NetworkL3=python_18.Network,
    NetworkL4=python_12.Network,
    NetworkL5=python_130.Network,
    NetworkL6=python_125.Network,
    NodeDicL1=python_21.NodeDic,
    NodeDicL2=python_15.NodeDic,
    NodeDicL3=python_18.NodeDic,
    NodeDicL4=python_12.NodeDic,
    NodeDicL5=python_130.NodeDic,
    NodeDicL6=python_125.NodeDic,
    departure="Coles",
    destination="Fitness First",
    flag=list_63)  # -> Network, NodeDic, route, Transition_links; inputs run: Boolean, NetworkL1: list, NetworkL2: list, NetworkL3: list, NetworkL4: list, NetworkL5: list, NetworkL6: list, NodeDicL1: list, NodeDicL2: list, NodeDicL3: list, NodeDicL4: list, NodeDicL5: list, NodeDicL6: list, flag: Int32
# ---------- python_133: Python ----------
from collections import deque, namedtuple
import Rhino.Geometry as rg
import ghpythonlib.components as gc
import re

# we'll use infinity as a default distance to nodes.
inf = float('inf')
Edge = namedtuple('Edge', 'start, end, cost')


def make_edge(start, end, cost=1):
  return Edge(start, end, cost)


class Graph:
    def __init__(self, edges):
        # let's check that the data is right
        wrong_edges = [i for i in edges if len(i) not in [2, 3]]
        if wrong_edges:
            raise ValueError('Wrong edges data: {}'.format(wrong_edges))

        self.edges = [make_edge(*edge) for edge in edges]
        
    @property
    def vertices(self):
        return set(
            sum(
                ([edge.start, edge.end] for edge in self.edges), []
            )
        )

    def get_node_pairs(self, n1, n2, both_ends=True):
        if both_ends:
            node_pairs = [[n1, n2], [n2, n1]]
        else:
            node_pairs = [[n1, n2]]
        return node_pairs

    def remove_edge(self, n1, n2, both_ends=True):
        node_pairs = self.get_node_pairs(n1, n2, both_ends)
        edges = self.edges[:]
        for edge in edges:
            if [edge.start, edge.end] in node_pairs:
                self.edges.remove(edge)

    def add_edge(self, n1, n2, cost=1, both_ends=True):
        node_pairs = self.get_node_pairs(n1, n2, both_ends)
        for edge in self.edges:
            if [edge.start, edge.end] in node_pairs:
                return ValueError('Edge {} {} already exists'.format(n1, n2))

        self.edges.append(Edge(start=n1, end=n2, cost=cost))
        if both_ends:
            self.edges.append(Edge(start=n2, end=n1, cost=cost))

    @property
    def neighbours(self):
        neighbours = {vertex: set() for vertex in self.vertices}
        for edge in self.edges:
            neighbours[edge.start].add((edge.end, edge.cost))

        return neighbours

    def dijkstra(self, source, dest):
        assert source in self.vertices, 'Such source node doesn\'t exist'
        distances = {vertex: inf for vertex in self.vertices}
        previous_vertices = {
            vertex: None for vertex in self.vertices
        }
        distances[source] = 0
        vertices = self.vertices.copy()

        while vertices:
            current_vertex = min(
                vertices, key=lambda vertex: distances[vertex])
            vertices.remove(current_vertex)
            if distances[current_vertex] == inf:
                break
            for neighbour, cost in self.neighbours[current_vertex]:
                alternative_route = distances[current_vertex] + cost
                if alternative_route < distances[neighbour]:
                    distances[neighbour] = alternative_route
                    previous_vertices[neighbour] = current_vertex

        path, current_vertex = deque(), dest
        while previous_vertices[current_vertex] is not None:
            path.appendleft(current_vertex)
            current_vertex = previous_vertices[current_vertex]
        if path:
            path.appendleft(current_vertex)
        return path

def Transition(NodeDic):
    
    myNodeDict = {}
    for i in range (0,int(len(NodeDic)/2)):
        myNodeDict[NodeDic[2*i]] = NodeDic[2*i+1]
    
    Transition_Network = []
    Transition_links = []
    
    Lift_Network = []
    Escalator_Network = []
    Stair_Network = []
    
    # Level 5 to Level 6
    edge_L5_L6_Lift1 = make_edge("LiftB_L5", "LiftB_L6", 100)
    edge_L6_L5_Lift1  = make_edge("LiftB_L6", "LiftB_L5", 100)
    Transition_links.append(rg.Line(myNodeDict["LiftB_L5"],myNodeDict["LiftB_L6"]))
    
    edge_L5_L6_Lift2 = make_edge("LiftC_L5", "LiftA_L6", 100)
    edge_L6_L5_Lift2  = make_edge("LiftA_L6", "LiftC_L5", 100)
    Transition_links.append(rg.Line(myNodeDict["LiftC_L5"],myNodeDict["LiftA_L6"]))
    
    edge_L5_L6_Escalator1= make_edge("EscalatorA_L5", "EscalatorE_L6", 100)
    edge_L6_L5_Escalator1= make_edge("EscalatorE_L6", "EscalatorA_L5", 100)
    Transition_links.append(rg.Line(myNodeDict["EscalatorE_L6"],myNodeDict["EscalatorA_L5"]))
    
    edge_L5_L6_Escalator2= make_edge("EscalatorD_L5", "EscalatorF_L6", 100)
    edge_L6_L5_Escalator2= make_edge("EscalatorF_L6", "EscalatorD_L5", 100)
    Transition_links.append(rg.Line(myNodeDict["EscalatorD_L5"],myNodeDict["EscalatorF_L6"]))
    
    edge_L5_L6_Escalator3= make_edge("EscalatorF_L5", "EscalatorC_L6", 100)
    edge_L6_L5_Escalator3= make_edge("EscalatorC_L6", "EscalatorF_L5", 100)
    Transition_links.append(rg.Line(myNodeDict["EscalatorC_L6"],myNodeDict["EscalatorF_L5"]))
    
    edge_L5_L6_Escalator4= make_edge("EscalatorC_L5", "EscalatorB_L6", 100)
    edge_L6_L5_Escalator4= make_edge("EscalatorB_L6", "EscalatorC_L5", 100)
    Transition_links.append(rg.Line(myNodeDict["EscalatorB_L6"],myNodeDict["EscalatorC_L5"]))
    
    Lift_Network.append(edge_L5_L6_Lift1)
    Lift_Network.append(edge_L6_L5_Lift1)
    Lift_Network.append(edge_L5_L6_Lift2)
    Lift_Network.append(edge_L6_L5_Lift2)
    Escalator_Network.append(edge_L5_L6_Escalator1)
    Escalator_Network.append(edge_L6_L5_Escalator1)
    Escalator_Network.append(edge_L5_L6_Escalator2)
    Escalator_Network.append(edge_L6_L5_Escalator2)
    Escalator_Network.append(edge_L5_L6_Escalator3)
    Escalator_Network.append(edge_L6_L5_Escalator3)
    Escalator_Network.append(edge_L5_L6_Escalator4)
    Escalator_Network.append(edge_L6_L5_Escalator4)
    
    # Level 4 to Level 5
    edge_L4_L5_Lift1 = make_edge("LiftA_L5", "LiftC_L4", 100)
    edge_L5_L4_Lift1  = make_edge("LiftC_L4", "LiftA_L5", 100)
    Transition_links.append(rg.Line(myNodeDict["LiftA_L5"],myNodeDict["LiftC_L4"]))
    
    edge_L4_L5_Lift2 = make_edge("LiftB_L5", "LiftB_L4", 100)
    edge_L5_L4_Lift2  = make_edge("LiftB_L4", "LiftB_L5", 100)
    Transition_links.append(rg.Line(myNodeDict["LiftB_L5"],myNodeDict["LiftB_L4"]))
    
    edge_L4_L5_Lift3 = make_edge("LiftC_L5", "LiftA_L4", 100)
    edge_L5_L4_Lift3  = make_edge("LiftA_L4", "LiftC_L5", 100)
    Transition_links.append(rg.Line(myNodeDict["LiftC_L5"],myNodeDict["LiftA_L4"]))
    
    edge_L4_L5_Escalator1= make_edge("EscalatorC_L4", "EscalatorB_L5", 100)
    edge_L5_L4_Escalator1= make_edge("EscalatorB_L5", "EscalatorC_L4", 100)
    Transition_links.append(rg.Line(myNodeDict["EscalatorC_L4"],myNodeDict["EscalatorB_L5"]))

    edge_L4_L5_Escalator2= make_edge("EscalatorF_L4", "EscalatorF_L5", 100)
    edge_L5_L4_Escalator2= make_edge("EscalatorF_L5", "EscalatorF_L4", 100)
    Transition_links.append(rg.Line(myNodeDict["EscalatorF_L4"],myNodeDict["EscalatorF_L5"]))
    
    edge_L4_L5_Escalator3= make_edge("EscalatorA_L4", "EscalatorD_L5",100)
    edge_L5_L4_Escalator3= make_edge("EscalatorD_L5", "EscalatorA_L4",100)
    Transition_links.append(rg.Line(myNodeDict["EscalatorA_L4"],myNodeDict["EscalatorD_L5"]))
    
    Lift_Network.append(edge_L4_L5_Lift1)
    Lift_Network.append(edge_L5_L4_Lift1)
    Lift_Network.append(edge_L4_L5_Lift2)
    Lift_Network.append(edge_L5_L4_Lift2)
    Lift_Network.append(edge_L4_L5_Lift3)
    Lift_Network.append(edge_L5_L4_Lift3)
    Escalator_Network.append(edge_L4_L5_Escalator1)
    Escalator_Network.append(edge_L5_L4_Escalator1)
    Escalator_Network.append(edge_L4_L5_Escalator2)
    Escalator_Network.append(edge_L5_L4_Escalator2)
    Escalator_Network.append(edge_L4_L5_Escalator3)
    Escalator_Network.append(edge_L5_L4_Escalator3)
    
    # Level 3 to Level 4
    edge_L4_L3_Lift1 = make_edge("LiftA_L3", "LiftA_L4", 100)
    edge_L3_L4_Lift1  = make_edge("LiftA_L4", "LiftA_L3", 100)
    Transition_links.append(rg.Line(myNodeDict["LiftA_L3"],myNodeDict["LiftA_L4"]))
    
    edge_L4_L3_Lift2 = make_edge("LiftB_L3", "LiftB_L4", 100)
    edge_L3_L4_Lift2  = make_edge("LiftB_L4", "LiftB_L3", 100)
    Transition_links.append(rg.Line(myNodeDict["LiftB_L3"],myNodeDict["LiftB_L4"]))
    
    edge_L4_L3_Lift3 = make_edge("LiftC_L3", "LiftC_L4", 100)
    edge_L3_L4_Lift3  = make_edge("LiftC_L4", "LiftC_L3", 100)
    Transition_links.append(rg.Line(myNodeDict["LiftC_L3"],myNodeDict["LiftC_L4"]))
    
    edge_L4_L3_Escalator1= make_edge("EscalatorC_L4", "EscalatorF_L3", 100)
    edge_L3_L4_Escalator1= make_edge("EscalatorF_L3", "EscalatorC_L4", 100)
    Transition_links.append(rg.Line(myNodeDict["EscalatorC_L4"],myNodeDict["EscalatorF_L3"]))

    edge_L4_L3_Escalator2= make_edge("EscalatorD_L3", "EscalatorB_L4", 100)
    edge_L3_L4_Escalator2= make_edge("EscalatorB_L4", "EscalatorD_L3", 100)
    Transition_links.append(rg.Line(myNodeDict["EscalatorD_L3"],myNodeDict["EscalatorB_L4"]))
    
    edge_L4_L3_Escalator3= make_edge("EscalatorE_L3", "EscalatorA_L4",100)
    edge_L3_L4_Escalator3= make_edge("EscalatorA_L4", "EscalatorE_L3",100)
    Transition_links.append(rg.Line(myNodeDict["EscalatorA_L4"],myNodeDict["EscalatorE_L3"]))
    
    edge_L4_L3_Escalator4= make_edge("EscalatorB_L3", "EscalatorD_L4",100)
    edge_L3_L4_Escalator4= make_edge("EscalatorD_L4", "EscalatorB_L3",100)
    Transition_links.append(rg.Line(myNodeDict["EscalatorB_L3"],myNodeDict["EscalatorD_L4"]))
    
    Lift_Network.append(edge_L4_L3_Lift1)
    Lift_Network.append(edge_L3_L4_Lift1)
    Lift_Network.append(edge_L4_L3_Lift2)
    Lift_Network.append(edge_L3_L4_Lift3)
    Lift_Network.append(edge_L4_L3_Lift3)
    Lift_Network.append(edge_L3_L4_Lift3)
    
    Escalator_Network.append(edge_L4_L3_Escalator1)
    Escalator_Network.append(edge_L3_L4_Escalator1)
    Escalator_Network.append(edge_L4_L3_Escalator2)
    Escalator_Network.append(edge_L3_L4_Escalator2)
    Escalator_Network.append(edge_L4_L3_Escalator3)
    Escalator_Network.append(edge_L3_L4_Escalator3)
    Escalator_Network.append(edge_L4_L3_Escalator4)
    Escalator_Network.append(edge_L3_L4_Escalator4)
    
    # Level 2 to Level 3
    edge_L2_L3_Lift1 = make_edge("LiftA_L2", "LiftB_L3", 100)
    edge_L3_L2_Lift1  = make_edge("LiftB_L3", "LiftA_L2", 100)
    Transition_links.append(rg.Line(myNodeDict["LiftA_L2"],myNodeDict["LiftB_L3"]))
    
    edge_L2_L3_Lift2 = make_edge("LiftB_L2", "LiftC_L3", 100)
    edge_L3_L2_Lift2  = make_edge("LiftC_L3", "LiftB_L2", 100)
    Transition_links.append(rg.Line(myNodeDict["LiftC_L3"],myNodeDict["LiftB_L2"]))
    
    edge_L2_L3_Escalator1= make_edge("EscalatorB_L2", "EscalatorF_L3", 100)
    edge_L3_L2_Escalator1= make_edge("EscalatorF_L3", "EscalatorB_L2", 100)
    Transition_links.append(rg.Line(myNodeDict["EscalatorB_L2"],myNodeDict["EscalatorF_L3"]))
    
    edge_L2_L3_Escalator2= make_edge("EscalatorA_L2", "EscalatorD_L3", 100)
    edge_L3_L2_Escalator2= make_edge("EscalatorD_L3", "EscalatorA_L2", 100)
    Transition_links.append(rg.Line(myNodeDict["EscalatorA_L2"],myNodeDict["EscalatorD_L3"]))
    
    edge_L2_L3_Escalator3= make_edge("EscalatorC_L2", "EscalatorE_L3", 100)
    edge_L3_L2_Escalator3= make_edge("EscalatorE_L3", "EscalatorC_L2", 100)
    Transition_links.append(rg.Line(myNodeDict["EscalatorC_L2"],myNodeDict["EscalatorE_L3"]))
    
    Lift_Network.append(edge_L2_L3_Lift1)
    Lift_Network.append(edge_L3_L2_Lift1)
    Lift_Network.append(edge_L2_L3_Lift2)
    Lift_Network.append(edge_L3_L2_Lift2)
    
    Escalator_Network.append(edge_L2_L3_Escalator1)
    Escalator_Network.append(edge_L3_L2_Escalator1)
    Escalator_Network.append(edge_L2_L3_Escalator2)
    Escalator_Network.append(edge_L3_L2_Escalator2)
    Escalator_Network.append(edge_L2_L3_Escalator3)
    Escalator_Network.append(edge_L3_L2_Escalator3)
    
    # Level 1 to Level 2
    edge_L1_L2_Lift1 = make_edge("LiftA_L1", "LiftA_L2", 100)
    edge_L2_L1_Lift1  = make_edge("LiftA_L2", "LiftA_L1", 100)
    Transition_links.append(rg.Line(myNodeDict["LiftA_L2"],myNodeDict["LiftA_L1"]))
    
    edge_L1_L2_Lift2 = make_edge("LiftB_L1", "LiftB_L2", 100)
    edge_L2_L1_Lift2  = make_edge("LiftB_L2", "LiftB_L1", 100)
    Transition_links.append(rg.Line(myNodeDict["LiftB_L1"],myNodeDict["LiftB_L2"]))
    
    edge_L1_L2_Escalator1= make_edge("EscalatorC_L1", "EscalatorB_L2", 100)
    edge_L2_L1_Escalator1= make_edge("EscalatorB_L2", "EscalatorC_L1", 100)
    Transition_links.append(rg.Line(myNodeDict["EscalatorC_L1"],myNodeDict["EscalatorB_L2"]))
    
    edge_L1_L2_Escalator2= make_edge("EscalatorA_L1", "EscalatorC_L2", 100)
    edge_L2_L1_Escalator2= make_edge("EscalatorC_L2", "EscalatorA_L1", 100)
    Transition_links.append(rg.Line(myNodeDict["EscalatorA_L1"],myNodeDict["EscalatorC_L2"]))
    
    edge_L1_L2_stair= make_edge("StairsA_L1", "StairsA_L2", 100)
    edge_L2_L1_stair= make_edge("StairsA_L2", "StairsA_L1", 100)
    Transition_links.append(rg.Line(myNodeDict["StairsA_L1"],myNodeDict["StairsA_L2"]))
    
    Lift_Network.append(edge_L1_L2_Lift1)
    Lift_Network.append(edge_L2_L1_Lift1)
    Lift_Network.append(edge_L1_L2_Lift2)
    Lift_Network.append(edge_L2_L1_Lift2)
    
    Escalator_Network.append(edge_L1_L2_Escalator1)
    Escalator_Network.append(edge_L2_L1_Escalator1)
    Escalator_Network.append(edge_L1_L2_Escalator2)
    Escalator_Network.append(edge_L2_L1_Escalator2)
    
    Stair_Network.append(edge_L1_L2_stair)
    Stair_Network.append(edge_L2_L1_stair)
    

    return Lift_Network, Escalator_Network, Stair_Network, Transition_links

if run:
    print len(NetworkL4)
    print len(NetworkL5)

    
    #route = mygraph.dijkstra("MyerL4", "Target")
    #route = mygraph.dijkstra("MyerL4", "Myer L5")
    #route = mygraph.dijkstra("MyerL4", "Pochana")
    
    NodeDic = NodeDicL1 + NodeDicL2 + NodeDicL3 + NodeDicL4 + NodeDicL5 + NodeDicL6
    Lift_Network, Escalator_Network, Stair_Network, Transition_links = Transition(NodeDic)
    
    NetworkFloors = NetworkL1 + NetworkL2 + NetworkL3 + NetworkL4 + NetworkL5 + NetworkL6
    
    if flag == 0:
        Network =  NetworkFloors + Lift_Network + Escalator_Network + Stair_Network
    elif flag == 1:
        Network = NetworkFloors + Lift_Network + Escalator_Network
    else:
        Network = NetworkFloors + Lift_Network
    
    
    mygraph = Graph(Network)
    route = mygraph.dijkstra(departure, destination)
# ---------- end python_133 ----------
line_8 = Line(python_133.Transition_links)
python_134 = GhPythonScript(run=Toggle(False), Network=python_133.Network, departure="MyerL3", destination="Prada")  # -> route; inputs run: Boolean, Network: list; same code as python_80
list_64 = ValueList({"None": "", "Dot": "0.1 1.0", "Dash": "1.0", "DashDot": "1.0 1.0 0.1 1.0"}, selected="None")
python_135 = GhPythonScript(route=python_133.route, NodeDic=python_133.NodeDic)  # -> out, Links; inputs run: Boolean, route: list, NodeDic: list; same code as python_81
c_script_55 = CSharpScript(Curve=python_135.Links, Width=Slider(4, range=0..10), Colour="0,0,255", Dash=list_64)  # -> out, A, B; inputs Curve: Curve, Width: Int32, Colour: Color, Dash: String; same code as c_script
len_6 = Length(Curve=python_135.Links)
ma_6 = MassAddition(Input=len_6)  # -> Result, PartialResults
panel_54 = Panel(ma_6.Result)

crv_19 = Curve(python_130.Links)
crv_20 = Curve(python_130.Links)
move_110 = Move(Geometry=crv_20, Motion=X_11)  # -> Geometry, Transform
crv_21 = Curve([crv_19, python_15.Links, python_18.Links, python_125.Links, python_21.Links, python_12.Links, line_8])  # disabled
crv_22 = Curve([move_16.Geometry, holes_shops_2, move_36.Geometry, holes_shops_4, move_26.Geometry, holes_shops_3, move_6.Geometry, holes_shops, move_97.Geometry, holes_shops_6, move_88.Geometry, holes_shops_5, line_8])
panel_55 = Panel(python_133.route)
